# Dynamo graph AulaMatrizModular.dyn (Dynamo 3.0.3.7597)

# group: Constroi uma matriz de vigas. Usa controle modular
# Prof: José Luis Menegotto
# Escola Politécnica da UFRJ
quantidade_módulos_x = IntegerSlider(6, range=1..20 step 1)
quantidade_módulos_y = IntegerSlider(3, range=1..10 step 1)
dim_h = DoubleSlider(4.9, range=3..6 step 0.1)
dim_v = DoubleSlider(5.8, range=3..6 step 0.1)
posição_dos_apóios = IntegerSlider(0, range=0..5 step 1)
proporção_modular_em_x = DoubleSlider(0.25, range=0..0.5 step 0.125)
proporção_modular_em_y = DoubleSlider(0.5, range=0..0.5 step 0.125)
módular_em_x = IntegerSlider(5, range=1..5 step 1)
módular_em_y = IntegerSlider(2, range=1..5 step 1)
constroi_matriz_de_vigas = CodeBlock(qx=quantidade_módulos_x, qy=quantidade_módulos_y, dx=dim_h, dy=dim_v, da=posição_dos_apóios, px=proporção_modular_em_x, py=proporção_modular_em_y, modx=módular_em_x, mody=módular_em_y)
# ---------- constroi_matriz_de_vigas.designscript (40 lines) ----------
qx;
qy;
dx;
dy;
mdx = qx/2;
da;
px;
py;
dav = da%mdx;
mx  = dx * px;
my  = dy * py;
//----------------------------------------------
// Valores de X e de Y com variação modular
//----------------------------------------------
x   = i%modx ? (i*dx+mx) : (i * dx);
y   = k%mody ? (i*dy+my) : (k * dy);
//----------------------------------------------
// Índices i k para traçado de vigas
//----------------------------------------------
i   = 0..qx;
k   = 0..qy;
//----------------------------------------------
// Matriz de pontos e Traçado das Vigas
//----------------------------------------------
PH  = Point.ByCoordinates ( x<1>, y   , 0 );
PV  = Point.ByCoordinates ( x   , y<1>, 0 );
VH  = Line.ByStartPointEndPoint( PH[i], PH[i+1]);
VV  = Line.ByStartPointEndPoint( PV[k], PV[k+1]);
//----------------------------------------------
// Índices para definir os apóios
//----------------------------------------------
PAP = [ PH[dav][ 0] , PH[-dav-1][ 0],
        PH[dav][-1] , PH[-dav-1][-1] ];
Apo = Circle.ByCenterPointRadius( PAP , 1 );
//---------------------------------------------
// Dicionário para Ordenar os dados
//---------------------------------------------
Key = [ "PH", "VH", "VV", "PAP"];
Val = [  PH ,  VH ,  VV ,  PAP ];
DIC = Dictionary.ByKeysValues ( Key ,  Val );
# ----------------------------------------
