# Dynamo graph AulaMatrizModular2.dyn (Dynamo 3.0.3.7597)

# group: Matriz retangular com divisão e uso de função Line.Intersect
# Prof. José Luis Menegotto
# Escola Politécnica da UFRJ
dim_x = DoubleSlider(14.5, range=5..30 step 0.25)
dim_y = DoubleSlider(16, range=5..50 step 0.5)
quant_h = DoubleSlider(5, range=1..10 step 1)
quant_v = DoubleSlider(2, range=1..10 step 1)
matriz_dividida = CodeBlock(dx=dim_x, dy=dim_y, qx=quant_h, qy=quant_v)
# ---------- matriz_dividida.designscript (30 lines) ----------
dx;
dy;
qx;
qy;
//-----------------------------------------------
i   = 0..1..(1/qx);
j   = 0..1..(1/qy);
ii  = 1..qx-1;
jj  = 1..qy-1;
x   = 0..dx..dx;
y   = 0..dy..dy;
//------------------------------------------------
QH  = Point.ByCoordinates       ( x<1>, y   , 0 );
QV  = Point.ByCoordinates       ( x   , y<1>, 0 );
//------------------------------------------------
LH  = Line.ByStartPointEndPoint ( QH[0] , QH[1] );
LV  = Line.ByStartPointEndPoint ( QV[0] , QV[1] );
//------------------------------------------------
PPH = LH<1>.PointAtParameter    ( i[ii]         );
PPV = LV<1>.PointAtParameter    ( j[jj]         );
PPE = [PPH, PPV];
//------------------------------------------------
L1  = Line.ByStartPointEndPoint ( PPH[0], PPH[1] );
L2  = Line.ByStartPointEndPoint ( PPV[0], PPV[1] );
//------------------------------------------------
PIN = Line.Intersect            ( L1<1> , L2    );
//------------------------------------------------
Key = [ "P_canto", "P_Perim", "P_Inter"];
Val = [  QH      ,  PPE     ,  PIN     ];
DIC = Dictionary.ByKeysValues ( Key ,  Val );
# ----------------------------------------
