# Dynamo graph Aula_PPE_04.dyn "Aula_PPE" (Dynamo 2.18.1.5096)

categories = Categories("OST_SiteProperty")
all_elements_of_category = ElementsOfCategory(Category=categories)
categories_2 = Categories("OST_Mass")
all_elements_of_category_2 = ElementsOfCategory(Category=categories_2)
number_slider = DoubleSlider(1, range=1..10 step 1)
seleção_da_divisa_e_extração_da = CodeBlock(divisas=all_elements_of_category, predios=all_elements_of_category_2, n=number_slider)  # "Seleção da divisa e extração da poligonal"
# ---------- seleção_da_divisa_e_extração_da.designscript (14 lines) ----------
divisas;
predios;
Qdiv = List.Count(divisas);
n;
Lote  = divisas[n % Qdiv];
Lot_E = Lote.Geometry (   );
Pol_L = PolyCurve.ByJoinedCurves ( Lot_E , 0 );
Are_L = FamilyInstance.GetParameterValueByName(Lote , "Area");
//------------------------------------------------------------
//Extração de resultados utilizando Dicionário
//------------------------------------------------------------
Key   = ["Lote" , "Area" , "Predios"];
Val   = [ Pol_L ,  Are_L ,  predios ];
DIC   = Dictionary.ByKeysValues ( Key , Val );
# ----------------------------------------
number_slider_2 = DoubleSlider(2, range=0..8 step 0.5)
análise_da_geometria_do_lote = CodeBlock(DadosLote=seleção_da_divisa_e_extração_da.DIC, DAF=number_slider_2)
# ---------- análise_da_geometria_do_lote.designscript (24 lines) ----------
DadosLote;
Vx = Vector.XAxis();
Vy = Vector.YAxis();
Vz = Vector.ZAxis();
//------------------------------------------
// Captura Linhas da divisa
//------------------------------------------
LOTE  = DadosLote["Lote"];
PRED  = DadosLote["Predios"];
OCUP  = LOTE.Offset  (-DAF , false );
LinO  = LOTE.Explode (             );

Nor   = LinO.NormalAtParameter( 0.5 );
Pnt   = LinO.PointAtParameter ( 0.5 );
Dim   = LinO.Length;
Ptm   = Line.ByStartPointDirectionLength( Pnt, Nor, Dim/10);

Eixo1 = Line.ByBestFitThroughPoints(Pnt);
Pcent = Eixo1.PointAtParameter  ( 0.5 );
Tng   = Eixo1.TangentAtParameter( 0.5 );
Ang   = 90 - Vector.AngleWithVector( Vx , Tng);
Eixo2 = Eixo1.Rotate ( Pcent , Vz , Ang);

FamilyType.SetLocation(PRED[0], Pcent);
# ----------------------------------------
watch = Watch(seleção_da_divisa_e_extração_da.DIC)
levels = Levels("Térreo")
