# Dynamo graph Aula_PPE_04b.dyn (Dynamo 2.18.1.5096)

# group: Função para o estudo de ocupação em Lotes
# Escola Politécnica UFRJ.
# Prof. José Luis Menegotto
categories = Categories("OST_SiteProperty")
all_elements_of_category = ElementsOfCategory(Category=categories)
número_de_lote = DoubleSlider(4, range=1..10 step 1)
distancia_afastamento = DoubleSlider(3, range=0..8 step 0.5)
taxa_ocupação = DoubleSlider(0.3, range=0.1..1 step 0.05)
coeficiente_de_aproveitamento = DoubleSlider(4, range=1..10 step 1)
altura_do_andar_projetado = DoubleSlider(4.14, range=3.24..6.48 step 0.18)
elementos_formais_do_lote = CodeBlock(divisas=all_elements_of_category, n=número_de_lote, DAF=distancia_afastamento, TOC=taxa_ocupação, COA=coeficiente_de_aproveitamento, AAN=altura_do_andar_projetado)
# ---------- elementos_formais_do_lote.designscript (66 lines) ----------
divisas;
n;
DAF;
TOC;
COA;
AAN;
//---------------------------------------------
// Constantes
//---------------------------------------------
Vx   = Vector.XAxis();
Vy   = Vector.YAxis();
Vz   = Vector.ZAxis();
Vf   = Vector.ByCoordinates(FTO, 0 , 0);
ATC  = COA * ALOT;
ALT  = COA * AAN;
FTO  = Math.Sqrt(TOC);
Qdiv = List.Count(divisas);
//---------------------------------------------
// Para processar um lote de cada vez
//---------------------------------------------
//LOTE = divisas[n % Qdiv];
//---------------------------------------------
// Para processar todos os lotes
//---------------------------------------------
LOTE = divisas[0..Qdiv-1];
//---------------------------------------------
// Processamento
//---------------------------------------------
LGEO = LOTE.Geometry (   );
DIVI = PolyCurve.ByJoinedCurves ( LGEO , 0 );
ALOT = LOTE.GetParameterValueByName("Area");
//---------------------------------------------
// Captura Linhas da divisa e faz offset
//---------------------------------------------
OCUP = DIVI.Offset  (-DAF , false );
LIMI = DIVI.Explode (             );
AREO = ALOT * TOC;
LADO = Math.Sqrt    ( AREO        );
//---------------------------------------------
// Pontos extremos dos limites da divisa
// e Eixo Médio do lote
//---------------------------------------------
PLIMI = LIMI.PointAtParameter ( 0 );
EIXOM = Line.ByBestFitThroughPoints ( PLIMI );
//---------------------------------------------
// Dimensiona Volume pela taxa de ocupação
//---------------------------------------------
BASE = EIXOM.PointAtParameter ( 0.5  );
Po1  = BASE.Add ( Vx );
Po2  = BASE.Add ( Vf );
SULO = Autodesk.Surface.ByPatch ( DIVI );
SUED = Geometry.Scale  (SULO, BASE, Po1, Po2 );
ARED = SUED.Area;
VOED = Autodesk.Surface.Thicken(SUED, -ALT, false);
//---------------------------------------------
//Extração de resultados utilizando Dicionário
//---------------------------------------------
Key = ["Divisa", "Area" ,"Limites" ,
       "AreaO" , "Lado" ,"EixoM"   ,
       "VoEd"
      ];
Val = [ DIVI   , ALOT   , LIMI     ,
        AREO   , LADO   , EIXOM    ,
        VOED
      ];
DIC = Dictionary.ByKeysValues ( Key , Val );
# ----------------------------------------
