# Dynamo graph Aula_PPE_05.dyn (Dynamo 2.18.1.5096)

# group: Função para o estudo de ocupação em Lotes
# Escola Politécnica UFRJ.
# Prof. José Luis Menegotto
categories = Categories("OST_SiteProperty")
all_elements_of_category = ElementsOfCategory(Category=categories)
número_de_lote = DoubleSlider(7, range=1..10 step 1)
distancia_afastamento = DoubleSlider(0, range=0..8 step 0.5)
taxa_ocupação = DoubleSlider(0.7, range=0.1..1 step 0.05)
coeficiente_de_aproveitamento = DoubleSlider(3, range=1..10 step 1)
altura_do_andar_projetado = DoubleSlider(4.86, range=3.24..6.48 step 0.18)
floor_types = FloorTypes("150mm Foundation Slab")
elementos_formais_do_lote = CodeBlock(divisas=all_elements_of_category, n=número_de_lote, DAF=distancia_afastamento, TOC=taxa_ocupação, COA=coeficiente_de_aproveitamento, AAN=altura_do_andar_projetado, TIP=floor_types)
# ---------- elementos_formais_do_lote.designscript (67 lines) ----------
divisas;
n;
DAF;
TOC;
COA;
AAN;
TIP;
//---------------------------------------------
// Constantes
//---------------------------------------------
Vx   = Vector.XAxis();
Vy   = Vector.YAxis();
Vz   = Vector.ZAxis();
Vf   = Vector.ByCoordinates(FTO, 0 , 0);
ATC  = COA * ALOT;
ALT  = COA * AAN;
FTO  = Math.Sqrt(TOC);
Qdiv = List.Count(divisas);
//---------------------------------------------
// Para processar um lote de cada vez
//---------------------------------------------
LOTE = divisas[n % Qdiv];
//---------------------------------------------
// Para processar todos os lotes
//---------------------------------------------
//LOTE = divisas[0..Qdiv-1];
//---------------------------------------------
// Processamento
//---------------------------------------------
LGEO = LOTE.Geometry (   );
DIVI = PolyCurve.ByJoinedCurves ( LGEO , 0 );
ALOT = LOTE.GetParameterValueByName("Area");
//---------------------------------------------
// Captura Linhas da divisa e faz offset
//---------------------------------------------
OCUP = DIVI.Offset  (-DAF , false );
LIMI = DIVI.Explode (             );
AREO = ALOT * TOC;
LADO = Math.Sqrt    ( AREO        );
//---------------------------------------------
// Pontos extremos dos limites da divisa
// e Eixo Médio do lote
//---------------------------------------------
PLIMI = LIMI.PointAtParameter ( 0 );
EIXOM = Line.ByBestFitThroughPoints ( PLIMI );
//---------------------------------------------
// Dimensiona Volume pela taxa de ocupação
//---------------------------------------------
BASE = EIXOM.PointAtParameter ( 0.5  );
Po1  = BASE.Add ( Vx );
Po2  = BASE.Add ( Vf );
SULO = Autodesk.Surface.ByPatch ( DIVI );
EDSU = SULO.Scale  (BASE, Po1, Po2 );
ARED = EDSU.Area;
EDVO = EDSU.Thicken( -ALT , 0);
//---------------------------------------------
//Extração de resultados utilizando Dicionário
//---------------------------------------------
Key = ["Divisa", "Area"  ,"Limites" ,"CoefApr",
       "AreaO" , "Lado"  ,"EixoM"   ,"AlAndar",
       "EdVolu", "EdPeri", "TipoLJ"
      ];
Val = [ DIVI   , ALOT   , LIMI     , COA ,
        AREO   , LADO   , EIXOM    , AAN ,
        EDVO   , EDSU   , TIP
      ];
DIC = Dictionary.ByKeysValues ( Key , Val );
# ----------------------------------------
cria_niveis = CodeBlock(Dados=elementos_formais_do_lote.DIC)
# ---------- cria_niveis.designscript (27 lines) ----------
Dados;
COA = Dados["CoefApr"];
AAN = Dados["AlAndar"];
VOL = Dados["EdVolu"];
LIM = Dados["EdPeri"];
TIP = Dados["TipoLJ"];
//------------------------------------------------
// Constantes
//------------------------------------------------
COB = "Cobertura";
TER = "Térreo";
AND = "° Pavto";
Vz  = Vector.ZAxis();
//------------------------------------------------
// Define os Andares
//------------------------------------------------
NUM = Math.Floor( 0..COA );
NOM = NUM==0 ? TER : NUM==NUM[-1]? COB : NUM+AND;
LEV = Level.ByElevationAndName ( NUM*AAN , NOM);
//------------------------------------------------
// Coloca poligonais abstratas das Lajes
//------------------------------------------------
a   = 0..COA;
ALA = LEV[a].Elevation;
PER = LIM.PerimeterCurves (            );
PCJ = PER.Translate       ( Vz, ALA<1> );
LAJ = Revit.Floor.ByOutlineTypeAndLevel(PCJ, TIP, LEV);
# ----------------------------------------
