# Dynamo graph Aula_PPE_10.dyn (Dynamo 3.0.3.7597)

# group: Treliça Espacial Equilátera
# Prof. José Luis Menegotto
# Escola Politécnica da UFRJ
quantidade_de_módulos_em_x = DoubleSlider(7, range=1..15 step 1)
quantidade_de_módulos_em_y = DoubleSlider(7, range=1..15 step 1)
dimensão_do_módulo = DoubleSlider(1.25, range=1..3 step 0.25)
apoios_em = DoubleSlider(2, range=0..3 step 1)
treliça_espacial_equilátera = CodeBlock(qx=quantidade_de_módulos_em_x, qy=quantidade_de_módulos_em_y, di=dimensão_do_módulo, ap=apoios_em)
# ---------- treliça_espacial_equilátera.designscript (56 lines) ----------
qx;
qy;
di;
ap;
dm  = di/2;
qi  = qy<=qx ? qx-1 : qy-1;
qj  = qy<=qx ? qx-1 : qy-1;
qk  = qy<=qx ? qx-1 : qy-1;
ql  = qy<=qx ? qx-2 : qy-2;
//-----------------------------------------------------
alt = Math.Cos(60)*Math.Sqrt(2) * di;
i   = 0..qi;
j   = 0..qj;
k   = 0..qk;
l   = 0..ql;
//-----------------------------------------------------
// Vetores das Diagonais
//-----------------------------------------------------
V1  = Vector.ByCoordinates( dm ,  dm , -alt);
V2  = Vector.ByCoordinates(-dm ,  dm , -alt);
V3  = Vector.ByCoordinates(-dm , -dm , -alt);
V4  = Vector.ByCoordinates( dm , -dm , -alt);
LVE = [V1,V2,V3,V4];
DVE = V1.Length;
//-----------------------------------------------------
// Posicionamento dos Pontos
//-----------------------------------------------------
cxi = 0..( di * qx )..di;
cyi = 0..( di * qy )..di;
cxs = List.DropItems      ( cxi , 1 ) - dm;
cys = List.DropItems      ( cyi , 1 ) - dm;
//-----------------------------------------------------
phi = Point.ByCoordinates ( cxi<1> , cyi ,  0  );
phs = Point.ByCoordinates ( cxs<1> , cys , alt );
pvi = List.Transpose      ( phi                );
pvs = List.Transpose      ( phs                );
//-----------------------------------------------------
// Barras do Banzo Inferior
//-----------------------------------------------------
BHI = Line.ByStartPointEndPoint( phi[i] , phi[i+1] );
BVI = Line.ByStartPointEndPoint( pvi[j] , pvi[j+1] );
//-----------------------------------------------------
// Barras do Banzo Superior
//-----------------------------------------------------
BHS = Line.ByStartPointEndPoint( phs[k] , phs[k+1] );
BVS = Line.ByStartPointEndPoint( pvs[l] , pvs[l+1] );
//-----------------------------------------------------
// Barras das Diagonais
//-----------------------------------------------------
DIA = Line.ByStartPointDirectionLength(phs,LVE<1>,DVE);
//-----------------------------------------------------
// Extração de resultados utilizando Dicionário
//-----------------------------------------------------
Key = [ "Apoios", "Quan-X", "Quan-Y", "PntosH"];
Val = [  ap     ,  qx     ,  qy     ,  phi    ];
DIC = Dictionary.ByKeysValues ( Key ,  Val );
# ----------------------------------------
define_a_posição_dos_apóios = CodeBlock(Dados=treliça_espacial_equilátera.DIC)
# ---------- define_a_posição_dos_apóios.designscript (18 lines) ----------
Dados;
ap  = Dados[ "Apoios" ];
qx  = Dados[ "Quan-X" ];
qy  = Dados[ "Quan-Y" ];
phi = Dados[ "PntosH" ];
//-----------------------------------------
// Índices de marcação
//-----------------------------------------
r   = 0.25;
i   =   ap;
j   = -1-i;
k   = qy-i;
//-----------------------------------------
// Pontos dos Apóios
//-----------------------------------------
LAP = [ phi[i][k], phi[j][k],
        phi[i][i], phi[j][i] ];
AP1 = Circle.ByCenterPointRadius( LAP , r );
# ----------------------------------------
