# Dynamo graph Barra.dyn (Dynamo 3.5.0.8297)

# group: Define o eixo de uma barra de reforço
# Prof. José Luis Menegotto / Escola Politécnica
# Programa de Mestrado em Estruturas
comprimento_total = DoubleSlider(8.6, range=1..12 step 0.1)
parametro_a = DoubleSlider(0.05, range=0.05..0.2 step 0.01)
parametro_b = DoubleSlider(0.05, range=0..0.1 step 0.01)
altura_do_gancho = DoubleSlider(0.3, range=0.3..0.4 step 0.025)
marca_a_barra = CodeBlock(c=comprimento_total, a=parametro_a, b=parametro_b, g=altura_do_gancho)
# ---------- marca_a_barra.designscript (26 lines) ----------
c;
a;
b;
p = a+b;
//------------------------------------------------
// A lista d tem os valores paramétricos
// para distribuir os pontos em X si o parâmetro b
// é = 0 o gancho é reto
//------------------------------------------------
d   = [0 , a , p , 1-p , 1-a , 1];
x   =  c * d;
y   =  (0..1) * g;
//------------------------------------------------
// Listas com o perfil das barras
//------------------------------------------------
b1  = [0,10];
b2  = [1,0,10];
b3  = [0,10,11];
b4  = [1,0,10,11];
b5  = [1,3,4,6,9,11];
//------------------------------------------------
// Traçado da barra
//------------------------------------------------
LP  = Point.ByCoordinates ( x<1> , y, 0 );
LPF = List.Flatten        ( LP      , 1 );
BAR = PolyCurve.ByPoints  ( LPF[b5] , 0 );
# ----------------------------------------
