# Dynamo graph Eixos_Modulados.dyn (Dynamo 3.0.3.7597)

# group: Cria Eixos Modulados e cotados
# Prof: José Luis Menegoitto
# Escola Politécnica da UFRJ
views = Views("Térreo")
quantidade_módulos_x = IntegerSlider(10, range=2..30 step 1)
dimensão_módulo_x = DoubleSlider(1.5, range=1..6 step 0.25)
razão_módulo_x = DoubleSlider(0.25, range=0.25..0.75 step 0.125)
valor_modular_em_x = IntegerSlider(2, range=1..5 step 1)
valor_modular_em_x_2 = IntegerSlider(10, range=10..30 step 2)
eixos_modulados = CodeBlock(vis=views, qx=quantidade_módulos_x, dx=dimensão_módulo_x, rx=razão_módulo_x, mx=valor_modular_em_x, sy=valor_modular_em_x_2)
# ---------- eixos_modulados.designscript (26 lines) ----------
vis;
qx;
dx;
rx;
mx;
sy;
PAR = "Name";
//--------------------------------------------------
ix  = -qx/2..qx/2;
dex = dx * rx;
Cx  = dx * ix + (ix%mx ? dex : 0);
//--------------------------------------------------
PX1 = Point.ByCoordinates ( Cx ,  sy     , 0 );
PX2 = PX1.Translate       ( 0  , -sy*2.0 , 0 );
PX3 = PX1.Translate       ( 0  , -sy*2.1 , 0 );
//--------------------------------------------------
// Colocação de eixos com cotas
//--------------------------------------------------
nume = List.IndexOf(ix, ix)+1;
nome = ""+nume;
eix  = Grid.ByStartPointEndPoint ( PX1 , PX2 );
eix.SetParameterByName           ( PAR , nome);
//--------------------------------------------------
ldi  = Line.ByStartPointEndPoint ( PX3[0], PX3[-1]);
ref  = eix.Curve;
dim  = Dimension.ByElements ( vis,eix,ldi,"","" );
# ----------------------------------------

watch = Watch(eixos_modulados.nome)

# group: Modifica Posição Símbolos de Vista
# Prof. José Luis Menegotto
# Escola Politécnica da UFRJ
categories = Categories("OST_Elev")
all_elements_of_category = ElementsOfCategory(Category=categories)
abrir_espaço = BoolSelector(true)
ajustar_marcas_de_vistas = CodeBlock(simb=all_elements_of_category, abre=abrir_espaço)
# ---------- ajustar_marcas_de_vistas.designscript (20 lines) ----------
simb;
abre;
param = "View Name";
//-------------------------------------------
n   = abre ? 1 : -1;
SIM = simb.GetParameterValueByName( param );
lvi = [
        "Leste","Norte","Oeste","Sul",
        "Este" ,"Norte","Oeste","Sur",
        "East" ,"North","West" ,"South"
      ];
dex = [ n*1, 0   , n*-1 , 0   ];
dey = [ 0  , n*1 , 0    , n*-1];
i   = List.IndexOf( SIM , lvi);
//-------------------------------------------
VEC = Vector.ByCoordinates ( dex[i], dey[i]);
//-------------------------------------------
tra = Transaction.Start ( simb );
tra.MoveByVector( VEC  );
Transaction.End ( tra );
# ----------------------------------------
