# Dynamo graph MoverElevação.dyn (Dynamo 3.0.3.7597)

categories = Categories("OST_Elev")
views = Views("Nível 1")
all_elements_of_category_in_view = ElementsOfCategoryInView(Category=categories, View=views)
code_block = CodeBlock(elev=all_elements_of_category_in_view)
# ---------- code_block.designscript (9 lines) ----------
elev;
v1  = Vector.ByCoordinates(  0,  1, 0 );
v2  = Vector.ByCoordinates(  1,  0, 0 );
v3  = Vector.ByCoordinates( -1,  0, 0 );
v4  = Vector.ByCoordinates(  0, -1, 0 );
Lv  = [v1, v2, v3, v4];
tra = Transaction.Start   ( elev );
Revit.Element.MoveByVector( tra, Lv);
Transaction.End(tra);
# ----------------------------------------
