# Dynamo graph Mover_Simbolo_Vista.dyn (Dynamo 3.0.3.7597)

# group: Modifica Posição Símbolos de Vista
# Prof. José Luis Menegotto
# Escola Politécnica da UFRJ
categories = Categories("OST_Elev")
all_elements_of_category = ElementsOfCategory(Category=categories)
abrir_espaço = BoolSelector(false)
ajustar_marcas_de_vistas = CodeBlock(simb=all_elements_of_category, abre=abrir_espaço)
# ---------- ajustar_marcas_de_vistas.designscript (19 lines) ----------
simb;
abre;
param = "View Name";
//----------------------------------------
n   = abre ? 1 : -1;
SIM = simb.GetParameterValueByName(param);
lvi = [ "Leste","Norte","Oeste","Sul",
        "Este" ,"Norte","Oeste","Sur",
        "East" ,"North","West" ,"South" ];
//----------------------------------------
dx  = [ n*1, 0   , n*-1 , 0   ];
dy  = [ 0  , n*1 , 0    , n*-1];
i   = List.IndexOf( SIM , lvi);
//----------------------------------------
vec = Vector.ByCoordinates (dx[i], dy[i]);
//----------------------------------------
tra = Transaction.Start ( simb );
tra.MoveByVector ( vec );
Transaction.End  ( tra );
# ----------------------------------------
