# Dynamo graph PPE_Aula06a.dyn (Dynamo 2.18.1.5096)

# group: Construção de matriz regular para Vigamentos
# Prof. José Luis Menegotto
# Escola Politécnica da UFRJ
quantidade_de_módulos_em_x = DoubleSlider(4, range=1..10 step 1)
quantidade_de_módulos_em_y = DoubleSlider(1, range=1..10 step 1)
dimensão_do_módulo_em_x = DoubleSlider(3.2, range=1..10 step 0.1)
dimensão_do_módulo_em_y = DoubleSlider(3, range=1..10 step 0.1)
angulo_de_inclinação = DoubleSlider(0, range=0..30 step 0.1)
matriz_regular_para_vigamentos = CodeBlock(qx=quantidade_de_módulos_em_x, qy=quantidade_de_módulos_em_y, dx=dimensão_do_módulo_em_x, dy=dimensão_do_módulo_em_y, ang=angulo_de_inclinação)
# ---------- matriz_regular_para_vigamentos.designscript (34 lines) ----------
qx;
qy;
qz = 0;
dx;
dy;
ang;
inc = Math.Tan ( ang );
vic = Vector.ByCoordinates( 0 , cy , 0 );
cx  = ( ( 0..qx ) * dx );
cy  = ( ( 0..qy ) * dy );
//--------------------------------------------------
// Indices
//--------------------------------------------------
h   = 0..qx-1;
v   = 0..qy-1;
hh  = h+1;
vv  = v+1;
//--------------------------------------------------
// Pontos da matriz
//--------------------------------------------------
LPI = Point.ByCoordinates ( cx, cx*inc , qz);
LPH = Point.Add           ( LPI<1> ,   vic );
LPV = List.Transpose      ( LPH            );
//--------------------------------------------------
// Linhas horizontais e verticais
//--------------------------------------------------
VIH = Line.ByStartPointEndPoint ( LPH[h], LPH[hh] );
VIV = Line.ByStartPointEndPoint ( LPV[v], LPV[vv] );
//--------------------------------------------------
//Extração de resultados utilizando Dicionário
//--------------------------------------------------
Key = ["PontosH", "PontosV", "VigasH", "VigasV"];
Val = [   LPH   ,    LPV   ,   VIH   ,    VIV  ];
DIC = Dictionary.ByKeysValues ( Key , Val );
# ----------------------------------------
