# Dynamo graph PPE_Aula06b.dyn (Dynamo 3.0.3.7597)

# group: Função para marcação de treliças
# Escola Politécnica UFRJ.
# Prof. José Luis Menegotto
vão_total_da_treliça = DoubleSlider(7.25, range=5..20 step 0.25)
quantidade_de_módulos = DoubleSlider(16, range=4..40 step 4)
angulo = DoubleSlider(5, range=0..15 step 5)
altura_inicial_entre_banzos = DoubleSlider(0.5, range=0.5..2 step 0.1)
aguas_1_2_3_2_invertidas = DoubleSlider(1, range=1..3 step 1)
banzos_paralelos = BoolSelector(true)
treliças_pratt_0_howe_1 = DoubleSlider(1, range=0..1 step 1)
marcação_das_barras_de_treliças = CodeBlock(vao=vão_total_da_treliça, qmo=quantidade_de_módulos, ang=angulo, alt=altura_inicial_entre_banzos, agu=aguas_1_2_3_2_invertidas, par=banzos_paralelos, tre=treliças_pratt_0_howe_1)
# ---------- marcação_das_barras_de_treliças.designscript (52 lines) ----------
vao;
qmo;
ang;
alt;
agu;
par;
tre;
//-----------------------------------------------------
vx   = vao/2;
qme  = qmo/2;
inc  = Math.Tan( ang );
//-----------------------------------------------------
// Formação das listas de índices
//-----------------------------------------------------
x    = vx..-vx..#qmo+1;
i    = List.Flatten([ qme..0   , 1..qme] , 1 );
j    = List.Flatten([ 0..qme-1 , qme..0] , 1 );
w    = List.Flatten([ qmo..0           ] , 1 );
indi = agu== 1 ? w :  agu== 2 ? i : j;
vzi  = x   * inc;
vzs  = vzi + alt;
//-----------------------------------------------------
albi = par== 0 ? 0         : vzi[indi];
albs = par== 0 ? vzs[indi] : vzs[indi];
//-----------------------------------------------------
// Pontos do Banzo inferior e superior
//-----------------------------------------------------
PTI = Point.ByCoordinates( x , 0 , albi );
PTS = Point.ByCoordinates( x , 0 , albs );
//-----------------------------------------------------
// Indices das metades esquerda e direita
//-----------------------------------------------------
i1  = 0  ..qme-1;
i2  = qme..qmo-1;
//-----------------------------------------------------
// Os indices k l são invertidos caso o sistema seja
// Pratt ou Howe. Indice m usado em treliça de 1 água
//-----------------------------------------------------
k   = tre==0? i1 : i2;
l   = tre==0? i2 : i1;
m   = 0..qmo-1;
//-----------------------------------------------------
// Barras de Montantes, Banzo Inferior, Banzo Superior
// Diagonais esquerdas e direitas ou todas
//-----------------------------------------------------
BMO =        Line.ByStartPointEndPoint ( PTI    , PTS      );
BDE = agu>1? Line.ByStartPointEndPoint ( PTS[k] , PTI[k+1] ):null;
BDD = agu>1? Line.ByStartPointEndPoint ( PTI[l] , PTS[l+1] ):null;

BDA = agu<2? Line.ByStartPointEndPoint ( PTS[m] , PTI[m+1] ):null;
BBI =        Line.ByStartPointEndPoint ( PTI[m] , PTI[m+1] );
BBS =        Line.ByStartPointEndPoint ( PTS[m] , PTS[m+1] );
# ----------------------------------------
