# Dynamo graph PPE_Aula06c.dyn (Dynamo 2.18.1.5096)

# group: Marcação de disposição em Shed
# Prof. José Luis Menegotto
# Escola Politécnica da UFRJ
quantidade_de_módulos_em_x = DoubleSlider(26, range=1..30 step 1)
dimensão_do_módulo_em_x = DoubleSlider(5.9, range=1..10 step 0.1)
dimensão_do_módulo_em_y = DoubleSlider(2.75, range=0..5 step 0.25)
altura_inicial = DoubleSlider(6, range=-20..20 step 0.25)
modular = DoubleSlider(13, range=1..13 step 1)
modulação_de_treliças_em_shed = CodeBlock(qx=quantidade_de_módulos_em_x, dx=dimensão_do_módulo_em_x, dy=dimensão_do_módulo_em_y, al=altura_inicial, m=modular)
# ---------- modulação_de_treliças_em_shed.designscript (23 lines) ----------
qx;
dx;
dy;
al;
m;
//---------------------------------------------------
// Listas e Indices
//---------------------------------------------------
x   =  0..qx;
i   =  0..qx-1;
cx  =  dx *  x;
mo  =  x % m;
cy  =  dy * mo + al - 2*mo;
//---------------------------------------------------
// Pontos e Linhas das barras
//---------------------------------------------------
LPS = Point.ByCoordinates ( cx , cy , 0 );
LPI = Point.ByCoordinates ( cx , 0  , 0 );
//---------------------------------------------------
MON = Line.ByStartPointEndPoint ( LPI   , LPS      );
VSH = Line.ByStartPointEndPoint ( LPS[i], LPS[i+1] );
VIH = Line.ByStartPointEndPoint ( LPI[i], LPI[i+1] );
DIA = Line.ByStartPointEndPoint ( LPI[i], LPS[i+1] );
# ----------------------------------------
