# Dynamo graph PPE_Aula06d.dyn (Dynamo 2.18.1.5096)

# group: Construção de matriz regular para Vigamentos + Contraventamento
# Prof. José Luis Menegotto
# Escola Politécnica da UFRJ
quantidade_de_módulos_em_x = DoubleSlider(6, range=1..10 step 1)
quantidade_de_módulos_em_y = DoubleSlider(3, range=1..10 step 1)
dimensão_do_módulo_em_x = DoubleSlider(1, range=1..10 step 0.1)
dimensão_do_módulo_em_y = DoubleSlider(1, range=1..10 step 0.1)
angulo_de_inclinação = DoubleSlider(0, range=0..30 step 0.1)
matriz_regular_para = CodeBlock(qx=quantidade_de_módulos_em_x, qy=quantidade_de_módulos_em_y, dx=dimensão_do_módulo_em_x, dy=dimensão_do_módulo_em_y, ang=angulo_de_inclinação)  # "Matriz regular para Contraventamentos"
# ---------- matriz_regular_para.designscript (31 lines) ----------
qx;
qy;
dx;
dy;
ang;
inc = Math.Tan ( ang );
vic = Vector.ByCoordinates( 0 , cy , 0 );
cx  = ( ( 0..qx ) * dx );
cy  = ( ( 0..qy ) * dy );
//--------------------------------------------------
// Indices
//--------------------------------------------------
h   = 0..qx-1;
v   = 0..qy-1;
//--------------------------------------------------
// Pontos da matriz
//--------------------------------------------------
LPI = Point.ByCoordinates ( cx, cx*inc ,  0);
LPH = Point.Add           ( LPI<1> ,   vic );
LPV = List.Transpose      ( LPH            );
//--------------------------------------------------
// Linhas horizontais e verticais
//--------------------------------------------------
VIH = Line.ByStartPointEndPoint ( LPH[h], LPH[h+1] );
VIV = Line.ByStartPointEndPoint ( LPV[v], LPV[v+1] );
//--------------------------------------------------
//Extração de resultados utilizando Dicionário
//--------------------------------------------------
Key = ["PntH","PntV","VigasH","VigasV","Col","Fil"];
Val = [ LPH  , LPV  ,  VIH   ,   VIV  , qx  ,  qy ];
DIC = Dictionary.ByKeysValues ( Key , Val );
# ----------------------------------------
contraventamento_x = CodeBlock(Dic=matriz_regular_para.DIC)
# ---------- contraventamento_x.designscript (18 lines) ----------
Dic;
qx  = Dic["Col"]+1;
qy  = Dic["Fil"];
PTV = Dic["PntV"];
//---------------------------------------------------
PtC = List.Flatten( PTV , 1);
//---------------------------------------------------
// Indices das Diagonais
//---------------------------------------------------
ic  =  0..qx-2;
ir  =  0..qy-1;
i   = List.Flatten(ic<1> + (qx*ir) , 1);
j   = i+qx+1;
//---------------------------------------------------
// Coloca as linhas
//---------------------------------------------------
Di1 = Line.ByStartPointEndPoint(PtC[i  ] , PtC[j  ]);
Di2 = Line.ByStartPointEndPoint(PtC[i+1] , PtC[j-1]);
# ----------------------------------------
