# Dynamo graph PPE_Aula07.dyn (Dynamo 3.0.3.7597)

# group: Constroi treliça de triângulos equiláteros
# Prof. José Luis Menegotto
# Escola Politécnica da UFRJ
dimensão_do_lado = DoubleSlider(1, range=1..20 step 1)  # graph input
quant_de_módulos_triangulares = DoubleSlider(11, range=1..20 step 1)  # graph input
treliça_isométrica = CodeBlock(l=dimensão_do_lado, q=quant_de_módulos_triangulares)
# ---------- treliça_isométrica.designscript (24 lines) ----------
l;
q;
//---------------------------------------------------
// Constantes
//---------------------------------------------------
s30 = Math.Sin(30) * l;
c30 = Math.Cos(30) * l;
//---------------------------------------------------
// Indices
//---------------------------------------------------
i   = 0..q+1;
j   = 0..Count(PTI)-3;
k   = 0..Count(PTI)-2;
//---------------------------------------------------
// Coordenadas X e Y
//---------------------------------------------------
x   = i   * s30;
y   = i%2 * c30;
//---------------------------------------------------
// Pontos e Barras
//---------------------------------------------------
PTI = Point.ByCoordinates      ( x  ,   y  ,   0 );
BZO = Line.ByStartPointEndPoint( PTI[j] , PTI[j+2] );
DIA = Line.ByStartPointEndPoint( PTI[k] , PTI[k+1] );
# ----------------------------------------
