# Dynamo graph PPE_Aula08.dyn (Dynamo 3.0.3.7597)

# group: Tramas Moduladas
# Prof. José Luis Menegotto
# Escola Politécnica da UFRJ
dimensão_do_módulo_base = DoubleSlider(1, range=1..20 step 1)  # graph input
proporção_do_módulo_base = DoubleSlider(0.5, range=0.1..1 step 0.05)  # graph input
quantidade_de_pontos = DoubleSlider(20, range=1..100 step 1)  # graph input
modular = DoubleSlider(4, range=1..5 step 1)  # graph input
trama_modular = CodeBlock(d=dimensão_do_módulo_base, p=proporção_do_módulo_base, q=quantidade_de_pontos, mod=modular)
# ---------- trama_modular.designscript (12 lines) ----------
d;
p;
q;
mod;
///-----------------------------------
m  = d * p;
i  = 0..q-1;
x  = i%mod ? (i * d+m) : (i * d);
y  = i+1;
//------------------------------------
P1 = Point.ByCoordinates ( x<1> , 0 );
P2 = Point.ByCoordinates ( x<1> , y );
# ----------------------------------------
