# Dynamo graph PPE_Aula_08b.dyn (Dynamo 3.0.3.7597)

# group: Cria Linhas e pontos entre paredes
# Prof: José Luis Menegotto
# Escola Politécnica da UFRJ
categories = Categories("OST_Walls")
all_elements_of_category = ElementsOfCategory(Category=categories)
dimensão_x = DoubleSlider(2, range=1..6 step 0.25)
dimensão_y = DoubleSlider(2.25, range=1..6 step 0.25)
ponto_inicial_x_0_5_ponto_médio = DoubleSlider(0, range=0..1 step 0.25)
ponto_inicial_y_0_5_ponto_médio = DoubleSlider(0.25, range=0..1 step 0.25)
direções = DoubleSlider(0, range=0..1 step 1)
lança_linhas_entre_paredes = CodeBlock(Par=all_elements_of_category, dx=dimensão_x, dy=dimensão_y, px=ponto_inicial_x_0_5_ponto_médio, py=ponto_inicial_y_0_5_ponto_médio, do=direções)
# ---------- lança_linhas_entre_paredes.designscript (34 lines) ----------
Par;
dx;
dy;
px;
py;
do;
//-------------------------------------------
i   = 0..3;
o   = 2..3;
EiP = Par[i].GetLocation();
Opo = EiP[o];
//-------------------------------------------
// Vetores direcionais
//-------------------------------------------
Nop = EiP.NormalAtParameter(0);
Non = Nop.Scale(-1);
Nor = List.Flatten([Nop, Non], 1);
xv  = Math.Round( Nor.X , 0 );
yv  = Math.Round( Nor.Y , 0 );
Vor = Vector.ByCoordinates( xv , yv , 0 );
Dir = do==0 ? Vor : Nor;
//-------------------------------------------
// Pt de referencia, pontos e projeções
//-------------------------------------------
Ldi = [dx, dy];
Lpa = [px, py];
Pme = EiP.PointAtParameter ( Lpa );
Lpo = EiP.PointsAtSegmentLengthFromPoint(Pme,Ldi);
Lpr = Lpo.Project ( Opo , Dir );
//-------------------------------------------
// Linhas e Pontos
//-------------------------------------------
Lin = Line.ByStartPointEndPoint( Lpo , Lpr );
Pin = Line.IntersectAll(Lin[0]<1>, Lin[1]<2>);
# ----------------------------------------
