# Dynamo graph Ponte_Saber.dyn (Dynamo 4.0.2.3852)

# group: Marcação de uma Obra de Arte Especial - Exercício para a Ponte do Saber UFRJ
# Autor: Prof. José Luis Menegotto
# Escola Politécnica da UFRJ
# Programa de Pós-graduação em Estruturas. Disciplina BIM.
largura = DoubleSlider(7.25, range=1..15 step 0.25)
profundidade = DoubleSlider(2.75, range=1..5 step 0.25)
altura = DoubleSlider(35, range=25..50 step 0.25)
altura_intermédia = DoubleSlider(6.25, range=1..10 step 0.25)
cota_da_fundação = DoubleSlider(-5.75, range=-7..-1 step 0.25)
r = DoubleSlider(0.25, range=0.1..0.45 step 0.05)
s = DoubleSlider(0.15, range=0.1..0.45 step 0.05)
fator_k_0_simétrico = DoubleSlider(0.125, range=-0.25..0.25 step 0.025)
espessura_parede = DoubleSlider(0.2, range=0.05..0.5 step 0.05)
andar = Levels()  # nothing selected
escalar_topo_1_seção_reta = DoubleSlider(0.2, range=0.15..1 step 0.05)
inclinar_0_vertical = DoubleSlider(8.75, range=0..20 step 0.05)
categoria_para_definir_o_mastro = Categories("OST_BridgeAbutments")
modelar_mastro_como_directshape = BoolSelector(false)
quantidade_de_estai = DoubleSlider(15, range=5..15 step 1)
largura_total_tabuleiro = DoubleSlider(11.75, range=10..15 step 0.25)
altura_do_tabuleiro = DoubleSlider(1.75, range=1..2 step 0.25)
espessura_do_tabuleiro = DoubleSlider(0.3, range=0.25..0.6 step 0.05)
distancia_inicial_dos_cabos = DoubleSlider(27, range=10..50 step 1)
distancia_final_dos_cabos = DoubleSlider(147, range=60..150 step 1)
seção_inferior_do_mastro = CodeBlock(l=largura, p=profundidade, ho=altura, hi=altura_intermédia, hf=cota_da_fundação, r=r, s=s, k=fator_k_0_simétrico, e=espessura_parede, an=andar, esc=escalar_topo_1_seção_reta, des=inclinar_0_vertical, cat=categoria_para_definir_o_mastro, mod=modelar_mastro_como_directshape, qes=quantidade_de_estai, lt=largura_total_tabuleiro, ht=altura_do_tabuleiro, et=espessura_do_tabuleiro, di=distancia_inicial_dos_cabos, df=distancia_final_dos_cabos)
# ---------- seção_inferior_do_mastro.designscript (42 lines) ----------
l;
p;
ho;
hi;
hf;
r;
s;
k;
e;
an;
esc;
des;
cat;
mod;
qes;
lt;
ht;
et;
di;
df;
//----------------------------------------------
i   = [2,3,4,13,19,17,15,7];
cta = [hf, 0, hi, ho , ho+0.8, ho*1.20];
par = "Elevation";
nom = "Cota "+Math.Floor(cta);
lev = Level.ByElevationAndName(cta , nom );
cot = lev.SetParameterByName  (par , cta );
//----------------------------------------------
x   = [-0.50+k,    0    , 0.5+k] * l;
y   = [ 0.50,r,s,0,-s,-r,-0.5  ] * p;
//----------------------------------------------
LiP = Point.ByCoordinates ( x<1>, y, 0 );
LiV = List.Flatten        ( LiP , 1    )[i];
Pol = PolyCurve.ByPoints  ( LiV , 1    );
Ine = Line.ByBestFitThroughPoints( LiV );
//----------------------------------------------
Po1 = mas[0][1];
Po2 = mas[0][2];
ptc = List.Flatten(cab[3], 2);
mas = Mastro ( Pol,cat,esc,des,hf,ho,hi, mod);
cab = Estais ( Po1,Po2,di ,df ,hi,qes);
pis = Pista  ( lt, ht , et , ptc );
# ----------------------------------------
constroi_o_mastro = CodeBlock()
# ---------- constroi_o_mastro.designscript (31 lines) ----------
//---------------------------------------------------
//  Verificar que o material "Concreto" exista
//---------------------------------------------------
def Mastro (ge, ca, es, de, hf, hm, hi, mo)
{
    //-------------------------------------------
    // Forma a matriz dos pontos da seção
    //-------------------------------------------
    z  = [ hf  , hi ,  hm ,  hm+0.8,  hm*1.20 ];
    d  = [ 0.0 , 0  , -de , -de    , -de+1.61 ];
    e  = [ 0.0 , 0  ,  es ,  es*1.6,  es*0.25 ];
    //-------------------------------------------
    // Posiciona seções do mastro.
    // Primeiro escala e depois desloca
    // à altura usando parâmetros z, d, e.
    //-------------------------------------------
    Po = ge.Scale          ( e         );
    Se = Po.Translate      ( d  , 0 , z);
    So = Solid.ByRuledLoft ( Se , 1    );
    //-------------------------------------------
    // Cria DirectSape só se f = True
    //-------------------------------------------
    m  = Material.ByName("Concreto");
    n  = "Mastro";
    Di = mo ? DirectShape.ByGeometry(So,ca,m,n):0;




    return [ Se, So, Di ];
};
# ----------------------------------------
marca_os_estai = CodeBlock()
# ---------- marca_os_estai.designscript (31 lines) ----------
//---------------------------------------------------
// Harpa de estai recebe duas Seções p q e quantidade
//---------------------------------------------------
def Estais( p , q , di, df, hi, n )
{
    p1  = PolyCurve.Points( p )[5];
    p2  = PolyCurve.Points( q )[5];
    p3  = Point.Translate ( p1, di   , 0, -hi);
    p4  = Point.Translate ( p3, df-di, 0,  0 );
    //---------------------------------------------
    // Posiciona eixo dos cabos no mastro (ex)
    //---------------------------------------------
    ex  = Line.ByStartPointEndPoint ( p1 , p2 );
    pm  = ex.PointAtParameter   ( 0.5 );
    ta  = ex.TangentAtParameter ( 0.0 );
    da  = ex.Length / 2.1;
    //---------------------------------------------
    // Posiciona harpa
    //---------------------------------------------
    h1 = Line.ByStartPointDirectionLength(pm,ta,da);
    h2 = Line.ByStartPointEndPoint       (p3,p4   );
    a1 = Line.PointAtParameter(h1 , 0..1..#n);
    a2 = Line.PointAtParameter(h2 , 0..1..#n);
    ca = Line.ByStartPointEndPoint( a1 , a2);





    return [ h1, h2 , a1, a2, ca ];
};
# ----------------------------------------
constroi_a_pista = CodeBlock()
# ---------- constroi_a_pista.designscript (31 lines) ----------
//---------------------------------------------------
//  Pista
//---------------------------------------------------
def Pista ( lt , ht , et , pt )
{
    o   = Point.Origin( );
    v   = Vector.YAxis( );
    PM  = Plane.ByOriginNormal ( o , v );
    //-----------------------------------------------
    // Forma a matriz dos pontos
    //-----------------------------------------------
    y   = [-0.5 , -0.25 , -0.125 ,  0.0     ] * lt;
    z   = [ 0.0 , -0.10 , -0.200 , -0.8 , -1] * ht;
    //-----------------------------------------------
    // Escolhe os pontos da matriz
    //-----------------------------------------------
    i   = [ 0 , 2 , 7 , 14 , 19 , 15 , 10 ];
    //-----------------------------------------------
    LP  = Point.ByCoordinates ( 0, y<1>, z );
    LF  = List.Flatten        ( LP , 1     );
    LV  = LF[i];
    TD  = PolyCurve.ByPoints  ( LV , 1     );
    TE  = TD.Mirror   (  PM  );
    OD  = TD.Offset   ( -et  );
    OE  = TE.Offset   ( -et  );
    PD  = TD.Translate( pt.AsVector ( ) );
    PE  = TE.Translate( pt.AsVector ( ) );
    DD  = OD.Translate( pt.AsVector ( ) );
    EE  = OE.Translate( pt.AsVector ( ) );
    return [ TD , TE , PD , PE , DD , EE ];
};
# ----------------------------------------
material_concreto = Python()  # PythonNet3; unwired: IN[0]
# ---------- material_concreto.python (23 lines) ----------
import clr
clr.AddReference('RevitAPI')
clr.AddReference('RevitServices')
from RevitServices.Persistence import DocumentManager
from Autodesk.Revit.DB import *

doc = DocumentManager.Instance.CurrentDBDocument

# ----------------------------------------------------
# - Seleciona todos os materiais e pega o primeiro
# ----------------------------------------------------
col = FilteredElementCollector(doc).OfClass(Material)
mts = col.ToElements()
mat = mts[0]
# ----------------------------------------------------
# - Transaccionar para mudar o nome do material
# ----------------------------------------------------
t = Transaction( doc , "Ambiente de trabalho" )
t.Start()
mat.Name = "Concreto"
t.Commit()

OUT = mat.Name
# ----------------------------------------
