# Dynamo graph Catedral_Brasilia.dyn (Dynamo 2.13.1.3887)

# group: Função de marcação da Catedral de Brasília
# Escola Politécnica da UFRJ. Departamento de Expressão Gráfica.
# Disciplina: Desenho Computacional / BIM
# Autor: Prof. José Luis Menegotto
categories = Categories("OST_Lines")
all_elements_of_category = ElementsOfCategory(Category=categories)
categories_2 = Categories("OST_Levels")
all_elements_of_category_2 = ElementsOfCategory(Category=categories_2)
catedral_brasília_leitura_das = CodeBlock(Lin=all_elements_of_category, And=all_elements_of_category_2)  # "Catedral Brasília Leitura das linhas das vistas ortográficas"
# ---------- catedral_brasília_leitura_das.designscript (19 lines) ----------
Lin;
And;
//--------------------------------------------------------------------------------------------------
//Posiciona os Andares
//-----------------------------------------------------------------------------------
And.SetParameterByName("Name"      , ["Altar" , "Terreo" , "Cobertura"]);
And.SetParameterByName("Elevation" , [  -3.0  ,    0.0   ,        23.3]);
//--------------------------------------------------------------------------------------------------
//Ordena por Tipo de Vista (Wide Lines na vista frontal e Thin Lines na vista Lateral)
//--------------------------------------------------------------------------------------------------
LLong    = Lin.GetParameterValueByName( "Line Style").Name=="<Wide Lines>" ? Lin : null;
LTran    = Lin.GetParameterValueByName( "Line Style").Name=="<Thin Lines>" ? Lin : null;
EixosL   = List.Clean(ModelCurve.GetLocation ( LLong ), false);
EixosT   = List.Clean(ModelCurve.GetLocation ( LTran ), false);
//--------------------------------------------------------------------------------------------------
//Ordena as linhas por Altura
//--------------------------------------------------------------------------------------------------
EixosLOr = List.SortByKey(EixosL , EixosL.StartPoint.Y )["sortedList"];
EixosTOr = List.SortByKey(EixosT , EixosT.StartPoint.Y )["sortedList"];
# ----------------------------------------
raio_da_catedral = DoubleSlider(29.5, range=29..30 step 0.25)
quantidade_de_colunas = DoubleSlider(16, range=2..16 step 2)
posiciona_em_3d_longitudinais_e = CodeBlock(EixosL=catedral_brasília_leitura_das.EixosLOr, EixosT=catedral_brasília_leitura_das.EixosTOr, Raio=raio_da_catedral, Quanti=quantidade_de_colunas)  # "Posiciona em 3D Longitudinais e Transversais"
# ---------- posiciona_em_3d_longitudinais_e.designscript (45 lines) ----------
EixosL;
EixosT;
Raio;
Quanti;
Ori    = Point.Origin();
Vex    = Vector.XAxis();
Vez    = Vector.ZAxis();
//-------------------------------------------------------------------
// Posiciona Longitudinais
//--------------------------------------------------------------------
P1l    = EixosL.StartPoint;
dxl    = List.SortByKey         ( P1l , P1l.X )["sortedKeys"][-1];
dyl    = List.SortByKey         ( P1l , P1l.Y )["sortedKeys"][ 0];
EixoLD = EixosL.Translate       ( -(dxl -Raio) , -dyl , 0);
EixoLR = EixoLD.Rotate          ( Ori , Vex , 90         );
PML    = EixoLR.PointAtParameter( 0.15                   );
VL     = Point.AsVector         ( PML                    );
//-------------------------------------------------------------------
// PosicionaTransversais
//-------------------------------------------------------------------
P1t     = EixosT.StartPoint;
dxt     = List.SortByKey         ( P1t , P1t.X )["sortedKeys"][0];
dyt     = List.SortByKey         ( P1t , P1t.Y )["sortedKeys"][0];
EixoTD  = EixosT.Translate       ( -(dxt -Raio) , -dyt, 0 );
EixoTR  = EixoTD.Rotate          ( Ori , Vex , 90         );
PMT     = EixoTR.PointAtParameter( 0.5                    );
EixoTRR = EixoTR.Rotate          ( PMT , Vez , 90         );
VT      = Point.AsVector         ( PMT                    );
Vtrans  = Vector.Subtract        ( VL  , VT               );
EixoTDD = Line.Translate         ( EixoTRR , Vtrans       );
//-------------------------------------------------------------------
// Definição dos contornos para o Loft
//-------------------------------------------------------------------
p1      = EixoLR.StartPoint;
p2      = EixoTDD.StartPoint;
p3      = EixoLR.EndPoint;
p4      = EixoTDD.EndPoint;
LPTOS   = Transpose( [ p1 , p2 , p3 , p4 ] );
POLIG   = PolyCurve.ByPoints( LPTOS , true );
//-------------------------------------------------------------------
// Coloca o sólido de uma coluna e o copia radialmente
//-------------------------------------------------------------------
Coluna  = Solid.ByLoft( POLIG );
ModAng  = List.TakeItems(0..360..#Quanti+1, Quanti);
Colunas = Geometry.Rotate(Coluna, Ori, Vez, ModAng);
# ----------------------------------------

watch = Watch(posiciona_em_3d_longitudinais_e.Colunas)
modela = BoolSelector(true)
categories_3 = Categories("OST_StructuralColumns")
definição_do_modelo_do_pilone_na = CodeBlock(model=modela, categ=categories_3)  # "Definição do Modelo do Pilone na categoria Structural Column"; unwired: Coluna
# ---------- definição_do_modelo_do_pilone_na.designscript (5 lines) ----------
Coluna;
mater  = Material.ByName("Concrete, Cast In Situ");
model;
categ;
model ? DirectShape.ByGeometry(Coluna, categ, mater, "Coluna") : null;
# ----------------------------------------
