# Dynamo custom node Cria_Andares.dyf (Dynamo 2.3.0.5885)
# category: Andares
# Criar andares

element_types = ElementTypes("ViewPlan")
all_elements_of_type = ElementsOfType(element_type=element_types)
categories = Categories("OST_Levels")
all_elements_of_category = ElementsOfCategory(Category=categories)
Quant_Andares_Torre = Input(Quant_Andares_Torre: var[]..[] = 1)
Quant_Andares_Embas = Input(Quant_Andares_Embas: var[]..[] = 1)
Altura_Piso_Piso = Input(Altura_Piso_Piso: var[]..[] = 3)
cria_niveis = CodeBlock(EVI=all_elements_of_type, EXI=all_elements_of_category, QAT=Quant_Andares_Torre, QAE=Quant_Andares_Embas, APP=Altura_Piso_Piso)
# ---------- cria_niveis.designscript (19 lines) ----------
EVI;
EXI;
txt = "° Pavto";
QAT;
QAE;
txt;
NOM;
CRI = Level.ByElevation          ( 0..#QAT+1..APP );
NOM = Math.Floor                 ( 0..QAT         );
APA = List.SetDifference         ( EXI , CRI      );
Element.Delete                   ( APA            );
NOV = Element.Delete             ( APA            );
FamilyInstance.SetParameterByName( CRI      , "Name", (NOM)+txt  );
FamilyInstance.SetParameterByName( CRI[0]   , "Name", "Térreo"   );
FamilyInstance.SetParameterByName( CRI[QAT] , "Name", "Cobertura");

Key = ["Andar", "Nome"    , "Cota"         , "QAE"];
Val = [ CRI   , CRI.Name  ,  CRI.Elevation ,  QAE ];
DIC = Dictionary.ByKeysValues ( Key , Val );
# ----------------------------------------
Andares = Output(cria_niveis.out17)
