# Dynamo graph ArcoCapaz.dyn (Dynamo 2.16.1.2727)

# group: Construção de Arco Capaz
# Lugar geométrico dos pontos que enxergam um segmento AB sempre com um ângulo determinado.
# Os pontos do segmento A e B não compartilham as propriedades do lugar geométrico.
angulo = IntegerSlider(58, range=0..90 step 1)
dimensão_segmento = IntegerSlider(17, range=5..30 step 1)
parametro_sobre_o_arco_capaz = IntegerSlider(30, range=0..100 step 5)
arco_capaz = CodeBlock(a=angulo, d=dimensão_segmento, p=parametro_sobre_o_arco_capaz)
# ---------- arco_capaz.designscript (41 lines) ----------
a;
d;
o  = 0;
p;
x   = [o , o+d ];
y   = [0 ,  0  ];
z   = [0 ,  0  ];
dc  = d*100;
cs  = CoordinateSystem.ByOrigin(PO[0]);
//----------------------------------------------------------------
//Segmento inicial
//----------------------------------------------------------------
PO  = Point.ByCoordinates      (  x    ,  y  , z );
AB  = Line.ByStartPointEndPoint( PO[0] , PO[1]   );
PM  = AB.PointAtParameter      ( 0.5             );
N1  = AB.NormalAtParameter     ( 0.5             );
ME  = Line.ByStartPointDirectionLength(PM<1>, [N1, N1], [dc, -dc]);
P1  = Vector.AsPoint(AB.Normal);
//----------------------------------------------------------------
//Centro do arco capaz
//----------------------------------------------------------------
AC  = Point.ByCylindricalCoordinates ( cs ,   -a, 0, dc);
PC  = Point.ByCylindricalCoordinates ( cs , 90-a, 0, dc);
L2  = Line.ByStartPointEndPoint      ( PO[0] , PC      );
L3  = Line.ByStartPointEndPoint      ( PO[0] , AC      );
CC  = Line.Intersect                 ( ME    , a>0==true?L2:AB );
//----------------------------------------------------------------
//Arco Capaz AR1 e seu simétrico AR2
//----------------------------------------------------------------
AR1 = Arc.ByCenterPointStartPointEndPoint( CC , PO[1] , PO[0]);
AR2 = AR1.Mirror ( Plane.ByThreePoints   ( P1 , PO[1] , PO[0]));
ARC = List.Clean ( List.Flatten ( [AR1 , AR2] , 2));
//----------------------------------------------------------------
//Linhas de demostração
//----------------------------------------------------------------
PV  = Line.PointAtParameter(ARC<1>, p/100);
LC  = Line.ByStartPointEndPoint(PV<1>, PO);
//----------------------------------------------------------------
//Formação da poligonal
//----------------------------------------------------------------
POL = PolyCurve.ByJoinedCurves( ARC, 0.001, false, 0.0);
# ----------------------------------------

watch = Watch(arco_capaz.AC)
