# Dynamo graph Forma_Cicloide_01.dyn "Forma_Cicloide_2" (Dynamo 2.3.0.5885)

distância_do_percurso = DoubleSlider(2, range=1..5 step 1)
quantidade_de_ciclos = DoubleSlider(5, range=1..10 step 0.25)
quantidade_de_divisões_por_ciclo = DoubleSlider(20, range=6..100 step 1)
separação_central = DoubleSlider(0.11, range=0.05..1 step 0.01)
fator_de_variação_modular = DoubleSlider(7, range=1..10 step 1)
definição_de_forma_baseada_em = CodeBlock(Dis=distância_do_percurso, cic=quantidade_de_ciclos, q=quantidade_de_divisões_por_ciclo, s=separação_central, m=fator_de_variação_modular)  # "Definição de forma baseada em curva Cicloide"
# ---------- definição_de_forma_baseada_em.designscript (53 lines) ----------
Dis;
cic;
q;
s;
m;
r  = Dis / Math.PiTimes2;
qt = q*cic;
//------------------------------------------------
//Mecanismo Cicloide Paramétrica
//------------------------------------------------
c   = Math.PiTimes2;
t   = (0..c..#qt) * cic;
a   = Math.RadiansToDegrees ( t );
x   = r * (  t - Math.Sin   ( a ));
y   = r * (  1 - Math.Cos   ( a ));
//------------------------------------------------
//Variação modular
//------------------------------------------------
mod = List.IndexOf( x , x ) % m ? 1.25 : 0.95;
//------------------------------------------------
//Listas de Estrutura Formal
//------------------------------------------------
//Ordenadas
y1  = s + 0.1 +( y  * mod     );
y0  =          ( y  * mod     );
YC  =          ( y  * 0       );
//alturas
h1  = Math.Abs (     y1 * 0.0 );
h2  = Math.Abs (     y1 * 0.2 );
HC  = Math.Abs ( s*0.5 + y0 * 0.8 );
//------------------------------------------------
Ly  = [ y1 , y1 , YC , -y1 , -y1 ];
Lz  = [ h1 , h2 , HC ,  h2 ,  h1 ];
//------------------------------------------------
//Lançamento dos Pontos
//------------------------------------------------
PO  = Point.ByCoordinates ( x , Ly<1> , Lz<1> );
//------------------------------------------------
//Lançamento das Curvas
//------------------------------------------------
POL = PolyCurve.ByPoints  ( PO              , false);
POT = PolyCurve.ByPoints  ( Transpose( PO ) , false);
//NCT = NurbsCurve.ByPoints ( Transpose( PO ), 1);
//------------------------------------------------
//Lançamento das Superficies
//------------------------------------------------
//SUT = Surface.ByLoft      ( POT                );
//------------------------------------------------
//Definição do plano do Piso
//------------------------------------------------
LPI = List.SetUnion       ( PO[0] , Reverse(PO[-1]));
POP = PolyCurve.ByPoints  ( LPI   , true           );
SUP = Surface.ByPatch     ( POP                    );
# ----------------------------------------
code_block = CodeBlock { 0..20..#45; }
indexOf = List.IndexOf(list=code_block, element=code_block)
code_block_2 = CodeBlock { 5; }
