# Dynamo graph Estrutura_Analitica_2023_A.dyn "Galpao_Analitico_2023" (Dynamo 2.17.1.4055)

# group: Estrutura tipo Galpão com Eixos Analíticos para Revit 2023
# Curso de Especialização de Estruturas de Aço - Escola Politécnica - UFRJ.
# Disciplina:  ETM602 - Desenho, Montagem e Fabricação (CAD/CAM/BIM).
# Prof. José Luis Menegotto.
vão_livre = DoubleSlider(19000, range=5000..20000 step 1000)
cumeeira = DoubleSlider(2500, range=1000..5000 step 500)
altura_1 = DoubleSlider(4000, range=0..6000 step 250)
levels = Levels()  # nothing selected
pontos_da_forma = CodeBlock(vlivr=vão_livre, cumee=cumeeira, z1=altura_1, And=levels)
# ---------- pontos_da_forma.designscript (20 lines) ----------
x1 = 0;
y1 = 0;
z0 = 0;
vlivr;
cumee;
z1;
y2 = y1 +  vlivr;
ym = y1 + (vlivr / 2 );
z2 = z1 + cumee;
//-----------------------------------------------------
// Ajusta o level
//-----------------------------------------------------
LVL = Level.SetParameterByName (And, "Elevation", z1 );
//-----------------------------------------------------
//Forma do perfil Inicial
//-----------------------------------------------------
Lx  = [x1 , x1 , x1,  x1 , x1 ];
Ly  = [y1 , y1 , ym,  y2 , y2 ];
Lz  = [z0 , z1 , z2,  z1 , z0 ];
Pts = Point.ByCoordinates(Lx, Ly, Lz);
# ----------------------------------------
q_módulos = DoubleSlider(5, range=2..20 step 1)
distância_entre_módulos = DoubleSlider(4750, range=1000..10000 step 250)
módulo_contraventamento_vertical = DoubleSlider(2, range=1..6 step 1)
forma = CodeBlock(Pts=pontos_da_forma.Pts, Qm=q_módulos, Dm=distância_entre_módulos, mo=módulo_contraventamento_vertical)
# ---------- forma.designscript (86 lines) ----------
Pts;
Qm;
Dm;
mo;
//----------------------------------------------------------------
//Definição da translação
//----------------------------------------------------------------
Tx    = 0..(Qm*Dm)..Dm;
Ty    = Tx * 0;
Tz    = Tx * 0;

PT    = Point.Translate   ( Pts<1> , Tx , Ty , Tz );
POL   = PolyCurve.ByPoints( PT );
POT   = PolyCurve.ByPoints( List.Transpose( PT ));

i     = 0..Qm;
j     = 0..Qm-1;
k     = 1..Qm-0;

p00   = PT[0][i];
p01   = PT[1][i];
p02   = PT[2][i];
p03   = PT[3][i];
p04   = PT[4][i];
p05   = Point.ByCoordinates(p02.X, p02.Y, p01.Z);

Pf11  = PT[0][j];
Pf12  = PT[1][k];
Pf13  = PT[1][j];
Pf14  = PT[0][k];

pp01  = PT[ 0][j];
pp02  = PT[-1][j];
pp11  = PT[-1][k];
pp12  = PT[ 0][k];
ptlaj = List.Transpose([pp01, pp02, pp11, pp12]);
LAJE  = Autodesk.Surface.ByPerimeterPoints(ptlaj);
pc1   = PT[2][j];
pc2   = PT[2][k];

Pf21  = PT[3][j];
Pf22  = PT[4][k];
Pf23  = PT[4][j];
Pf24  = PT[3][k];
//----------------------------------------------------------------
//Colunas
//----------------------------------------------------------------
COLF1 = Line.ByStartPointEndPoint( p00 , p01 );
COLF2 = Line.ByStartPointEndPoint( p04 , p03 );
//----------------------------------------------------------------
//Vigas do telhado
//----------------------------------------------------------------
VIFT1 = Line.ByStartPointEndPoint( p01 , p02 );
VIFT2 = Line.ByStartPointEndPoint( p02 , p03 );
//----------------------------------------------------------------
//Cumeeira, Banzo inferior e pendural
//----------------------------------------------------------------
CUMEE = Line.ByStartPointEndPoint( pc1 , pc2 );
BANZO = Line.ByStartPointEndPoint( p01 , p03 );
PENDU = Line.ByStartPointEndPoint( p05 , p02 );
//----------------------------------------------------------------
//Contraventamentos
//----------------------------------------------------------------
CXF11 = i%mo==0? Line.ByStartPointEndPoint( Pf11 , Pf12 ) : null;
CXF12 = i%mo==0? Line.ByStartPointEndPoint( Pf13 , Pf14 ) : null;
CXF21 = i%mo==0? Line.ByStartPointEndPoint( Pf21 , Pf22 ) : null;
CXF22 = i%mo==0? Line.ByStartPointEndPoint( Pf23 , Pf24 ) : null;
//----------------------------------------------------------------
//Travessas longitudinais
//----------------------------------------------------------------
VTRF10 = Line.ByStartPointEndPoint( Pf11 , Pf14 );
VTRF11 = Line.ByStartPointEndPoint( Pf12 , Pf13 );
VTRF20 = Line.ByStartPointEndPoint( Pf21 , Pf24 );
VTRF21 = Line.ByStartPointEndPoint( Pf22 , Pf23 );
//----------------------------------------------------------------
// Semântica com diccionário de elementos ordenados
//----------------------------------------------------------------
Chave  = [ "ColF1" , "ColF2" , "Cumeeira" , "Banzo" , "Pendural",
           "VigT1" , "VigT2" ,
           "XF1"   , "XF2"   ,
           "VTF1"  , "VTF2"  , "Laje" ];
Valor  = [ COLF1  , COLF2    ,  CUMEE  , BANZO , PENDU ,
           VIFT1  , VIFT2    ,
          [CXF11  , CXF12  ] , [CXF21  , CXF22 ] ,
          [VTRF10 , VTRF11 ] , [VTRF20 , VTRF21] , LAJE ];
Dados  = Dictionary.ByKeysValues( Chave , Valor );
# ----------------------------------------

# group: Colocação de Eixos Analíticos e Estabelecimento de Roles
# Curso de Especialização de Estruturas de Aço - Escola Politécnica - UFRJ.
# Disciplina:  ETM602 - Desenho, Montagem e Fabricação (CAD/CAM/BIM).
# Prof. José Luis Menegotto.
funções_estruturais = StructuralRoleComboBox("Column")
funções_estruturais_2 = StructuralRoleComboBox("Beam")
funções_estruturais_3 = StructuralRoleComboBox("Piso")
funções_estruturais_4 = StructuralRoleComboBox("Viga")
criação_do_esqueleto_analítico = CodeBlock(RoleCol=funções_estruturais, RoleVig=funções_estruturais_2, RolePis=funções_estruturais_3, RolePar=funções_estruturais_4, Dados=forma.Dados)
# ---------- criação_do_esqueleto_analítico.designscript (28 lines) ----------
RoleCol;
RoleVig;
RolePis;
RolePar;
Dados;
//----------------------------------------------------------------
//Cria os eixos analíticos
//----------------------------------------------------------------
ACOLF1 = AnalyticalMember.ByCurve ( Dados["ColF1"]   );
ACOLF2 = AnalyticalMember.ByCurve ( Dados["ColF2"]   );
AVITF1 = AnalyticalMember.ByCurve ( Dados["VigT1"]   );
AVITF2 = AnalyticalMember.ByCurve ( Dados["VigT2"]   );
ACUME  = AnalyticalMember.ByCurve ( Dados["Cumeeira"]);
ABNZO  = AnalyticalMember.ByCurve ( Dados["Banzo"]   );
APEND  = AnalyticalMember.ByCurve ( Dados["Pendural"]);
AVTR1  = AnalyticalMember.ByCurve ( Dados["VTF1"]    );
AVTR2  = AnalyticalMember.ByCurve ( Dados["VTF2"]    );
ACXF1  = AnalyticalMember.ByCurve ( Dados["XF1" ]    );
ACXF2  = AnalyticalMember.ByCurve ( Dados["XF2" ]    );
ALAJE  = AnalyticalPanel.BySurface( Dados["Laje"]    );
//----------------------------------------------------------------
//Estabelece o Rol
//----------------------------------------------------------------
AnalyticalMember.SetStructuralRole ( [ACOLF1 , ACOLF2                 ] , RoleCol );
AnalyticalMember.SetStructuralRole ( [AVITF1 , AVITF2 , AVTR1 , AVTR2 ] , RoleVig );
AnalyticalMember.SetStructuralRole ( [ACXF1  , ACXF2                  ] , RoleVig );
AnalyticalMember.SetStructuralRole ( [ACUME  , ABNZO  , APEND         ] , RoleVig );
AnalyticalPanel.SetStructuralRole  ( [ALAJE                           ] , RolePis );
# ----------------------------------------
