# Dynamo graph Estrutura_Analitica_2023_C.dyn (Dynamo 2.18.1.5096)

# group: Estrutura Analítica tipo Galpão Revit 2024 - Dicionário > Estrutura Analítica tipo Galpão Revit 2024 - Dicionário
# Mestrado em Estruturas e Curso de Especialização de Estruturas de Aço - Escola Politécnica - UFRJ.
# Disciplina:  ETM602 - Desenho, Montagem e Fabricação (CAD/CAM/BIM).
# Prof. José Luis Menegotto.
vão_livre = DoubleSlider(11000, range=5000..20000 step 1000)
cumeeira = DoubleSlider(1500, range=1000..5000 step 500)
altura_1 = DoubleSlider(4250, range=0..6000 step 250)
andar_do_beiral = Levels("No levels available.")
pontos_da_forma = CodeBlock(vlivr=vão_livre, cumee=cumeeira, z1=altura_1, And=andar_do_beiral)
# ---------- pontos_da_forma.designscript (20 lines) ----------
x1 = 0;
y1 = 0;
z0 = 0;
vlivr;
cumee;
z1;
y2 = y1 +  vlivr;
ym = y1 + (vlivr / 2 );
z2 = z1 + cumee;
//-----------------------------------------------------
// Ajusta o level
//-----------------------------------------------------
LVL = Level.SetParameterByName (And, "Elevation", z1 );
//-----------------------------------------------------
//Forma do perfil Inicial
//-----------------------------------------------------
Lx  = [x1 , x1 , x1,  x1 , x1 ];
Ly  = [y1 , y1 , ym,  y2 , y2 ];
Lz  = [z0 , z1 , z2,  z1 , z0 ];
Pts = Point.ByCoordinates(Lx, Ly, Lz);
# ----------------------------------------
q_módulos = DoubleSlider(4, range=2..20 step 1)
distância_entre_módulos = DoubleSlider(5250, range=1000..10000 step 250)
módulo_contraventamento_vertical = DoubleSlider(2, range=1..6 step 1)
rol_pisos = StructuralRoleComboBox("Floor")
rol_colunas = StructuralRoleComboBox("Column")
funções_vigas = StructuralRoleComboBox("Beam")
funções_membro = StructuralRoleComboBox("Member")
forma = CodeBlock(Pts=pontos_da_forma.Pts, Qm=q_módulos, Dm=distância_entre_módulos, mo=módulo_contraventamento_vertical, RolP=rol_pisos, RolC=rol_colunas, RolV=funções_vigas, RolM=funções_membro)
# ---------- forma.designscript (90 lines) ----------
Pts;
Qm;
Dm;
mo;
RolP;
RolC;
RolV;
RolM;
//------------------------------------------------
//Definição da translação
//------------------------------------------------
Tx    = 0..(Qm*Dm)..Dm;
Ty    = Tx * 0;
Tz    = Tx * 0;
PT    = Point.Translate   (Pts<1> , Tx,Ty,Tz);
POL   = PolyCurve.ByPoints(PT );
POT   = PolyCurve.ByPoints(List.Transpose(PT));
i     = 0..Qm;
j     = 0..Qm-1;
k     = 1..Qm-0;
p00   = PT[ 0][i];
p01   = PT[ 1][i];
p02   = PT[ 2][i];
p03   = PT[ 3][i];
p04   = PT[ 4][i];
p05   = Point.ByCoordinates(p02.X, p02.Y, p01.Z);
Pf11  = PT[ 0][j];
Pf12  = PT[ 1][k];
Pf13  = PT[ 1][j];
Pf14  = PT[ 0][k];
pp01  = PT[ 0][j];
pp02  = PT[-1][j];
pp11  = PT[-1][k];
pp12  = PT[ 0][k];
pc1   = PT[ 2][j];
pc2   = PT[ 2][k];
Pf21  = PT[ 3][j];
Pf22  = PT[ 4][k];
Pf23  = PT[ 4][j];
Pf24  = PT[ 3][k];
//------------------------------------------------
// Colunas
//------------------------------------------------
COL1  = Linha ( p00 , p01 );
COL2  = Linha ( p04 , p03 );
//------------------------------------------------
// Vigas do telhado
//------------------------------------------------
VTE1  = Linha ( p01 , p02 );
VTE2  = Linha ( p02 , p03 );
//------------------------------------------------
// Cumeeira, Banzo inferior e pendural
//------------------------------------------------
CUME  = Linha ( pc1 , pc2 );
BANZ  = Linha ( p01 , p03 );
PEND  = Linha ( p05 , p02 );
//------------------------------------------------
// Contraventamentos
//------------------------------------------------
cnvt  = i%mo==0;
CXV1  = cnvt ? Linha (Pf11 , Pf12) : null;
CXV2  = cnvt ? Linha (Pf13 , Pf14) : null;
CXV3  = cnvt ? Linha (Pf21 , Pf22) : null;
CXV4  = cnvt ? Linha (Pf23 , Pf24) : null;
//------------------------------------------------
// Travessas longitudinais
//------------------------------------------------
TRA1  = Linha ( Pf11 , Pf14 );
TRA2  = Linha ( Pf12 , Pf13 );
TRA3  = Linha ( Pf21 , Pf24 );
TRA4  = Linha ( Pf22 , Pf23 );
//------------------------------------------------
// Lajes
//------------------------------------------------
ptlaj = List.Transpose([pp01, pp02, pp11, pp12]);
LAJE  = Autodesk.Surface.ByPerimeterPoints(ptlaj);
//------------------------------------------------
// Semântica com diccionário
//------------------------------------------------
Cha = [ "COL1","COL2","VTE1","VTE2",
        "TRA1","TRA2","TRA3","TRA4",
        "CXV1","CXV2","CXV3","CXV4",
        "CUME","BANZ","PEND","LAJE" ];
Val = [  COL1 , COL2 , VTE1 , VTE2,
         TRA1 , TRA2 , TRA3 , TRA4,
         CXV1 , CXV2 , CXV3 , CXV4,
         CUME , BANZ , PEND , LAJE  ];
//------------------------------------------------
Dic = Dictionary.ByKeysValues ( Cha , Val );
mem = Membros ( Dic , RolP, RolC, RolV, RolM);
# ----------------------------------------

# group: Estrutura Analítica tipo Galpão Revit 2024 - Dicionário
# Mestrado em Estruturas e Curso de Especialização de Estruturas de Aço - Escola Politécnica - UFRJ.
# Disciplina:  ETM602 - Desenho, Montagem e Fabricação (CAD/CAM/BIM).
# Prof. José Luis Menegotto.
# note: Nesta opção foi definido o dicionário e as funções para poder discriminar o tipo e o rol  dos elementos analíticos a partir das chaves definidas no diccionário.
# As funções permitem simplificar a escrita e reduzir a quantidade de linhas de ligação entre os nodos.
# Tipos:
# AnalyticalMember
# AnalyticalPanel
# Roles:
# Pisos
# Colunas
# Vigas
# Membros
funções_de_distribuição_de = CodeBlock()  # "Funções de distribuição de elementos e roles"
# ---------- funções_de_distribuição_de.designscript (35 lines) ----------
def Membros ( dic , rP, rC, rV, rM)
{
   ch = Dictionary.Keys (dic);
   el = dic[ch];
   ti = Verifica ( ch , "COL" ) ? ColocaC ( el , rC ):
        Verifica ( ch , "VTE" ) ? ColocaC ( el , rV ):
        Verifica ( ch , "TRA" ) ? ColocaC ( el , rV ):
        Verifica ( ch , "CXV" ) ? ColocaC ( el , rM ):
        Verifica ( ch , "CUM" ) ? ColocaC ( el , rV ):
        Verifica ( ch , "BAN" ) ? ColocaC ( el , rV ):
        Verifica ( ch , "PEN" ) ? ColocaC ( el , rM ):
        Verifica ( ch , "LAJ" ) ? ColocaP ( el , rP ): "";

   return ti;
};
//-----------------------------------------------------------
def Verifica(ch,ti)
{
    return String.Contains(ch,ti,false)?true:false;
};
//-----------------------------------------------------------
def ColocaC(e,r)
{
    return AnalyticalMember.ByCurve (e).SetStructuralRole(r);
};
//-----------------------------------------------------------
def ColocaP(e,r)
{
    return AnalyticalPanel.BySurface(e).SetStructuralRole(r);
};
//-----------------------------------------------------------
def Linha  (a,b)
{
    return Line.ByStartPointEndPoint(a,b);
};
# ----------------------------------------
