# Dynamo graph Galpao_Analitico_2024.dyn (Dynamo 2.17.1.4055)

# group: Seleção das Categorias e Elementos
# BIM I - Modelagem Digital da Edificação - Escola Politécnica - UFRJ.
# Prof. José Luis Menegotto.
categories = Categories("OST_StructuralColumns")
all_elements_of_category = ElementsOfCategory(Category=categories)
categories_2 = Categories("OST_StructuralFraming")
all_elements_of_category_2 = ElementsOfCategory(Category=categories_2)
categories_3 = Categories("OST_Floors")
all_elements_of_category_3 = ElementsOfCategory(Category=categories_3)

# group: Colocação de Eixos Analíticos e Definição de Roles
# BIM I - Modelagem Digital da Edificação - Escola Politécnica - UFRJ.
# Prof. José Luis Menegotto.
funções_estruturais = StructuralRoleComboBox("Column")
funções_estruturais_2 = StructuralRoleComboBox("Beam")
funções_estruturais_3 = StructuralRoleComboBox("Piso")
definição_de_elementos = CodeBlock(Colunas=all_elements_of_category, Vigas=all_elements_of_category_2, Lajes=all_elements_of_category_3, RoleCol=funções_estruturais, RoleVig=funções_estruturais_2, RoleLaj=funções_estruturais_3)  # "Definição de elementos analíticos da estrurura existente"
# ---------- definição_de_elementos.designscript (15 lines) ----------
Colunas;
Vigas;
Lajes;
//--------------------------------------------------------------
//Cria os Elementos analíticos
//--------------------------------------------------------------
AnaC = AnalyticalMember.ByElement (Colunas , true, true );
AnaV = AnalyticalMember.ByElement (Colunas , true, true );
AnaP = AnalyticalPanel.ByElement  (Lajes   , true, true, true);
//--------------------------------------------------------------
//Define o Rol estrutural de cada elemento analítico
//--------------------------------------------------------------
RolC = AnalyticalMember.SetStructuralRole ( AnaC , RoleCol );
RolV = AnalyticalMember.SetStructuralRole ( AnaV , RoleVig );
RolP = AnalyticalPanel.SetStructuralRole  ( AnaP , RoleLaj );
# ----------------------------------------
