# Dynamo graph Galpao_Tipo1_Modulo.dyn (Dynamo 2.17.1.4055)

# group: Referência: GERDAU - Coletânea do Uso do Aço - Galpões em pórticos com Perfis Estruturais Laminados. Fernando Ottoboni Pinho
# Algoritmo para geração de Pórticos de galpão metálica: Curso de Especialização de Estruturas de Aço - Escola Politécnica - UFRJ.
# Disciplina:  ETM602 - Desenho, Montagem e Fabricação (CAD/CAM/BIM).
# Prof. José Luis Menegotto.
file_path = Filename(".\Porticos_Gerdau.PNG")
file_from_path = FileObject(path=file_path)
readFromFile = Image.ReadFromFile(file=file_from_path)
watch_image = WatchImageCore(image=readFromFile)

# group: Definição do perfil do Pórtico Simples (tipo 1)
# Algoritmo para geração de Pórticos de galpão metálica: Curso de Especialização de Estruturas de Aço - Escola Politécnica - UFRJ.
# Disciplina:  ETM602 - Desenho, Montagem e Fabricação (CAD/CAM/BIM).
# Prof. José Luis Menegotto.
levels = Levels("L1")  # graph input
vão_y = DoubleSlider(5000, range=5000..20000 step 500)  # graph input
altura_andar = DoubleSlider(6500, range=5000..12000 step 250)  # graph input
inclinação = DoubleSlider(15, range=0..20 step 1)  # graph input
distância_inicial_entre_terças = DoubleSlider(2250, range=1500..2500 step 250)  # graph input
apoiar_a_terça_sobre_a_viga = BoolSelector(true)
offset_topo_do_pilar = DoubleSlider(0, range=0..2500 step 250)  # graph input
tipo_de_viga = StructuralFramingTypes("No structural framing types available.")  # graph input
tipo_de_pilar = StructuralColumnTypes("UC356x368x129")  # graph input
tipo_de_terças = StructuralFramingTypes("C10X20")  # graph input
pontos_e_linhas_do_pórtico_tipo = CodeBlock(And=levels, DimY=vão_y, DimZ=altura_andar, Inc=inclinação, dit=distância_inicial_entre_terças, apv=apoiar_a_terça_sobre_a_viga, tof=offset_topo_do_pilar, tiv=tipo_de_viga, tip=tipo_de_pilar, tit=tipo_de_terças)  # "Pontos e linhas do Pórtico Tipo 1"
# ---------- pontos_e_linhas_do_pórtico_tipo.designscript (71 lines) ----------
And;
DimX = 23000;
DimY;
DimZ;
Inc;
dit;
apv;
tof;
tiv;
tip;
tit;
LVL = Level.SetParameterByName (And, "Elevation", DimZ );
Tg  = Math.Tan(Inc);
vx  = DimX/2;
vy  = DimY;
vz  = DimZ;
//---------------------------------------------------------
// Formação das listas de coordenadas
//---------------------------------------------------------
x0  = -vx..vx..vx;
y0  =   0..vy..#2;
z0  =   0..vz..vz;
z1  =  vx * Tg;
//---------------------------------------------------------
// Distribuição inicial dos pontos
//---------------------------------------------------------
PtO = Point.ByCoordinates( x0<1>  , y0    , z0<2> );
PtT = Transpose          ( PtO                    );
PtC = Point.Translate    ( PtT[1][1] , 0 , 0 , z1 );
//---------------------------------------------------------
// Pilares Esquerdo e Direito
//---------------------------------------------------------
PiE = Line.ByStartPointEndPoint ( PtT[0][0] , PtT[1][0] );
PiD = Line.ByStartPointEndPoint ( PtT[0][2] , PtT[1][2] );
//---------------------------------------------------------
// Vigas Esquerdas e Direitas
//---------------------------------------------------------
ViE = Line.ByStartPointEndPoint ( PtC       , PtT[1][0] );
ViD = Line.ByStartPointEndPoint ( PtC       , PtT[1][2] );
//---------------------------------------------------------
// Ponto de referência para a Terça inicial
//---------------------------------------------------------
pitE = Line.PointAtParameter    ( ViE , (250 / ViD.Length));
pitD = Line.PointAtParameter    ( ViD , (250 / ViD.Length));
//---------------------------------------------------------
// Distribuição das Terças
//---------------------------------------------------------
TrE = Line.PointsAtSegmentLengthFromPoint( ViE, pitE, dit);
TrD = Line.PointsAtSegmentLengthFromPoint( ViD, pitD, dit);

VtE = Line.ByStartPointEndPoint ( TrE[0] , TrE[-1] );
VtD = Line.ByStartPointEndPoint ( TrD[0] , TrD[-1] );
VCe = Line.ByStartPointEndPoint ( PtC[0] , PtC[-1] );
//---------------------------------------------------------
// Colocação dos objetos construtivos
//---------------------------------------------------------
EVI = StructuralFraming.BeamByCurve  ( [ViE,ViD] , And , tiv);
ETE = StructuralFraming.BeamByCurve  ( VtE       , And , tit);
ETD = StructuralFraming.BeamByCurve  ( VtD       , And , tit);
EPI = StructuralFraming.ColumnByCurve( [PiE,PiD] , And , tip);
//---------------------------------------------------------
// Ajuste dos parâmetros das Instâncias inseridas
//---------------------------------------------------------
agi = (apv==true) ? 180 : 0;
FamilyInstance.SetParameterByName(EPI , "Top Offset",  tof);
FamilyInstance.SetParameterByName(EPI , "Cross-Section Rotation",  90);
FamilyInstance.SetParameterByName(ETE , "Cross-Section Rotation",  Inc+agi);
FamilyInstance.SetParameterByName(ETD , "Cross-Section Rotation", -Inc+agi);
chaves  = ["Andar", "QPrt", "Pilares", "Vigas"];
valores = [ LVL   ,   2   ,  EPI     ,  EVI   ];
Dic     = Dictionary.ByKeysValues(chaves, valores);
# ----------------------------------------
vão_x = DoubleSlider(15000, range=15000..60000 step 500)  # graph input
