# Dynamo custom node MET_Analitica_Colu.dyf "Coluna_Analitica" (Dynamo 2.18.1.5096)
# category: MET
# Define uma coluna analítica

Curva_Coluna = Input(Curva_Coluna: var[]..[])
structural_roles = StructuralRoleComboBox("Column")
Perfil = Input(Perfil: var[]..[])
define_coluna_analítica = CodeBlock(Curva=Curva_Coluna, Role=structural_roles, Sec=Perfil)
# ---------- define_coluna_analítica.designscript (5 lines) ----------
Curva;
Role;
MA = AnalyticalMember.ByCurve ( Curva );
AnalyticalMember.SetStructuralRole ( [ MA ] , Role );
MA.SetParameterByName( "Section Type" , Sec);
# ----------------------------------------
Coluna_Analítica = Output(define_coluna_analítica.out3)
