# Dynamo custom node MET_Analitica_Laje.dyf (Dynamo 2.18.1.5096)
# category: MET
# Cria Laje Analítica

Superficie = Input(Superficie: var[]..[])
structural_roles = StructuralRoleComboBox("Floor")
define_superfície_analítica = CodeBlock(Srf=Superficie, Role=structural_roles)
# ---------- define_superfície_analítica.designscript (7 lines) ----------
Srf;
Role;
//------------------------------------------------
//Cria Painel analítico
//------------------------------------------------
SA = AnalyticalPanel.BySurface   (  Srf         );
AnalyticalPanel.SetStructuralRole( [ SA ], Role );
# ----------------------------------------
Superficie_Analítica = Output(define_superfície_analítica.out3)
