# Dynamo custom node MET_Analitica_Viga.dyf (Dynamo 2.18.1.5096)
# category: MET
# Cria uma viga analítica

Curva_Viga = Input(Curva_Viga: var[]..[])
structural_roles = StructuralRoleComboBox("Beam")
Perfil = Input(Perfil: var[]..[])
define_viga_analítica = CodeBlock(Curva=Curva_Viga, Role=structural_roles, Sec=Perfil)
# ---------- define_viga_analítica.designscript (5 lines) ----------
Curva;
Role;
MA = AnalyticalMember.ByCurve ( Curva );
AnalyticalMember.SetStructuralRole ( [ MA ] , Role );
MA.SetParameterByName( "Section Type", Sec);
# ----------------------------------------
Viga_Analítica = Output(define_viga_analítica.out3)
