# Dynamo graph MET_Coloca_Clip_Pilar_Viga.dyn (Dynamo 2.18.1.5096)

selectStructureData = SelectStructureData()  # 4 picked in the model
structuralDataTypes = StructuralDataTypes("UB-Universal Beams | VIGA0")
structuralDataTypes_2 = StructuralDataTypes("UC-Universal Columns-Column | PILAR2")
coloca_clip_pilar_viga = CodeBlock(Elementos=selectStructureData, TpVigas=structuralDataTypes.typeName, TpPilar=structuralDataTypes_2.typeName)  # unwired: TipCL
# ---------- coloca_clip_pilar_viga.designscript (12 lines) ----------
Elementos;
TpVigas;
TpPilar;
Nodos = ConnectionNode.FromStructure  ( Elementos );
Grupo = ConnectionNode.SubNodesOfSize ( Nodos , 2 );
//-------------------------------------------------------------
//Clips
//-------------------------------------------------------------
PilCL = Filter.BySectionType ( Grupo, 0, TpPilar )["accepted"];
VigCL = Filter.BySectionType ( Grupo, 1, TpVigas )["accepted"];
Resul = [PilCL , VigCL ];
Clips = Connection.ByType ( Resul , [0,1] , TipCL);
# ----------------------------------------
