# Dynamo graph MET_Coloca_Conexao_ColVig.dyn (Dynamo 2.18.1.5096)

# group: Coloca Placas de Base, Mísulas e Cumeeiras em Pórtico Tipo 1
# Algoritmo para Colocação de Ligações de Aço em Pórticos de galpão metálica: Curso de Especialização de Estruturas de Aço - Escola Politécnica - UFRJ.
# Disciplina:  ETM602 - Desenho, Montagem e Fabricação (CAD/CAM/BIM).
# Prof. José Luis Menegotto.
selectStructureData = SelectStructureData()  # 4 picked in the model
structuralDataTypes = StructuralDataTypes("Vigas W Gerdau | W150X29.8")
structuralDataTypes_2 = StructuralDataTypes("Pilares HP Gerdau | HP250X62")
conexão_utilizada = ConnectionTypes("Apex haunch | TOP_01")
conexão_utilizada_2 = ConnectionTypes("Knee of frame bolted, with haunch | MIS_01")
conexão_utilizada_3 = ConnectionTypes("Base plate | PBA_01")
# note: O nodo coloca automaticamente as seguintes conexões:
# Misula
# Cumeeira
# Placas de Base
# Elas devem ter sido previamente carregadas no modelo.
# Para que a conexão seja colocada o tipo de viga e de coluna selecionada deve coincidir com as utilizadas no modelo.  Repare na filtragem feita no algoritmo (Filter.BySectionType).
# Recomendações:
# Utilizar no modo de execução (Run) Manual.
# A configuração dos parâmetros de cada conexão devem ser realizados alterando os parâmetros a partir da interface de propriedades em Edit Type.
coloca_conexão_coluna_viga = CodeBlock(Elemn=selectStructureData, TpVigas=structuralDataTypes.typeName, TpPilar=structuralDataTypes_2.typeName, Top=conexão_utilizada, Mis=conexão_utilizada_2, Pla=conexão_utilizada_3)
# ---------- coloca_conexão_coluna_viga.designscript (29 lines) ----------
Elemn;
Nodos;
TpVigas;
TpPilar;
Top;
Mis;
Pla;
Nodos = ConnectionNode.FromStructure  ( Elemn     );
Grup1 = ConnectionNode.SubNodesOfSize ( Nodos , 1 );
Grup2 = ConnectionNode.SubNodesOfSize ( Nodos , 2 );
//----------------------------------------------------------------
// Cumeeiras
//----------------------------------------------------------------
F_T0  = Filter.BySectionType ( Grup2 , 0 , TpVigas )["accepted"];
F_T1  = Filter.BySectionType ( Grup2 , 1 , TpVigas )["accepted"];
F_T   = List.SetIntersection ( F_T0 , F_T1 );
Topos = Connection.ByType    ( F_T  , [0 , 1] , Top);
//----------------------------------------------------------------
// Mísulas
//----------------------------------------------------------------
F_M0  = Filter.BySectionType ( Grup2 , 0 , TpPilar )["accepted"];
F_M1  = Filter.BySectionType ( Grup2 , 1 , TpVigas )["accepted"];
F_M   = List.SetIntersection ( F_M0  , F_M1 );
Misul = Connection.ByType    ( F_M   , [0 , 1] , Mis);
//----------------------------------------------------------------
// Placa de Base
//----------------------------------------------------------------
F_P   = Filter.BySectionType ( Grup1 , 0 , TpPilar )["accepted"];
Placa = Connection.ByType    ( F_P   , 0 , Pla );
# ----------------------------------------
