# Dynamo graph MET_Exporta_SAT.dyn (Dynamo 2.18.1.5096)

# group: Exporta geometria de elementos para formato SAT
# Exporta geometria de elementos para formato SAT
# Curso de Especialização de Estruturas de Aço - Escola Politécnica - UFRJ.
# Disciplina:  ETM602 - Desenho, Montagem e Fabricação (CAD/CAM/BIM).
# Prof. José Luis Menegotto.
categories = Categories("OST_StructuralFoundation")
all_elements_of_category = ElementsOfCategory(Category=categories)
# note: Criada para transportar as famílias das Fundações de concreto para os modelos de Advance Steel.
# Quando os modelos de Revit são exportados para Advance Steel via smlx, as fundações de concreto são simplificadas com um bloco prismático. Para transportar essas famílias pode ser utilizada esta pequena rotina que salva a geometria de cada fundação em arquivos SAT independentes.
# O nome do arquivo é formado pelo nome do Tipo  da fundação (que não pode ter caracteres especiais), seguido pelo Número ID do elemento. Isso garante que cada arquivo SAT será o de uma instância específica do modelo.  Deve ser escolhida a pasta de destinos dos arquivos.
selecionar_a_pasta_de_destino = Directory("C:\MET_2023")
exporta_a_geometria_coletada = CodeBlock(Elem=all_elements_of_category, Pasta=selecionar_a_pasta_de_destino)  # "Exporta a geometria coletada para um arquivo SAT"
# ---------- exporta_a_geometria_coletada.designscript (13 lines) ----------
Elem;
Pasta;
//-----------------------------------------------
// Define o nome do Arquivo
//-----------------------------------------------
Tipo  = Elem.Name;
Iden  = Elem.Id;
Geom  = Elem.Geometry();
Arqui = Pasta+"\\"+Tipo+"_"+Iden+".sat";
//-----------------------------------------------
//Exporta
//-----------------------------------------------
Geometry.ExportToSAT ( Geom , Arqui );
# ----------------------------------------
