# Dynamo graph MET_Fisico_a_Analitico.dyn (Dynamo 2.18.1.5096)

categories = Categories("OST_StructuralFraming")
all_elements_of_category = ElementsOfCategory(Category=categories)
byElement = AnalyticalAutomation.AnalyticalElements.AnalyticalMember.ByElement(element=all_elements_of_category)
categories_2 = Categories("OST_StructuralColumns")
all_elements_of_category_2 = ElementsOfCategory(Category=categories_2)
byElement_2 = AnalyticalAutomation.AnalyticalElements.AnalyticalMember.ByElement(element=all_elements_of_category_2)
categories_3 = Categories("OST_Floors")
all_elements_of_category_3 = ElementsOfCategory(Category=categories_3)
byElement_3 = AnalyticalAutomation.AnalyticalElements.AnalyticalPanel.ByElement(element=all_elements_of_category_3)
