# Dynamo graph MET_Montar_Matriz_Modulada.dyn (Dynamo 2.18.1.5096)

# group: Cria Pontos e Barras ordenados numa matriz modulada
# Algoritmo para montar uma matriz retangular com opções de modulação.
# Curso de Especialização de Estruturas de Aço - Escola Politécnica - UFRJ.
# Disciplina:  ETM602 - Desenho, Montagem e Fabricação (CAD/CAM/BIM).
# Prof. José Luis Menegotto.
quant_x = IntegerSlider(4, range=2..20 step 1)
quant_y = IntegerSlider(4, range=2..20 step 1)
dim_x = DoubleSlider(3.5, range=1..20 step 0.25)
dim_y = DoubleSlider(4.75, range=1..20 step 0.25)
modular = IntegerSlider(2, range=1..20 step 1)
define_matriz_de_pontos_e_barras = CodeBlock(qx=quant_x, qy=quant_y, dx=dim_x, dy=dim_y, m=modular)
# ---------- define_matriz_de_pontos_e_barras.designscript (24 lines) ----------
qx;
qy;
dx;
dy;
//-----------------------------------------------
//Matriz de pontos modulada
//-----------------------------------------------
x  = ((0..qx) * dx) + (i%m==0 ? 0 : dx*0.5);
y  = ((0..qy) * dy) + (k%m==0 ? 0 : dy*0.5);
z  =  0;
PX = Point.ByCoordinates ( x<1> , y    , z );
PY = Point.ByCoordinates ( x    , y<1> , z );
//-----------------------------------------------
//Barras Na Direção X
//-----------------------------------------------
i  = 0..qx-1;
j  = i+1;
BX = Line.ByStartPointEndPoint( PX[i] , PX[j] );
//-----------------------------------------------
//Barras Na Direção Y
//-----------------------------------------------
k  = 0..qy-1;
l  = k+1;
BY = Line.ByStartPointEndPoint( PY[k] , PY[l] );
# ----------------------------------------
