# Dynamo graph MET_Montar_Portico.dyn (Dynamo 2.18.1.5096)

# group: Marcação de Planos Horizontais (Levels) e do Pórtico
# Algoritmo para montar Pórticos Tipo 1 para galpão metálico.
# Curso de Especialização de Estruturas de Aço - Escola Politécnica - UFRJ.
# Disciplina:  ETM602 - Desenho, Montagem e Fabricação (CAD/CAM/BIM).
# Prof. José Luis Menegotto.
coleciona_Andares = Custom[Coleciona_Andares]()  # Captura os andares atuais
cota_beiral = DoubleSlider(4.25, range=3..5 step 0.25)
cota_fundação = DoubleSlider(-1.25, range=-2..-1 step 0.25)
vão_livre = DoubleSlider(25, range=5..45 step 1)
angulo_de_inclinação = DoubleSlider(7, range=0..45 step 1)
distância_entre_terças = DoubleSlider(1.2, range=1..1.5 step 0.05)
# note: Este grupo de comandos inicia o processo ordenando os andares (capturados pelo Custom Node), as coordenadas dos pontos onde se localizam elementos e lançando as linhas dos elementos.
# Esses eixos são marcações temporárias que desaparencem quando a função é fechada.
# Eles servem como guias às funções de colocação de elementos construtivos concretos, como as famílias dos perfis.
define_pontos = CodeBlock(Planos=coleciona_Andares, bei=cota_beiral, fun=cota_fundação, vl=vão_livre, an=angulo_de_inclinação, dt=distância_entre_terças)
# ---------- define_pontos.designscript (34 lines) ----------
Planos;
bei;
ter = 0;
fun;
vl;
an;
dt;
//-------------------------------------------------
nomes = ["Fundação","Térreo","Beiral","Cumeeira"];
altur = [ fun      ,  ter   ,  bei   ,   bei+dz ];
Planos.SetParameterByName ( "Name"      , nomes );
Planos.SetParameterByName ( "Elevation" , altur );
//-------------------------------------------------
dz = Math.Tan( an ) * vl/2;
x  = [0   ,  0  ,   0.5  ,   1 ,  1  ] * vl;
z  = [fun , bei , bei+dz , bei , fun ];
i  = [1, 2];
j  = i+1;
k  = [0 , 4];
l  = [1 , 3];
//-------------------------------------------------
PO = Point.ByCoordinates          ( x , 0 , z );
// Colunas e Vigas --------------------------------
CO = Line.ByStartPointEndPoint   ( PO[k] , PO[l] );
VI = Line.ByStartPointEndPoint   ( PO[i] , PO[j] );
// MetSec Fachada ---------------------------------
rf = CO.PointAtParameter               ( 0.5     );
FA = CO.PointsAtSegmentLengthFromPoint ( rf , dt );
// Terças -----------------------------------------
rv = VI.PointAtParameter               ( 0.5     );
TE = VI.PointsAtSegmentLengthFromPoint ( rv , dt );
Planos;
CO;
VI;
# ----------------------------------------

# group: Coloca Vigas e Colunas. (Devem ser carregadas as familias que serão utilizadas)
# Algoritmo para montar Pórticos Tipo 1 para galpão metálico.
# Curso de Especialização de Estruturas de Aço - Escola Politécnica - UFRJ.
# Disciplina:  ETM602 - Desenho, Montagem e Fabricação (CAD/CAM/BIM).
# Prof. José Luis Menegotto.
structural_column_types = StructuralColumnTypes("HP250X62")
# note: Este grupo de comandos Coloca as famílias dos perfis e captura alguns parâmetros de tipo ("Width" e  "Height") para uso posterior. Também seta alguns parâmetros instanciados de posicionamento
# "Cross-Section Rotation"
# "z Justification"
# Finalmente, cria-se um Dictionário com os valores.
# Diccionários é uma das formas de atribuir significados às listas de dados.
# Também é uma forma de ordenar as
# saídas entre um grupo de comandos e outro, diminuindo a quantidade da fiação entre os processos.
structural_framing_types = StructuralFramingTypes("W150X29.8")
coloca_as_vigas_primárias_e = CodeBlock(AN=define_pontos.out25, CO=define_pontos.out26, TC=structural_column_types, VI=define_pontos.out27, TV=structural_framing_types)  # "Coloca as Vigas Primárias e Colunas"
# ---------- coloca_as_vigas_primárias_e.designscript (29 lines) ----------
AN;
CO;
TC;
VI;
TV;
//--------------------------------------------------------
// Coloca Instâncias de Colunas e Vigas
//--------------------------------------------------------
IC  = StructuralFraming.ColumnByCurve ( CO , AN[0] , TC );
IV  = StructuralFraming.BeamByCurve   ( VI , AN[1] , TV );
//--------------------------------------------------------
// Dados de Tipo de Viga e Coluna para calculo posterior
//--------------------------------------------------------
LT  = [TC      , TV       ];
LP  = ["Width" , "Height" ];
LT<1>.GetParameterValueByName ( LP ) * 10;
//--------------------------------------------------------
// Definição de alinhamento e posicionamento
//--------------------------------------------------------
LI  = [IC                       , IV                ];
LV  = ["Cross-Section Rotation" , "z Justification" ];
VA  = [     90                  ,  2                ];
LI.SetParameterByName ( LV , VA);
//--------------------------------------------------------
// Define Dicionário de Dados
//--------------------------------------------------------
Key = ["TipoC", "TipoV", "Colunas" , "Vigas" ];
Val = [ TC    ,  TV    ,  IC       , IV      ];
Dic = Dictionary.ByKeysValues( Key , Val );
# ----------------------------------------

# group: Calcula o Peso do Pórtico
# Algoritmo para montar Pórticos Tipo 1 para galpão metálico.
# Curso de Especialização de Estruturas de Aço - Escola Politécnica - UFRJ.
# Disciplina:  ETM602 - Desenho, Montagem e Fabricação (CAD/CAM/BIM).
# Prof. José Luis Menegotto.
calcular_peso = CodeBlock(Dic=coloca_as_vigas_primárias_e.Dic)
# ---------- calcular_peso.designscript (16 lines) ----------
Dic;
//Instâncias ------------------------------------------------
Col = Dic["Colunas"];
Vig = Dic["Vigas"];
//Tipos -----------------------------------------------------
TPC = Dic["TipoC"];
TPV = Dic["TipoV"];
LTP = [TPC , TPV ];
//-----------------------------------------------------------
// Cálculo do peso
//-----------------------------------------------------------
KGT = LTP.GetParameterValueByName ("Nominal Weight" );
KGC = Col.GetParameterValueByName ("Comprimento" )*KGT[0]<1>;
KGV = Vig.GetParameterValueByName ("Length"      )*KGT[1]<1>;
KGR = List.Flatten ( [KGC, KGV] , 1) / 1000;
PES = Math.Round ( Math.Sum  ( KGR ), 2) + " Toneladas";
# ----------------------------------------
# note: Exemplo de aproveitamento das informações.
# Calcula o peso do pórtico com os dados de peso
# pegos de cada tipo de Perfil utilizado e multiplicado pelo comprimento do perfil, somados, arredondados e transformados em Toneladas.
peso = Watch(calcular_peso.PES)

# group: Define os elementos analíticos (Custom Nodes. Arquivos dyf)
# Custom Nodes com o algoritmos para definir membros analíticos.
# Curso de Especialização de Estruturas de Aço - Escola Politécnica - UFRJ.
# Disciplina:  ETM602 - Desenho, Montagem e Fabricação (CAD/CAM/BIM).
# Prof. José Luis Menegotto.
# note: Para que os elementos físicos sejam Exportados para Robot é importante setar o parâmetro instanciado "Setion Type" com o nome do perfil correspondente. Caso contrârio, no Robot será importado apenas o membro Analítico ao qual deverá ser assignado posteriormente uma seção de perfil específica.
# Duplo click dentro do Custom Node para abrir e editar o conteúdo.
coluna_Analitica = Custom[Coluna_Analitica](Curva_Coluna=coloca_as_vigas_primárias_e.CO, Perfil=coloca_as_vigas_primárias_e.TC)  # Define uma coluna analítica
MET_Analitica_Viga = Custom[MET_Analitica_Viga](Curva_Viga=coloca_as_vigas_primárias_e.VI, Perfil=coloca_as_vigas_primárias_e.TV)  # Cria uma viga analítica
