# Dynamo graph MET_VigaPredim.dyn (Dynamo 2.17.1.4055)

# group: Exemplo de procura de dados em arquivos TXT estruturados
# Algoritmo para colocação de viga metálica predimensionada: Curso de Especialização de Estruturas de Aço - Escola Politécnica - UFRJ.
# Disciplina:  ETM602 - Desenho, Montagem e Fabricação ( CAD/CAM/BIM)
# Prof: José Luis Menegotto
longitude_viga = DoubleSlider(6.8, range=1..14 step 0.1)
define_o_eixo_da_viga_e_sua = CodeBlock(L=longitude_viga)  # "Define o eixo da Viga e sua AlturaInicial"
# ---------- define_o_eixo_da_viga_e_sua.designscript (9 lines) ----------
L;
razao = 1/20 * 1000;
//------------------------------------------------------
//Define pontos e eixo da viga e verifica o comprimento
//------------------------------------------------------
p1    = Point.ByCoordinates       ( 0 , 0 , 0 );
p2    = Point.ByCoordinates       ( L , 0 , 0 );
Viga  = Line.ByStartPointEndPoint ( p1  ,  p2 );
AltI  = Viga.Length * razao;
# ----------------------------------------
determina_o_perfil_de_acordo_com = CodeBlock(AltI=define_o_eixo_da_viga_e_sua.AltI)  # "Determina o perfil de acordo com o vão livre"
# ---------- determina_o_perfil_de_acordo_com.designscript (21 lines) ----------
//--------------------------------------------------------------------
// Faz a leitura do arquivo TXT com os dados dos perfis
//--------------------------------------------------------------------
pasta  = "C:\\MET_2023\\5_Dynamo\\";
arqcsv = "Tabela_Perfis_W_Laminados_Gerdau.txt";
arquiv = pasta + arqcsv;
Dados  = DSOffice.Data.ImportCSV      ( arquiv , true);
//--------------------------------------------------------------------
// Prepara os Dados
//--------------------------------------------------------------------
Ldados = List.Flatten ( String.Split  ( Dados  , '	'  ), 2);
TabCla = List.Flatten ( List.Sublists ( Ldados , [1] , 11), 1);
TabPer = List.Flatten ( List.Sublists ( Ldados , [2] , 11), 1);
TabAlt = List.Flatten ( List.Sublists ( Ldados , [3] , 11), 1);
ValAlt = String.ToNumber ( TabAlt );
Altura = AltI > ValAlt ? ValAlt : 0;
//--------------------------------------------------------------------
// Encontra o Indice do elemento e retorna Perfil selecionado
//--------------------------------------------------------------------
i      = List.IndexOf(ValAlt , List.Reverse( List.Sort( Altura  ))[0]);
Perfil = [TabCla[i], TabPer[i] , TabAlt[i]];
# ----------------------------------------
perfil_selecionado = Watch(determina_o_perfil_de_acordo_com.Perfil)
