# Dynamo graph Modulador_Z.dyn (Dynamo 2.17.0.3472)

# group: Modulador em Z
# Disciplina:              BIM I Modelagem Digital da Edificação
# Desenvolvido por: Prof. José Luis Menegotto
# Departamento de Expressão Gráfica / Escola Politécnica da UFRJ
quantidade_de_pontos_n = DoubleSlider(28, range=2..30 step 1)
módulo_m = DoubleSlider(4, range=1..10 step 1)
dimensão_x = DoubleSlider(4.375, range=0.625..10 step 0.625)
dimensão_y = DoubleSlider(10, range=0.625..10 step 0.625)
altura_cumeeira = DoubleSlider(3.125, range=0..10 step 0.625)
distribuição_telhado = CodeBlock(n=quantidade_de_pontos_n, m=módulo_m, dx=dimensão_x, dy=dimensão_y, dz=altura_cumeeira)
# ---------- distribuição_telhado.designscript (19 lines) ----------
n;
m;
dx;
dy;
dz;
xm = (0..n);

xc = (0..n)   *dx;
y  = [-1, 1]  *dy;
z  = (xm % m) *dz;
qx = List.Count( xc);
qy = List.Count(  y);
i  = 0..qx-2;
j  = i+1;

PtsO = Point.ByCoordinates      ( xc         ,  y<1>,    z );
LinT = Line.ByStartPointEndPoint( PtsO[0]    ,  PtsO[1]    );
LiL1 = Line.ByStartPointEndPoint( PtsO[0][i] ,  PtsO[0][j] );
LiL2 = Line.ByStartPointEndPoint( PtsO[1][i] ,  PtsO[1][j] );
# ----------------------------------------
