# Dynamo graph Distribui_Elem_Parede.dyn (Dynamo 4.0.2.3852)

# group: Distribui elementos equidistantes em paredes
# Disciplina BIM - Prof. José Luis Menegotto
# DEG/POLI/UFRJ
categories = Categories("OST_ElectricalFixtures")
all_elements_of_category = ElementsOfCategory(Category=categories)
# note: Uso de:
# Agrupamentos por hospedeiros
# Diccionários
indice_da_parede = IntegerSlider(0, range=0..5 step 1)
distribui_elemento_em_parede = CodeBlock(ele=all_elements_of_category, i=indice_da_parede)
# ---------- distribui_elemento_em_parede.designscript (24 lines) ----------
ele;
i;
//----------------------------------------------
// Agrupa elementos pela parede que os hospedam
// Podem ser portas, janelas, tomadas, etc.
//----------------------------------------------
pared = FamilyInstance.GetHost(  ele  );
grupo = List.GroupByKey ( ele , pared );
wal   = grupo["unique keys"][i];
grp   = grupo["groups"     ][i];
//---------------------------------------------
// Processa os itens do grupo de índice i
//---------------------------------------------
q     = List.Count(grp)+1;
lin   = wal.GetLocation();
tba   = grp.GetLocation();
dim   = lin.Length;
dis   = Math.Round (dim / q, 2);
pin   = lin.PointsAtEqualSegmentLength(q);
pfi   = List.Flatten ( pin , 1 );
//---------------------------------------------
// Reposiciona os elementos equidistantes
//---------------------------------------------
grp.SetLocation ( pfi );
# ----------------------------------------
watch = Watch(distribui_elemento_em_parede.pared)
