# Dynamo graph Forma_Espiral_Ncentros.dyn (Dynamo 2.17.1.4055)

# group: Construção e uso da Espiral de n Centros
# Disciplina:              BIM I Modelagem Digital da Edificação
# Desenvolvido por: Prof. José Luis Menegotto
# Departamento de Expressão Gráfica / Escola Politécnica da UFRJ
quantidade_de_centros = DoubleSlider(6, range=2..12 step 1)
raio_do_polígono_gerador = DoubleSlider(0.52, range=0.05..1 step 0.01)
girar = DoubleSlider(0, range=0..360 step 1)
definição_de_forma_baseada_em = CodeBlock(q=quantidade_de_centros, r=raio_do_polígono_gerador, g=girar)  # "Definição de forma baseada em Espirais de n centros"
# ---------- definição_de_forma_baseada_em.designscript (27 lines) ----------
q;
r;
g;
vz  = Vector.ZAxis();

// Calcula o módulo angular (ma) e o angulo de giro (g) ----
ma  = 360/q;
ra  = ma/2 + g;
// Indices dos vértices ------------------------------------
i   = 0..q-1;
j   = List.ShiftIndices ( i , 1 );
// Calcula os angulos aplicando o giro ---------------------
an  = (0..#q..ma) + ra;
// Calcula coordenadas XY dos pontos do polígono gerador ---
x   = Math.Cos ( an ) * r;
y   = Math.Sin ( an ) * r;
cen = Point.ByCoordinates ( x , y , 0 );
// Dimensão do Lado e Acumulada do Lado --------------------
lad = Point.DistanceTo    ( cen[0] , cen[1] );
da  = lad + (lad * i);
Vij = Vector.ByTwoPoints ( cen[i] , cen[j]   );
sp  = Point.Translate    ( cen[i] , Vij , da );
//Desenha a espiral  ---------------------------------------
pol = PolyCurve.ByPoints ( cen    , true );
arc = Arc.ByCenterPointStartPointSweepAngle(cen, sp, ma, vz);
epa = Arc.PointAtParameter      (arc , 1);
rad = Line.ByStartPointEndPoint (cen , epa);
# ----------------------------------------
