# Dynamo graph Oval4Centros.dyn (Dynamo 2.17.1.4055)

# group: Construir formas a partir de uma Oval de 4 Centros
# Disciplina:              BIM I Modelagem Digital da Edificação
# Desenvolvido por: Prof. José Luis Menegotto
# Departamento de Expressão Gráfica / Escola Politécnica da UFRJ
diagonal_x = DoubleSlider(2.5, range=1..20 step 0.1)
diagonal_y = DoubleSlider(1.8, range=1..20 step 0.1)
oval_de_4_centros = CodeBlock(Dx=diagonal_x, Dy=diagonal_y)
# ---------- oval_de_4_centros.designscript (16 lines) ----------
Dx;
Dy;
p1 = Point.ByCoordinates(Dx , 0  , 0);
p2 = Point.ByCoordinates(0  , Dy , 0);
p3 = Point.ByCoordinates(-Dx, 0  , 0);
p4 = Point.ByCoordinates(0  , -Dy, 0);
LP = [p1,p2,p3,p4];
LPS = List.ShiftIndices(LP, 3);
Lad = Line.ByStartPointEndPoint(LP, LPS);
Pme = Line.PointAtParameter  (Lad , 0.5);
Nor = Line.NormalAtParameter (Lad , 0.5);
Tng = Line.TangentAtParameter(Lad , 0.5);
Pms = List.ShiftIndices(Pme, 3);
O4C = Arc.ByStartPointEndPointStartTangent(Pme, Pms, Tng);
Cen = O4C.CenterPoint;
Lin = Line.ByStartPointEndPoint(Cen, Pme);
# ----------------------------------------
dim_offset_x = DoubleSlider(0.5, range=0..5 step 0.1)
dim_offset_y = DoubleSlider(0.3, range=0..5 step 0.1)
abre_as_curvas_para_procurar = CodeBlock(o4c=oval_de_4_centros.O4C, dx=dim_offset_x, dy=dim_offset_y)  # "Abre as Curvas para procurar Formas"
# ---------- abre_as_curvas_para_procurar.designscript (14 lines) ----------
o4c;
dx;
dy;
i1  = [0, 2];
i2  = i1+1;
A1  = Arc.Offset(o4c[i1], dy);
A2  = Arc.Offset(o4c[i2], dx);
LP1 = [A1[0].EndPoint  , A1[0].StartPoint, A1[1].EndPoint  , A1[1].StartPoint];
LP2 = [A2[0].StartPoint, A2[1].EndPoint  , A2[1].StartPoint, A2[0].EndPoint  ];
Lin = Line.ByStartPointEndPoint(LP1 , LP2);
Con = [A1[0], Lin[0], A2[0], Lin[1], A1[1], Lin[2], A2[1], Lin[3]];
Bor = PolyCurve.ByJoinedCurves(Con, 0.0);
Sup = Autodesk.Surface.ByPatch( Bor );
Are = Sup.Area;
# ----------------------------------------
watch = Watch(abre_as_curvas_para_procurar.Are)
