# Dynamo graph Plano_Circulo_Senoide.dyn (Dynamo 4.0.2.3852)

# group: Cria círculos ordenados numa senoide
# Aula BIM: DEG/POLI/UFRJ
# Autor: Prof. José Luis Menegotto
fator_de_amplitude = DoubleSlider(0, range=-2..10 step 0.2)
raio = DoubleSlider(0.046, range=0.01..0.05 step 0.001)
modular = DoubleSlider(3, range=1..20 step 1)
# note: Usa uma função condicional para alterar o raio do círculo ao lonfo do percurso. A sintaxe de uma condicional é a seguinte:
# val = condição ? verdadeiro : falso
# Na função o valor do raio varia se o índice i
# é modular ao valor do parâmetro m.
# Isso se faz utilizando o operador Remainder (%)
# Se i é modular de m então utilize r senão divida r por m
# rai = i % m  ? r   :   r/m;
# Usa a FazCirculo
senoide = CodeBlock(amp=fator_de_amplitude, r=raio, m=modular)
# ---------- senoide.designscript (11 lines) ----------
amp;
r;
m;
qpo = 360*2;
x   = 0..qpo;
i   = 0..qpo-1;
j   = i+1;
s   = Math.Sin(x);
y   = Math.RadiansToDegrees(s)*amp;
Pt  = Point.ByCoordinates(x, y, 0);
ci  = FazCirculo (Pt[i], Pt[j], (i+1)*r, i, m);
# ----------------------------------------
modela_o_círculo = CodeBlock()
# ---------- modela_o_círculo.designscript (8 lines) ----------
def FazCirculo ( pa, pb, r, i, m )
{
 ra = i%m ? r : r/m;
 vd = Vector.ByTwoPoints  ( pa, pb );
 pl = Plane.ByOriginNormal( pa, vd );
 ci = Circle.ByPlaneRadius( pl, ra );
 return = ci;
};
# ----------------------------------------

# group: Cria Plano diretor e círculo
# Aula BIM: DEG/POLI/UFRJ
# Autor: Prof. José Luis Menegotto
X1 = DoubleSlider(0, range=0..30 step 1)
Y1 = DoubleSlider(55, range=0..100 step 1)
Z1 = DoubleSlider(30, range=0..30 step 1)
X2 = DoubleSlider(0, range=0..30 step 1)
plano_diretor_de_circulo = CodeBlock(x1=X1, y1=Y1, z1=Z1, x2=X2)
# ---------- plano_diretor_de_circulo.designscript (13 lines) ----------
pa = Point.ByCoordinates(x1 , y1 , z1);
pb = Point.ByCoordinates(x2 , 0  , 0 );
//--------------------------------------
// Define a normal do plano diretor com
// o vetor p1 p2
//--------------------------------------
di = Vector.ByTwoPoints   (pa , pb );
pl = Plane.ByOriginNormal (pa , di );
//--------------------------------------
// Define o círculo sobre o plano
//--------------------------------------
Li = Line.ByStartPointEndPoint(pa , pb);
Ci = Circle.ByPlaneRadius     (pl , 10);
# ----------------------------------------
