# Dynamo graph Lote_Linhas_Forca.dyn (Dynamo 2.17.0.3472)

# group: Seleção do Lote
# Disciplina:              BIM I Modelagem Digital da Edificação
# Desenvolvido por: Prof. José Luis Menegotto
# Departamento de Expressão Gráfica / Escola Politécnica da UFRJ
numero_do_lote = DoubleSlider(4, range=0..4 step 1)
seleção_de_Lotes = Custom[Seleção_de_Lotes](Indice_Lote=numero_do_lote)  # Seleciona lotes para processamento

# group: Análise do Lote
# Disciplina:              BIM I Modelagem Digital da Edificação
# Desenvolvido por: Prof. José Luis Menegotto
# Departamento de Expressão Gráfica / Escola Politécnica da UFRJ
afastamento = DoubleSlider(2, range=0..4 step 0.1)
posição_longitudinal = DoubleSlider(0.49, range=0.01..0.99 step 0.005)
posição_transversal = DoubleSlider(0.505, range=0..1 step 0.005)
analisar_Divisas = Custom[Analisar_Divisas](Lote=seleção_de_Lotes, Afastamento=afastamento, Pos_Longitudinal=posição_longitudinal, Pos_Transversal=posição_transversal)  # Analisa linhas de força do terreno

code_block = CodeBlock(D=analisar_Divisas) { D; D["PtsM"]; D["NoFo"]; D["NoDe"]; D["LinP"]; D["PtsC"]; D["LinC"]; D["LinL"]; D["LinT"]; D["Circ"]; }

# group: Definição dos Pavimentos
# Disciplina:              BIM I Modelagem Digital da Edificação
# Desenvolvido por: Prof. José Luis Menegotto
# Departamento de Expressão Gráfica / Escola Politécnica da UFRJ
quantidade_de_andares_torre = DoubleSlider(13, range=1..25 step 1)
altura_piso_a_piso = DoubleSlider(3.5, range=3..4 step 0.25)
cria_Andares = Custom[Cria_Andares](Quant_Andares_Torre=quantidade_de_andares_torre, Altura_Piso_Piso=altura_piso_a_piso)  # Criar andares

# group: Formalização da massa do prédio
# Disciplina:              BIM I Modelagem Digital da Edificação
# Desenvolvido por: Prof. José Luis Menegotto
# Departamento de Expressão Gráfica / Escola Politécnica da UFRJ
ocupação_da_torre = DoubleSlider(30, range=10..100 step 5)
proporção_area_lado = DoubleSlider(0.455, range=0.1..10 step 0.001)
posicionamento_rotacional = DoubleSlider(15, range=0..25 step 1)
razão_do_embasamento_1_n = DoubleSlider(6, range=1..6 step 1)
predio_Estudo = Custom[Predio_Estudo](Dic_Lote=analisar_Divisas, Dic_Andares=cria_Andares, Indice_Ocupacao=ocupação_da_torre, Razao_Area_Lado=proporção_area_lado, Girar=posicionamento_rotacional, Razao_Andares_Embasamento=razão_do_embasamento_1_n)  # Predio para estudos preliminares

visualizar_os_elementos = CodeBlock(Dic_Pre=predio_Estudo) { Dic_Pre; Dic_Pre["EMBAS"]; Dic_Pre["TORRE"]; Dic_Pre["PoliT"]; Dic_Pre["SoliT"]; Dic_Pre["SoliE"]; Dic_Pre["SoliF"]; }
