# Dynamo graph Lote_Perimetral.dyn (Dynamo 2.17.0.3472)

# group: Análise Perimetral de Lotes
# Disciplina:              BIM I Modelagem Digital da Edificação
# Desenvolvido por: Prof. José Luis Menegotto
# Departamento de Expressão Gráfica / Escola Politécnica da UFRJ
categories = Categories("OST_SiteProperty")
all_elements_of_category = ElementsOfCategory(Category=categories)
numero_do_lote = DoubleSlider(0, range=0..4 step 1)
seleção_da_divisa_e_extração_da = CodeBlock(divisas=all_elements_of_category, n=numero_do_lote)  # "Seleção da divisa e extração da poligonal"
# ---------- seleção_da_divisa_e_extração_da.designscript (7 lines) ----------
divisas;
Qdiv = List.Count(divisas);
n;

Lote  = divisas[n %Qdiv];
Lot_E = Lote.Geometry         (  );
Pol_L = PolyCurve.ByJoinedCurves ( Lot_E , 0 );
# ----------------------------------------
afastamento = DoubleSlider(3, range=0..5 step 0.1)
profundidade_das_unidades = DoubleSlider(3.1, range=1..7 step 0.1)
dim_frontal_das_unidades = DoubleSlider(2.7, range=1..10 step 0.1)
boolean = BoolSelector(true)
ocupação_perimetral_do_lote = CodeBlock(Pol_L=seleção_da_divisa_e_extração_da.Pol_L, DAF=afastamento, PRP=profundidade_das_unidades, DMP=dim_frontal_das_unidades, inv=boolean)
# ---------- ocupação_perimetral_do_lote.designscript (31 lines) ----------
Pol_L;
DAF;
PRP;
DMP;
inv;
// -------------------------------------------------------------------
// Inverte valor numérico da profundidade caso a normal seja invertida
// -------------------------------------------------------------------
DPR     = inv ? -PRP : PRP;
// -------------------------------------------------------------------
// Define as poligonais de ocupação e interna
// -------------------------------------------------------------------
Pol_O   = Pol_L.Offset( -DAF );
Pol_I   = Pol_L.Offset( -DAF - PRP);
Curv_O  = Pol_O.Explode();
Curv_I  = Pol_I.Explode();
// -------------------------------------------------------------------
// Calcula os pontos
// -------------------------------------------------------------------
Normais = Curv_I.NormalAtParameter( 0.5 );
Pnts_PR = Curv_I.PointAtParameter ( 0.5 );
Pnts_PT = Curve.PointsAtSegmentLengthFromPoint( Curv_I , Pnts_PR, DMP);
Divi_PT = Line.ByStartPointDirectionLength    ( Pnts_PT, Normais, DPR);
// -------------------------------------------------------------------
//Define superfices usando as poligonais do Lote e de Ocupação
FaceL   = Surface.ByPatch( Pol_L );
FaceO   = Surface.ByPatch( Pol_O );
// -------------------------------------------------------------------
// Calcula taxa de ocupação
// -------------------------------------------------------------------
TxOcup  = Math.Ceiling (FaceO.Area / FaceL.Area *100) + " %";
# ----------------------------------------
taxa_de_ocupação = Watch(ocupação_perimetral_do_lote.TxOcup)
