# Dynamo custom node Seleção_de_Lotes.dyf (Dynamo 2.3.0.5885)
# category: Seleção
# Seleciona lotes para processamento

categories = Categories("OST_SiteProperty")
all_elements_of_category = ElementsOfCategory(Category=categories)
Indice_Lote = Input(Indice_Lote: var[]..[] = 0)
seleção_da_divisa_e_extração_da = CodeBlock(divisas=all_elements_of_category, n=Indice_Lote)  # "Seleção da divisa e extração da poligonal"
# ---------- seleção_da_divisa_e_extração_da.designscript (16 lines) ----------
divisas;
Qdiv = List.Count(divisas);
n;

Lote  = divisas[n % Qdiv];
Lot_E = Element.Geometry         ( Lote      );
Pol_L = PolyCurve.ByJoinedCurves ( Lot_E , 0 );
Are_L = FamilyInstance.GetParameterValueByName(Lote , "Area");

//------------------------------------------------------------
//Extração de resultados utilizando Dicionário
//------------------------------------------------------------

Key   = ["Lote" , "Area" ];
Val   = [ Pol_L ,  Are_L ];
DIC   = Dictionary.ByKeysValues ( Key , Val );
# ----------------------------------------
Dados_Lote = Output(seleção_da_divisa_e_extração_da.DIC)
