# Dynamo graph MET_Eixos.dyn (Dynamo 2.13.1.3887)

# group: Criação de eixos estruturais
# Algoritmo para geração de Malha estrututural: Curso de Especialização de Estruturas de Aço - Escola Politécnica - UFRJ.
# Disciplina:  ETM602 - Desenho, Montagem e Fabricação (CAD/CAM/BIM).
# Prof. José Luis Menegotto.
quantidade_eixos_em_x_qx = DoubleSlider(5, range=1..20 step 1)
quantidade_de_eixos_em_y_qy = DoubleSlider(3, range=1..26 step 1)
distância_de_separação_e = DoubleSlider(1500, range=500..2000 step 500)
dimensão_entre_eixos_em_x_dx = DoubleSlider(3000, range=2000..6000 step 500)
dimensão_entre_eixos_em_y_dy = DoubleSlider(2500, range=2000..20000 step 500)
cria_malha_regular_de_eixos = CodeBlock(qx=quantidade_eixos_em_x_qx, qy=quantidade_de_eixos_em_y_qy, ds=distância_de_separação_e, dx=dimensão_entre_eixos_em_x_dx, dy=dimensão_entre_eixos_em_y_dy)  # "Cria malha regular de eixos estruturais (Medidas em Milímetros)"
# ---------- cria_malha_regular_de_eixos.designscript (35 lines) ----------
qx;
qy;
ds;
cx  = (qx-1)*dx*0.5;
cy  = (qy-1)*dy*0.5;
x   =         (0..#qx..dx)-cx;
y   = Reverse((0..#qy..dy)-cy);
nx  = 1..qx;
ny  = 1..qy;
i = 0..qx-2;
j = i+1;
k = 0..qy-2;
l = k+1;
num = Math.Ceiling(nx/1)+"";
let = ["A","B","C","D","E","F","G","H","I",
       "J","K","L","M","N","O","P","Q","R",
       "S","T","U","V","W","X","Y","Z"];
//-----------------------------------------------------
// Forma as listas de pontos
//-----------------------------------------------------
PtX = Point.ByCoordinates ( x<1>, y   , 0 );
PtY = Point.ByCoordinates ( x   , y<1>, 0 );
//-----------------------------------------------------
// Separa o inicio do Eixo
//-----------------------------------------------------
ph1 = PtX[ 0].Translate (-ds,  0, 0);
ph2 = PtX[-1].Translate ( ds,  0, 0);
pv1 = PtY[ 0].Translate ( 0 , ds, 0);
pv2 = PtY[-1].Translate ( 0 ,-ds, 0);
//-----------------------------------------------------
// Coloca e Numera o Eixo
//-----------------------------------------------------
EiH = Grid.ByStartPointEndPoint ( ph1 , ph2 );
EiV = Grid.ByStartPointEndPoint ( pv1 , pv2 );
Grid.SetParameterByName ([EiH , EiV], "Name" , [let , num]);
# ----------------------------------------
