# Dynamo graph MET_Galpao_Gerdau_Tipo1.dyn (Dynamo 2.13.1.3887)

# group: Seleciona e ordena os Andares - Definição semántica Andares > Nota
# note: Para o funcionamento deste algoritmo é
# necessário que o modelo Revit  tenha 4
# Andares iniciais.
# A função poderia ser expandida para criar
# esses andares previamente.

# group: Referência: GERDAU - Coletânea do Uso do Aço - Galpões em pórticos com Perfis Estruturais Laminados. Fernando Ottoboni Pinho
# Algoritmo para geração de Pórticos de galpão metálica: Curso de Especialização de Estruturas de Aço - Escola Politécnica - UFRJ.
# Disciplina:  ETM602 - Desenho, Montagem e Fabricação (CAD/CAM/BIM).
# Prof. José Luis Menegotto.
file_path = Filename(".\Porticos_Gerdau.PNG")
file_from_path = FileObject(path=file_path)
readFromFile = Image.ReadFromFile(file=file_from_path)
watch_image = WatchImageCore(image=readFromFile)

# group: Seleciona e ordena os Andares - Definição semántica Andares
# Dicionário Distribuição vertical
categoria_de_andares = Categories("OST_Levels")
pega_todos_os_andares = ElementsOfCategory(Category=categoria_de_andares)
ordena_andares_por_cota_de_baixo = CodeBlock(Andares=pega_todos_os_andares)  # "Ordena Andares por Cota de baixo para cima e forma o Diccionário"
# ---------- ordena_andares_por_cota_de_baixo.designscript (9 lines) ----------
And = List.SortByKey(Andares, Andares.Elevation);
Fun = And["sortedList"][0];
Ter = And["sortedList"][1];
Bei = And["sortedList"][2];
Cum = And["sortedList"][3];

Key = ["Fundação", "Térreo", "Beiral", "Cumeeira"];
Val = [Fun       , Ter     ,  Bei    , Cum       ];
DicAndares = Dictionary.ByKeysValues(Key, Val);
# ----------------------------------------

# group: Seleciona os Tipos - Definição semántica de tipos
# Dicionário de tipos
family_types = FamilyTypes("M_Footing-Rectangular:1800 x 1200 x 450mm")
tipo_de_pilar = StructuralColumnTypes("UC305x305x97")  # graph input
tipo_de_viga = StructuralFramingTypes("UB406x178x60")  # graph input
tipo_de_terças = StructuralFramingTypes("HSS152.4X152.4X9.5")  # graph input
tipos = CodeBlock(tif=family_types, tip=tipo_de_pilar, tiv=tipo_de_viga, tit=tipo_de_terças)
# ---------- tipos.designscript (7 lines) ----------
tif;
tip;
tiv;
tit;
Key = ["Fundação", "Pilar", "Viga", "Terça"];
Val = [tif       ,  tip   ,  tiv  ,  tit   ];
DicTipos = Dictionary.ByKeysValues(Key, Val);
# ----------------------------------------

# group: Ingressa Dimensões e forma Diccionario dimensional - Definição semántica dimensional
# Dicionário dimensional
cota_fundação = DoubleSlider(-1000, range=-1000..-200 step 20)  # graph input
cota_térreo = DoubleSlider(120, range=0..200 step 20)  # graph input
vão_x = DoubleSlider(26000, range=15000..60000 step 500)  # graph input
vão_y = DoubleSlider(28500, range=5000..30000 step 500)  # graph input
altura_andar = DoubleSlider(5000, range=5000..12000 step 250)  # graph input
inclinação = DoubleSlider(10, range=0..20 step 1)  # graph input
distância_inicial_entre_terças = DoubleSlider(1500, range=1500..2500 step 250)  # graph input
apoiar_a_terça_sobre_a_viga = BoolSelector(true)
ingressa_dimensões_e_forma = CodeBlock(CotaFun=cota_fundação, CotaTer=cota_térreo, DimX=vão_x, DimY=vão_y, DimZ=altura_andar, Inc=inclinação, dit=distância_inicial_entre_terças, apv=apoiar_a_terça_sobre_a_viga)  # "Ingressa Dimensões e forma Diccionario dimensional"
# ---------- ingressa_dimensões_e_forma.designscript (12 lines) ----------
CotaFun;
CotaTer;
DimX;
DimY;
DimZ;
Inc;
dit;
apv;

Key = ["CotaFun", "CotaTer", "DimX", "DimY","DimZ", "Inc", "dit","apv" ];
Val = [CotaFun  ,  CotaTer ,  DimX ,  DimY , DimZ ,  Inc ,  dit , apv  ];
DicDim = Dictionary.ByKeysValues(Key, Val);
# ----------------------------------------

# group: Definição do perfil do Pórtico Simples (tipo 1)
# Algoritmo para geração de Pórticos de galpão metálica: Curso de Especialização de Estruturas de Aço - Escola Politécnica - UFRJ.
# Disciplina:  ETM602 - Desenho, Montagem e Fabricação (CAD/CAM/BIM).
# Prof. José Luis Menegotto.
pontos_e_linhas_do_pórtico_tipo = CodeBlock(andares=ordena_andares_por_cota_de_baixo.DicAndares, tipos=tipos.DicTipos, dimensoes=ingressa_dimensões_e_forma.DicDim)  # "Pontos e linhas do Pórtico Tipo 1"
# ---------- pontos_e_linhas_do_pórtico_tipo.designscript (68 lines) ----------
andares;
tipos;
dimensoes;

Fun     = andares["Fundação"];
Ter     = andares["Térreo"];
Bei     = andares["Beiral"];
Cum     = andares["Cumeeira"];

tif     = tipos["Fundação"];
tip     = tipos["Pilar"   ];
tiv     = tipos["Viga"    ];
tit     = tipos["Terça"   ];

CotaFun = dimensoes["CotaFun"];
CotaTer = dimensoes["CotaTer"];
DimX    = dimensoes["DimX"];
DimY    = dimensoes["DimY"];
DimZ    = dimensoes["DimZ"];
Inc     = dimensoes["Inc"];
dit     = dimensoes["dit"];
apv     = dimensoes["apv"];

FUN = Level.SetParameterByName (Fun , "Elevation", CotaFun );
TER = Level.SetParameterByName (Ter , "Elevation", CotaTer );
BEI = Level.SetParameterByName (Bei , "Elevation", CotaTer+DimZ );
CUM = Level.SetParameterByName (Cum , "Elevation", CotaTer+DimZ+z1 );
Tg  = Math.Tan(Inc);
vx  = DimX/2;
vy  = DimY;
vz  = DimZ + CotaTer;
x0  = -vx..vx..vx;
y0  =   0..vy..#5;
z0  =  CotaFun..vz..vz+Math.Abs(CotaFun);
z1  =  vx * Tg;

agi = apv==true?180:0;
PtO = Point.ByCoordinates( x0<1>     , y0    , z0<2>);
PtT = Transpose          ( PtO                      );
PtC = Point.Translate    ( PtT[1][1] , 0 , 0 , z1   );

PiE = Line.ByStartPointEndPoint ( PtT[0][0] , PtT[1][0] );
PiD = Line.ByStartPointEndPoint ( PtT[0][2] , PtT[1][2] );
ViE = Line.ByStartPointEndPoint ( PtC       , PtT[1][0] );
ViD = Line.ByStartPointEndPoint ( PtC       , PtT[1][2] );

pitE = Line.PointAtParameter    ( ViE , 0.025 );
pitD = Line.PointAtParameter    ( ViD , 0.025 );

TrE = Line.PointsAtSegmentLengthFromPoint( ViE, pitE, dit);
TrD = Line.PointsAtSegmentLengthFromPoint( ViD, pitD, dit);

VtE = Line.ByStartPointEndPoint ( TrE[0] , TrE[-1] );
VtD = Line.ByStartPointEndPoint ( TrD[0] , TrD[-1] );
VCe = Line.ByStartPointEndPoint ( PtC[0] , PtC[-1] );

EFE = FamilyInstance.ByPoint         ( tif , PiE.StartPoint );
EFD = FamilyInstance.ByPoint         ( tif , PiD.StartPoint );
EPE = StructuralFraming.ColumnByCurve( PiE , Fun , tip);
EPD = StructuralFraming.ColumnByCurve( PiD , Fun , tip);
EVE = StructuralFraming.BeamByCurve  ( ViE , Bei , tiv);
EVD = StructuralFraming.BeamByCurve  ( ViD , Bei , tiv);
ETE = StructuralFraming.BeamByCurve  ( VtE , Cum , tit);
ETD = StructuralFraming.BeamByCurve  ( VtD , Cum , tit);

Key     = ["EFE", "EFD", "EPE","EPD","EVE","EVD","ETE","ETD", "Inc","agi"];
Val     = [ EFE ,  EFD ,  EPE , EPD , EVE , EVD , ETE , ETD ,  Inc , agi];
DicObje = Dictionary.ByKeysValues(Key, Val);
# ----------------------------------------
setagem_de_parâmetros = CodeBlock(andares=pontos_e_linhas_do_pórtico_tipo.andares, Objetos=pontos_e_linhas_do_pórtico_tipo.DicObje)
# ---------- setagem_de_parâmetros.designscript (46 lines) ----------
andares;
Objetos;

EFE = Objetos["EFE"];
EFD = Objetos["EFD"];
EPE = Objetos["EPE"];
EPD = Objetos["EPD"];
EVE = Objetos["EVE"];
EVD = Objetos["EVD"];
ETE = Objetos["ETE"];
ETD = Objetos["ETD"];
Inc = Objetos["Inc"];
agi = Objetos["agi"];

Fun = andares["Fundação"];
Ter = andares["Térreo"  ];
Bei = andares["Beiral"  ];
Cum = andares["Cumeeira"];

FamilyInstance.SetParameterByName( EFE , "Mark"     , ""+EFE.Id);
FamilyInstance.SetParameterByName( EFD , "Mark"     , ""+EFD.Id);
FamilyInstance.SetParameterByName( EPE , "Mark"     , ""+EPE.Id);
FamilyInstance.SetParameterByName( EPD , "Mark"     , ""+EPD.Id);
FamilyInstance.SetParameterByName( EVE , "Mark"     , ""+EVE.Id);
FamilyInstance.SetParameterByName( EVD , "Mark"     , ""+EVD.Id);
FamilyInstance.SetParameterByName( ETE , "Mark"     , ""+ETE.Id);
FamilyInstance.SetParameterByName( ETD , "Mark"     , ""+ETD.Id);

FamilyInstance.SetParameterByName( EPE , "Top Level"       , Bei );
FamilyInstance.SetParameterByName( EPD , "Top Level"       , Bei );
FamilyInstance.SetParameterByName( ETE , "Reference Level" , Cum );
FamilyInstance.SetParameterByName( ETD , "Reference Level" , Cum );

FamilyInstance.SetParameterByName( EPE , "Cross-Section Rotation" ,  90);
FamilyInstance.SetParameterByName( EPD , "Cross-Section Rotation" ,  90);
FamilyInstance.SetParameterByName( ETE , "Cross-Section Rotation" ,  Inc+agi);
FamilyInstance.SetParameterByName( ETD , "Cross-Section Rotation" , -Inc+agi);

FamilyInstance.SetParameterByName( EFE , "UsoEstrutural" , "Base" );
FamilyInstance.SetParameterByName( EFD , "UsoEstrutural" , "Base" );
FamilyInstance.SetParameterByName( EPE , "UsoEstrutural" , "Pilar");
FamilyInstance.SetParameterByName( EPD , "UsoEstrutural" , "Pilar");
FamilyInstance.SetParameterByName( EVE , "UsoEstrutural" , "Viga" );
FamilyInstance.SetParameterByName( EVD , "UsoEstrutural" , "Viga" );
FamilyInstance.SetParameterByName( ETE , "UsoEstrutural" , "Terca");
FamilyInstance.SetParameterByName( ETD , "UsoEstrutural" , "Terca");
# ----------------------------------------

watch = Watch()  # unwired: arg0
