# Dynamo graph MET_Matriz_R.dyn (Dynamo 2.13.1.3887)

# group: Cria linhas de Vigas em direções horizontal e vertical
# Algoritmo para geração de Malha estrututural: Curso de Especialização de Estruturas de Aço - Escola Politécnica - UFRJ.
# Disciplina:  ETM602 - Desenho, Montagem e Fabricação (CAD/CAM/BIM).
# Prof. José Luis Menegotto.
quantidade_eixos_em_x_qx = DoubleSlider(5, range=1..20 step 1)
quantidade_de_eixos_em_y_qy = DoubleSlider(3, range=1..26 step 1)
dimensão_entre_eixos_em_x_dx = DoubleSlider(3000, range=2000..6000 step 500)
dimensão_entre_eixos_em_y_dy = DoubleSlider(2000, range=2000..20000 step 500)
cria_linhas_de_vigas_em_sentido = CodeBlock(qx=quantidade_eixos_em_x_qx, qy=quantidade_de_eixos_em_y_qy, dx=dimensão_entre_eixos_em_x_dx, dy=dimensão_entre_eixos_em_y_dy)  # "Cria linhas de Vigas em sentido horizontal (X) e vertical (Y)"
# ---------- cria_linhas_de_vigas_em_sentido.designscript (35 lines) ----------
qx;
qy;
dx;
dy;
//------------------------------------------
// Centralizar as coordenadas
//------------------------------------------
cx  = (qx-1)*dx*0.5;
cy  = (qy-1)*dy*0.5;
x   = (0..#qx..dx)-cx;
y   = (0..#qy..dy)-cy;
//------------------------------------------
// Forma as listas de pontos
//------------------------------------------
PtX = Point.ByCoordinates ( x<1>, y   , 0 );
PtY = Point.ByCoordinates ( x   , y<1>, 0 );
// PtY = Transpose(PtX) pode ser usada;
//------------------------------------------
// Indices das Diagonais
//------------------------------------------
i   = 0..qx-2;
j   = i+1;
k   = 0..qy-2;
l   = k+1;
//------------------------------------------
// Coloca as linhas
//------------------------------------------
ViH = Line.ByStartPointEndPoint(PtX[i] , PtX[j]);
ViV = Line.ByStartPointEndPoint(PtY[k] , PtY[l]);
//------------------------------------------
// Definição semântica
//------------------------------------------
llave = ["Vigas_H" , "Vigas_V" ];
valor = [ ViH      ,  ViV      ];
Dicio = Dictionary.ByKeysValues( llave, valor );
# ----------------------------------------

# group: Indices para a Vigas em sentido horizontal (X)
# Aplicados na Lista   PtC = List.Flatten  (PtY  , 1  );
indices_i = Watch(cria_linhas_de_vigas_em_sentido.i)
indices_j = Watch(cria_linhas_de_vigas_em_sentido.j)

# group: Indices para a Vigas em sentido vertical (Y)
# Aplicados na Lista   PtC = List.Flatten  (PtY  , 1  );
indices_l = Watch(cria_linhas_de_vigas_em_sentido.l)
indices_k = Watch(cria_linhas_de_vigas_em_sentido.k)

# group: Esquema dos pontos e dos Indices para as vigas horizontais
# Curso de Especialização de Estruturas de Aço - Escola Politécnica - UFRJ.
# Disciplina:  ETM602 - Desenho, Montagem e Fabricação (CAD/CAM/BIM).
# Prof. José Luis Menegotto.
file_path = Filename("..\Met_Matriz_R_horizontal.PNG")
file_from_path = FileObject(path=file_path)
readFromFile = Image.ReadFromFile(file=file_from_path)
watch_image = WatchImageCore(image=readFromFile)

# group: Esquema dos pontos e dos Indices para as vigas verticais
# Curso de Especialização de Estruturas de Aço - Escola Politécnica - UFRJ.
# Disciplina:  ETM602 - Desenho, Montagem e Fabricação (CAD/CAM/BIM).
# Prof. José Luis Menegotto.
file_path_2 = Filename("..\Met_Matriz_R_vertical.PNG")
file_from_path_2 = FileObject(path=file_path_2)
readFromFile_2 = Image.ReadFromFile(file=file_from_path_2)
watch_image_2 = WatchImageCore(image=readFromFile_2)
