# Dynamo graph Viaduto_Millau_2023.dyn (Dynamo 2.18.1.5096)

# group: Função comentada de marcação da estrutura do Viaduto Millau. Revit 2023.
# Escola Politécnica da UFRJ. Departamento de Expressão Gráfica.
# Disciplina: Desenho Computacional / BIM
# Autor: Prof. José Luis Menegotto
Z1 = DoubleSlider(0, range=0..100 step 0.1)
longitude = DoubleSlider(2400, range=1000..2500 step 50)
flecha = DoubleSlider(8.3, range=0..150 step 0.1)
altura_do_mastro = DoubleSlider(87, range=80..200 step 0.5)
altura_do_pilone = DoubleSlider(244.8, range=100..260 step 1.5)
parâmetro_superior_dos_estais = DoubleSlider(0.99, range=0.7..0.99 step 0.01)
parâmetro_inferior_dos_estais = DoubleSlider(0.59, range=0.5..0.65 step 0.01)
# note: Embora se trate de uma obra construída com suas dimensões já estão definidas, o exercício pretende
# exemplificar como um projeto pode ser estudado com ferramentas computacionais que permitam realizar um processo de ajuste e controle dimensional paramétrico.
viaduto_millau_marcação_da = CodeBlock(z1=Z1, longi=longitude, corda=flecha, AltMastro=altura_do_mastro, AltPilone=altura_do_pilone, es=parâmetro_superior_dos_estais, ei=parâmetro_inferior_dos_estais)  # "Viaduto Millau - Marcação da estrutura."
# ---------- viaduto_millau_marcação_da.designscript (71 lines) ----------
z1;
longi;
corda;
AltMastro;
AltPilone;
es;
ei;
qe           = 11.0;
AltCaixao    =  4.5;
Modulos      = 14.0;
ModulosX     = 210;
qm           = ModulosX / Modulos;
segm         = 0..1..1/ModulosX;
AltPista     = AltPilone + AltCaixao;
V_Cai        = Vector.Scale(Vector.ZAxis(), -AltCaixao);
V_Pil        = Vector.Scale(Vector.ZAxis(),  AltPilone);
V_Mas        = Vector.Scale(Vector.ZAxis(),  AltMastro);
// -------------------------------------------------------
// Definição dos arcos da pista
// -------------------------------------------------------
p1           = Point.ByCoordinates   ( 0        , 0     , z1 );
p2           = Point.ByCoordinates   ( longi/2  , corda , z1 );
p3           = Point.ByCoordinates   ( longi    , 0     , z1 );
Eixo         = Arc.ByThreePoints     ( p1 , p2  , p3         );
// -------------------------------------------------------
// Definição das seções do caixão
// -------------------------------------------------------
Pto_CL       = Arc.PointAtParameter  ( Eixo   , segm ).Translate(0, 0, AltPista);
V_Nor        = Arc.NormalAtParameter ( Eixo   , segm );
Pto_CE       = Point.Translate       ( Pto_CL , V_Nor , [ 16.02 , -16.02]<1>);
Pto_CI       = Point.Translate       ( Pto_CL , V_Nor , [  2.50 ,  -2.50]<1>);
Pto_IN       = Point.Translate       ( Pto_CI , V_Cai );
L_PtoX       = List.Transpose        ( [Pto_CE[0], Pto_CE[1], Pto_IN[1], Pto_IN[0]]);
POL_CX       = PolyCurve.ByPoints    ( L_PtoX, true);
// -------------------------------------------------------
// Divisão do Arco da Pista em Segmentos entre Mastros
// -------------------------------------------------------
epe          = 0+(1/qm)..1..#qm;
epd          = 1-(1/qm)..0..#qm;
Pista_Segmen = Arc.DivideEqually     ( Eixo    , Modulos );
Pista_EsqDir = List.TakeEveryNthItem ( Pista_Segmen , [2,2]  , [1,2] );
Cab_Esq      = Line.PointAtParameter ( Pista_EsqDir[0] , epe<1> );
Cab_Dir      = Line.PointAtParameter ( Pista_EsqDir[1] , epd<1> );
Pis_EstE     = Point.Translate       ( Cab_Esq, 0, 0 , AltPista);
Pis_EstD     = Point.Translate       ( Cab_Dir, 0, 0 , AltPista);
// -------------------------------------------------------
// Coloca Eixo do Pilone
// -------------------------------------------------------
Pto_Pil      = Line.PointAtParameter(Pista_EsqDir[0], 1);
Pilones      = Line.ByStartPointDirectionLength(Pto_Pil, V_Pil, AltPilone);
// -------------------------------------------------------
// Coloca Eixo do Mastro
// -------------------------------------------------------
Pto_Mas      = Point.Translate(Pto_Pil, 0, 0, AltPista);
Mastros      = Line.ByStartPointDirectionLength(Pto_Mas, V_Pil, AltMastro);
// -------------------------------------------------------
// Definição dos pontos dos Estais sobre os Mastros
// -------------------------------------------------------
i_Mastr      = List.TakeItems        ( ei..es..(es-ei)/(qe+2) , 11 );
Pto_EsE      = Transpose(Line.PointAtParameter ( Mastros<1> , List.Reverse(i_Mastr)));
Pto_EsD      = Transpose(Line.PointAtParameter ( Mastros<1> , List.Reverse(i_Mastr)));
// ------------------------------------------------------
// Traçado dos Estais
// ------------------------------------------------------
L_EstaE      = Line.ByStartPointEndPoint(Pto_EsE , Pis_EstE);
L_EstaD      = Line.ByStartPointEndPoint(Pto_EsD , Pis_EstD);
// ----------------------------------------------------
// Colocação dos Levels
// ----------------------------------------------------
//Level.ByElevationAndName(AltPista , "Viaduto_Pista");
//Level.ByElevationAndName(p1.Z     , "Viaduto_Base");
# ----------------------------------------
