# Dynamo graph Viaduto_Millau_Pilone_Forma_2023.dyn (Dynamo 2.16.1.2727)

# group: Função de criação de Pilone Inferior do Viaduto Millau
# Escola Politécnica da UFRJ. Departamento de Expressão Gráfica
# Autor: Prof. José Luis Menegotto.
# Disciplina: Desenho Computacional
DX = IntegerSlider(10, range=1..10 step 1)
DY = IntegerSlider(1, range=1..10 step 1)
fator = IntegerSlider(80, range=1..100 step 1)
code_block = CodeBlock(F=fator) { F* 0.05; }
altura_pilone = DoubleSlider(244, range=200..250 step 1)
altura_fenda = DoubleSlider(90, range=1..200 step 1)
dx = IntegerSlider(2, range=1..6 step 1)
dy = IntegerSlider(3, range=1..6 step 1)
pilone_inferior_sólido = CodeBlock(alt=altura_pilone, fen=altura_fenda, dx=dx, dy=dy)
# ---------- pilone_inferior_sólido.designscript (51 lines) ----------
alt;
fen;
dx;
dy;
eXs = 10;
eXi = 27;
eYs = 16;
eYi = 17;
alm = alt - fen;
Txs = eXs/2;
Txi = eXi/2;
Tys = eYs/2;
Tyi = eYi/2;
Txm = eXm/2;
Tym = eYm/2;

Mxi = List.Flatten([Txi,  dx, -dx, -Txi, -Txi,  -dx,   dx, Txi], 1);
Myi = List.Flatten([ dy, Tyi, Tyi,   dy,  -dy, -Tyi, -Tyi, -dy], 1);
Mzi = List.Flatten([  0,   0,   0,    0,    0,    0,    0,   0], 1);
Mxm = List.Flatten([Txm,  dx, -dx, -Txm, -Txm,  -dx,   dx, Txm], 1);
Mym = List.Flatten([ dy, Tym, Tym,   dy,  -dy, -Tym, -Tym, -dy], 1);
Mzm = List.Flatten([alm, alm, alm,  alm,  alm,  alm,  alm, alm], 1);
Mxs = List.Flatten([Txs,  dx, -dx, -Txs, -Txs,  -dx,   dx, Txs], 1);
Mys = List.Flatten([ dy, Tys, Tys,   dy,  -dy, -Tys, -Tys, -dy], 1);
Mzs = List.Flatten([alt, alt, alt,  alt,  alt,  alt,  alt, alt], 1);

L_Poi = Point.ByCoordinates ( Mxi , Myi , Mzi);
L_Pom = Point.ByCoordinates ( Mxm , Mym , Mzm);
L_Pos = Point.ByCoordinates ( Mxs , Mys , Mzs);

VTG   = Vector.Reverse(Vector.ZAxis());

ps     = Point.ByCoordinates (0     ,   0   , alt );
pi     = Point.ByCoordinates (0     ,   0   ,   0 );
Eixo   = Line.ByStartPointEndPoint( ps , pi );
p1     = Point.ByCoordinates (eXs/2 ,   0   , alt );
p2     = Point.ByCoordinates (eXi/2 ,   0   ,   0 );
Arco1  = Arc.ByStartPointEndPointStartTangent( p1 , p2 , VTG);
p3     = Point.ByCoordinates (0     , eYs/2 , alt );
p4     = Point.ByCoordinates (0     , eYi/2 ,   0 );
Arco2  = Line.ByStartPointEndPoint( p3 , p4 );
pf     = Line.PointAtSegmentLength(Eixo, fen);
p5     = Point.Project ( pf , Arco1 , Vector.XAxis());
p6     = Point.Project ( pf , Arco2 , Vector.YAxis());
eXm    = List.Flatten  ( pf.DistanceTo ( p5 )*2, 1);
eYm    = List.Flatten  ( pf.DistanceTo ( p6 )*2, 1);
SIN    = PolyCurve.ByPoints ( L_Poi , true );
SME    = PolyCurve.ByPoints ( L_Pom , true );
SSU    = PolyCurve.ByPoints ( L_Pos , true );

Solido = Solid.ByLoft( List.Flatten([ SIN,  SME, SSU], 2));
# ----------------------------------------
definição_do_vazio_da_fenda = CodeBlock(dx=DX, dy=DY, fat=code_block, fen=pilone_inferior_sólido.alt, ps=pilone_inferior_sólido.ps, pf=pilone_inferior_sólido.pf, Solido=pilone_inferior_sólido.Solido)
# ---------- definição_do_vazio_da_fenda.designscript (21 lines) ----------
dx;
dy;
fat;
fen;
ps;
pf;
Solido;

cXi = [0 ,  dx,  0, -dx];
cYi = [dy,  0, -dy,   0];
cZi = pf.Z;
cXs = cXi * fat;
cYs = cYi * fat;
cZs = ps.Z;

Pts   = Point.ByCoordinates( cXs , cYs , cZs );
Pti   = Point.ByCoordinates( cXi , cYi , cZi );
Polis = PolyCurve.ByPoints ( Pts , true      );
Polii = PolyCurve.ByPoints ( Pti , true      );

Vazio  = Solid.ByLoft([ Polis,  Polii ]);
# ----------------------------------------
modela = BoolSelector(false)
categories = Categories("OST_StructuralColumns")
definição_do_modelo_do_pilone_na = CodeBlock(Solido=definição_do_vazio_da_fenda.Solido, Vazio=definição_do_vazio_da_fenda.Vazio, model=modela, categ=categories)  # "Definição do Modelo do Pilone na categoria Structural Column"
# ---------- definição_do_modelo_do_pilone_na.designscript (5 lines) ----------
Pilone = Solid.Difference(Solido, Vazio);
mater  = Material.ByName("Concrete, Cast In Situ");
model;
categ;
model ? DirectShape.ByGeometry(Pilone, categ, mater, "Pilone") : null;
# ----------------------------------------
