# Dynamo graph PPE_Room_Pisos_e_Laje.dyn (Dynamo 2.3.0.5885)

categories = Categories("OST_Rooms")
all_elements_of_category = ElementsOfCategory(Category=categories)
categories_2 = Categories("OST_Levels")
all_elements_of_category_2 = ElementsOfCategory(Category=categories_2)
pisos_internos_de_anteprojeto = FloorTypes("Piso_Basico")
laje_estrutural_de_anteprojeto = FloorTypes("Laje_Estrutural_10cm")
categories_3 = Categories("OST_Walls")
all_elements_of_category_3 = ElementsOfCategory(Category=categories_3)
viga_básica_de_anteprojeto = StructuralFramingTypes("Basica")
coloca_piso_e_laje_no_ambiente = CodeBlock(Amb=all_elements_of_category, Lev=all_elements_of_category_2, Pin=pisos_internos_de_anteprojeto, Pie=laje_estrutural_de_anteprojeto, EPA=all_elements_of_category_3, TIV=viga_básica_de_anteprojeto)  # "Coloca piso e Laje no Ambiente usando Rooms e Levels"
# ---------- coloca_piso_e_laje_no_ambiente.designscript (19 lines) ----------
Amb;
Lev;
Pin;
Pie;
//------------------------------------------------------------------
//  Coloca Viga básica sob os eixos das paredes
//------------------------------------------------------------------
PAR = Element.GetLocation                    ( EPA                    );
AND = Wall.GetParameterValueByName           ( EPA , "Base Constraint");
VIG = StructuralFraming.BeamByCurve          ( PAR , AND , TIV        );
//------------------------------------------------------------------
//  Coloca Laje estrutural e piso arquitetônico usando o Room
//------------------------------------------------------------------
Per = Room.CoreBoundary                      ( Amb                 );
Pis = Floor.ByOutlineTypeAndLevel            ( Per<1> , Pin , Lev  );
Laj = Floor.ByOutlineTypeAndLevel            ( Per<1> , Pie , Lev  );
Ofs = FamilyInstance.GetParameterValueByName ( Pis , "Thickness"   );
Nii = FamilyInstance.SetParameterByName      ( Pis , "Height Offset From Level", Ofs);
Nie = FamilyInstance.SetParameterByName      ( Laj , "Height Offset From Level", 0);
# ----------------------------------------
