# Dynamo custom node Analisar_Divisas.dyf (Dynamo 2.3.0.5885)
# category: Lote
# Analisa linhas de força do terreno

Lote = Input(Lote: var[]..[] = 0)
Afastamento = Input(Afastamento: var[]..[] = 1)
Pos_Longitudinal = Input(Pos_Longitudinal: var[]..[] = 0.5)
Pos_Transversal = Input(Pos_Transversal: var[]..[] = 0.5)
análise_da_geometria_do_lote = CodeBlock(DadosLote=Lote, DAF=Afastamento, t=Pos_Longitudinal, DesT=Pos_Transversal)
# ---------- análise_da_geometria_do_lote.designscript (69 lines) ----------
DadosLote;
DAF;
t;
DesT;
//--------------------------------------------------------------------------
// Captura Linhas da divisa
//--------------------------------------------------------------------------
LOTE  = DadosLote["Lote"];
OCUP  = LOTE.Offset  ( -DAF  ,  false  );
LinO  = OCUP.Explode (                 );
//--------------------------------------------------------------------------
// Orienta os vetores Normais da divisa
//--------------------------------------------------------------------------
qs    = List.Count              ( LinO            )-1;
vt    = Line.TangentAtParameter ( LinO [0..qs] , 0);
Zvt   = Vector.Cross            ( vt[0] , vt[1]   ).Z;
Fo    = Zvt > 0 ?  1 : -1;
De    = Zvt < 0 ?  1 : -1;
//--------------------------------------------------------------------------
//Captura os pontos e Normais da divisa
//--------------------------------------------------------------------------
PtsO  = Line.PointAtParameter               ( LinO , 0                 );
PtsM  = Line.PointAtParameter               ( LinO , 0.5               );
NoFo  = Line.NormalAtParameter              ( LinO , 0.5).Scale (  Fo  );
NoDe  = Line.NormalAtParameter              ( LinO , 0.5).Scale (  De  );
//--------------------------------------------------------------------------
//Define Eixo significativo do Lote, Origem, Dir Normais e Tang
//--------------------------------------------------------------------------
Ldi   = [ 1 , -1 ];
EixS  = Line.ByBestFitThroughPoints         ( PtsO                     );
PtsS  = Geometry.Intersect                  ( EixS    , OCUP           );
LinS  = Line.ByStartPointEndPoint           ( PtsS[0] , PtsS[1]        );
O     = Line.PointAtParameter               ( LinS    , t              );
T     = Line.TangentAtParameter             ( LinS    , t ).Scale( Ldi );
N     = Line.NormalAtParameter              ( LinS    , t ).Scale( Ldi );
//--------------------------------------------------------------------------
//Define Linhas de Penetração ao Terreno no Ponto médio e Normal
//--------------------------------------------------------------------------
PtsT  = Point.Project                       ( O       , OCUP   , N     );
LinP  = Line.ByStartPointDirectionLength    ( PtsM    , NoDe   , DAF+1 );
LinT  = Line.ByStartPointEndPoint           ( PtsT[0] , PtsT[1]        );
//--------------------------------------------------------------------------
//Define Eixo Longitudinal da implantação do projeto
//--------------------------------------------------------------------------
Vz    = Vector.ZAxis();
Dime  = DesT * LinT.Length;
OLOC  = Line.PointAtSegmentLength           ( LinT    , Dime          );
PtsL  = Point.Project                       ( OLOC    , OCUP , T<1>   );
PtsC  = Point.Project                       ( OLOC    , OCUP , NoFo<1>);
LinC  = Line.ByStartPointEndPoint           ( OLOC    , PtsC <1>      );
Coin  = List.Equals                         ( PtsL[0] , PtsL[1]       );
LinL  = Coin?null:Line.ByStartPointEndPoint ( PtsL[0] , PtsL[1]       );
Circ  = Circle.ByCenterPointRadius          ( OLOC    , 0.5           );
Angu  = Vector.AngleAboutAxis               ( N<1>    , NoDe ,  Vz    );
//--------------------------------------------------------------------------
//Extração de resultados utilizando Dicionário
//--------------------------------------------------------------------------
AreaL = DadosLote["Area"];
Key   = [
          "LOTE" , "OCUP", "PtsO", "PtsM", "NoDe", "NoFo", "PtsL", "PtsT",
          "OLOC" , "Circ", "LinO", "LinS", "LinT", "LinL", "LinP", "Angu",
          "AreaL", "PtsC", "LinC", "T"   , "N"   , "O"
        ];
Val   = [
           LOTE  , OCUP  , PtsO  , PtsM  , NoDe  ,  NoFo , PtsL  , PtsT  ,
           OLOC  , Circ  , LinO  , LinS  , LinT  ,  LinL , LinP  , Angu  ,
           AreaL , PtsC  , LinC  , T     , N     ,  O
        ];
DIC   = Dictionary.ByKeysValues ( Key , Val );
# ----------------------------------------
Dados_do_Lote = Output(análise_da_geometria_do_lote.DIC)
