# Dynamo graph Distribui_Elem_Forro.dyn (Dynamo 4.0.2.3852)

# group: Distribui elementos ordenados em Forros
# Disciplina BIM - DEG/POLI/UFRJ
# Autor: Prof. José Luis Menegotto
categories = Categories("OST_LightingFixtures")
all_elements_of_category = ElementsOfCategory(Category=categories)
# note: Uso de funcionalidade reativa  para reposicionar
# elementos colocados no forro.
# Uso de agrupamento por hospedeiro e Dicionários
# A função precisa de uma familia hospedada
# em forros (Ceiling) para modificar o seu posicionamento.
# Especial atenção com a variável cen, utilizada para
# posicionar o coordinatesystem na primeira linha do
# código e na linha 37 onde se define o seu valor.
indice_de_processamento = IntegerSlider(0, range=0..5 step 1)
distribui_elementos_em_forros = CodeBlock(ele=all_elements_of_category, ip=indice_de_processamento)
# ---------- distribui_elementos_em_forros.designscript (45 lines) ----------
ele;
ip;
//----------------------------------------------------------
// Como o Centroide do sólido do forro se posiciona acima da
// face com a metade da espessura, se guarda a variável alt
// com esse valor negativo para que ao calcular a posição
// o ponto possa se deslocar para abaixo.
// O aluno pode desenvolver uma função para que que esse
// valor seja automáticamente extraído da familia tipo do
// forro. No momento o valor (-0.052) está determinado.
//
// O outro valor determinado é o raio.
// Com ele se organizam os pontos ao redor do ponto
// central do forro. Esse valor, evidentemente, não pode ser
// maior que a metade da menor largura do ambiente descontado
// o raio da luminária e um valor de distância às paredes,
// pois senão a luminária cairá fora do compartimento ou numa
// posição inconveniente.
//----------------------------------------------------------
cs    = CoordinateSystem.ByOrigin( cen );
alt   = -0.052/2;
rai   = 1.45;
//----------------------------------------------------------
// Agrupa elementos e os ceilings que os hospedam
// Podem ser luminárias, detectores, sensores, etc.
// Processa os itens do grupo de índice ip
//----------------------------------------------------------
hospe = FamilyInstance.GetHost (  ele         );
agrup = List.GroupByKey        (  ele , hospe );
hos   = agrup["unique keys"][ip];
grp   = agrup["groups"     ][ip];
//----------------------------------------------------------
// Utiliza o Ceiling para capturar a posição atual
//----------------------------------------------------------
q     = List.Count          ( grp );
sol   = Ceiling.GetGeometry ( hos );
cen   = Solid.Centroid      ( sol );
faa   = 0..360..(360/q);
ang   = List.DropItems      ( faa , 1 );
//----------------------------------------------------------
// Reposiciona os elementos com o ordenamento programado
//----------------------------------------------------------
pin   = Point.ByCylindricalCoordinates(cs, ang<1>, alt, rai);
pfi   = List.Flatten ( pin , 1 );
grp.SetLocation ( pfi );
# ----------------------------------------
watch = Watch(distribui_elementos_em_forros.alt)
