# Dynamo graph Matriz_XYZ.dyn (Dynamo 2.17.1.4055)

# group: Matriz Retangular
# Desenvolvido como material didático para a Disciplina BIM;
# Prof: José Luis Menegotto  POLI/UFRJ
structural_column_types = StructuralColumnTypes("HP200X53")
structural_framing_types = StructuralFramingTypes("W150X24")
DX = DoubleSlider(6.75, range=1..10 step 0.25)
DY = DoubleSlider(5.25, range=1..10 step 0.25)
altura_andar = DoubleSlider(4.14, range=3.6..6 step 0.18)
quanti_x = IntegerSlider(1, range=1..10 step 1)
quanti_y = IntegerSlider(1, range=1..10 step 1)
quantidade_de_andares = IntegerSlider(1, range=1..25 step 1)
cota_rn = CodeBlock { 0.0; }
matriz_retangular_xyz = CodeBlock(dx=DX, dy=DY, dz=altura_andar, qx=quanti_x, qy=quanti_y, qz=quantidade_de_andares, cotaRN=cota_rn)
# ---------- matriz_retangular_xyz.designscript (27 lines) ----------
dx;
dy;
dz;
qx;
qy;
qz;
cotaRN;

a  = 0..qx;
b  = 0..qy;
c  = 0..qz;

x  = (a * dx);
y  = (b * dy);
z  = (c * dz) + cotaRN;

px = Point.ByCoordinates( x<1> , y    , z<2> );
py = Point.ByCoordinates( x    , y<1> , z<2> );
pz = Point.ByCoordinates( x<2> , y    , z<1> );

vx = Line.ByStartPointEndPoint( px[i] , px[i+1] );
vy = Line.ByStartPointEndPoint( py[j] , py[j+1] );
co = Line.ByStartPointEndPoint( pz[k] , pz[k+1] );

i  = 0..Count(px)-2;
j  = 0..Count(py)-2;
k  = 0..Count(pz)-2;
# ----------------------------------------
code_block = CodeBlock(alt=matriz_retangular_xyz.z, vx=matriz_retangular_xyz.vx, vy=matriz_retangular_xyz.vy, cz=matriz_retangular_xyz.co)
# ---------- code_block.designscript (28 lines) ----------
alt;
vx;
vy;
cz;
//Coloca Andares -------------------------------------------------
pav  = 0..List.Count( alt )-1;
max  = pav[-1];
nome = pav==0 ? "Térreo" : pav==max ? "Cobertura" : pav+"° Andar";
Pavto = Level.ByElevationAndName  ( alt , nome );

//Coloca Eixos ---------------------------------------------------
e    = 2;
ex1  = vx[  0][0].StartPoint.Translate ( -e ,  0 ,  0 );
ex2  = vx[ -1][0].EndPoint  .Translate (  e ,  0 ,  0 );
ey1  = vy[  0][0].StartPoint.Translate (  0 , -e ,  0 );
ey2  = vy[ -1][0].EndPoint  .Translate (  0 ,  e ,  0 );
Let  = [
         "A", "B", "C", "D", "E", "F", "G", "H", "I", "J",
         "K", "L", "M", "N", "O", "P", "Q", "R", "S", "T",
         "U", "V", "W", "X", "Y", "Z"
       ];
Num   = 1..List.Count(EixoY);

EixoX = Grid.ByStartPointEndPoint ( ex1 , ex2  );
EixoY = Grid.ByStartPointEndPoint ( ey1 , ey2  );

EixoX.SetParameterByName( "Name" , Let      );
EixoY.SetParameterByName( "Name" , Num + "" );
# ----------------------------------------

watch = Watch(code_block.Num)
