# Dynamo graph Matriz_XY_Contraventamentos.dyn (Dynamo 2.17.1.4055)

# group: Cria linhas de contraventamento X horizontal
# Algoritmo para geração de Malha estrututural: Curso de Especialização de Estruturas de Aço - Escola Politécnica - UFRJ.
# Disciplina:  ETM602 - Desenho, Montagem e Fabricação (CAD/CAM/BIM).
# Prof. José Luis Menegotto.
quantidade_eixos_em_x_qx = DoubleSlider(3, range=1..20 step 1)
quantidade_de_eixos_em_y_qy = DoubleSlider(4, range=1..26 step 1)
dimensão_entre_eixos_em_x_dx = DoubleSlider(2500, range=2000..6000 step 500)
dimensão_entre_eixos_em_y_dy = DoubleSlider(5000, range=2000..20000 step 500)
cria_linhas_de_contraventamento = CodeBlock(qx=quantidade_eixos_em_x_qx, qy=quantidade_de_eixos_em_y_qy, dx=dimensão_entre_eixos_em_x_dx, dy=dimensão_entre_eixos_em_y_dy)  # "Cria linhas de contraventamento X horizontal"
# ---------- cria_linhas_de_contraventamento.designscript (36 lines) ----------
qx;
qy;
dx;
dy;
//------------------------------------------
// Centraliza as coordenadas
//------------------------------------------
cx  = (qx-1)*dx*0.5;
cy  = (qy-1)*dy*0.5;
x   = (0..#qx..dx)-cx;
y   = (0..#qy..dy)-cy;
ic  =  0..qx-2;
ir  =  0..qy-2;
//------------------------------------------
// Forma as listas de pontos
//------------------------------------------
PtY = Point.ByCoordinates ( x   , y<1>, 0 );
PtC = List.Flatten        (PtY  , 1       );
//------------------------------------------
// Indices das Diagonais
//------------------------------------------
i   = List.Flatten(ic + (qx*ir)<1>, 1);
j   = i+qx+1;
k   = i+1;
l   = j-1;
//------------------------------------------
// Coloca as linhas
//------------------------------------------
Di1 = Line.ByStartPointEndPoint(PtC[i] , PtC[j]);
Di2 = Line.ByStartPointEndPoint(PtC[k] , PtC[l]);
//------------------------------------------
// Definição semântica
//------------------------------------------
llave = ["Diagonais1", "Diagonais2" ];
valor = [ Di1        ,  Di2         ];
Dicio = Dictionary.ByKeysValues( llave, valor );
# ----------------------------------------

# group: Indices para a Diagonal 1
# Aplicados na Lista   PtC = List.Flatten  (PtY  , 1  );
indices_i = Watch(cria_linhas_de_contraventamento.i)
indices_j = Watch(cria_linhas_de_contraventamento.j)

# group: Indices para a Diagonal 2
# Aplicados na Lista   PtC = List.Flatten  (PtY  , 1  );
indices_l = Watch(cria_linhas_de_contraventamento.l)
indices_k = Watch(cria_linhas_de_contraventamento.k)

# group: Esquema dos pontos e dos Indices para Diagonais 1
# Curso de Especialização de Estruturas de Aço - Escola Politécnica - UFRJ.
# Disciplina:  ETM602 - Desenho, Montagem e Fabricação (CAD/CAM/BIM).
# Prof. José Luis Menegotto.
file_path = Filename(".\MET_Contraventamentos1.png")
file_from_path = FileObject(path=file_path)
readFromFile = Image.ReadFromFile(file=file_from_path)
watch_image = WatchImageCore(image=readFromFile)

# group: Esquema dos pontos e dos Indices para Diagonais 2
# Curso de Especialização de Estruturas de Aço - Escola Politécnica - UFRJ.
# Disciplina:  ETM602 - Desenho, Montagem e Fabricação (CAD/CAM/BIM).
# Prof. José Luis Menegotto.
file_path_2 = Filename(".\MET_Contraventamentos2.png")
file_from_path_2 = FileObject(path=file_path_2)
readFromFile_2 = Image.ReadFromFile(file=file_from_path_2)
watch_image_2 = WatchImageCore(image=readFromFile_2)
