# Dynamo graph Perfis_2D.dyn (Dynamo 3.3.0.6316)

# group: Configurador de perfil 2D
# Autor: Prof. José Luis Menegotto.
# Escola Politécnica da UFRJ
# Disciplinas BIM, Descomp - Configurador de perfil 2D.
definição_de_perfil_2d = CodeBlock()
# ---------- definição_de_perfil_2d.designscript (41 lines) ----------
def Perfil ( h , hc, b , lc, p )
{
    x   =   0;
    y   = [ 0, lc,                   1-lc, 1 ] *  b;
    z   = [ 0, 0.1, 0.1+hc , 0.90-hc, 0.90, 1 ] * -h;
//---------------------------------------------------------------
    p00 = [0,3,23,20                                           ];
    p01 = [0,3,23,20                                           ];
    p02 = [4,1,2,7,19,22,21,16                                 ];
    p03 = [0,3,7,10,14,19,23,20,16,13,9,4                      ];
    p04 = [0,1,17,19,23,20                                     ];
    p05 = [0,3,7,10,14, 19,23, 20                              ];
    p06 = [0,3,7,10,9,13,14,       19,23,20                    ];
    p07 = [0,3,7,6,10,9,13,14,  18,19,23,20                    ];
    p08 = [4,1,3,7,6,10,9,13,14,18,19,23,   21,16              ];
    p09 = [0,3,7,6,10,18,19,23,20,16,17,5,4                    ];
    p10 = [0,3,23,20                                           ];
    p11 = [0,1,19,23,20                                        ];
    p12 = [0,1,5,19,23,20                                      ];
    p13 = [1,2,18,19,23,20,16,17                               ];
    p14 = [1,2,14,19,23,20,16,13                               ];
    p15 = [4,5,1,2,6,7,11,10,14,19,23,20,16,13,9,8             ];
    p16 = [4,5,1,2,6,7,11,10,14,15,19,18,22,21,17,16,12,13,9,8 ];
    p17 = [4,  1,2,  7,11,10,14,15,19,   22,21,   16,12,13,9,8 ];
    p18 = [1,2,14,15,19,                 22,21,   16,12,13     ];
    p19 = [0,2,7,19,22,20                                      ];
    p20 = [0,1,7,19,21,20                                      ];
    p21 = [0,3,7,6,10,11,15,14,18,19,23,20                     ];
    p22 = [0,3,7,6,10,11,15,14,18,19,23,20,16,17,13,12,8,9,5,4 ];
    p23 = [0,3,7,6,            18,19,23,20,16,17,          5,4 ];
//---------------------------------------------------------------
    ip  = [ p00,p01,p02,p03,p04,p05,p06,p07,p08,p09,
            p10,p11,p12,p13,p14,p15,p16,p17,p18,p19,
            p20,p21,p22,p23
          ];
    i   = ip[p%List.Count(ip)];
//---------------------------------------------------------------
    ps = List.Flatten( Point.ByCoordinates ( x , y, z<1>), 2);
    sv = PolyCurve.ByPoints  ( ps[i] , true );
    return = [ sv ];
};
# ----------------------------------------
altura = DoubleSlider(5, range=5..10 step 0.25)
parametro_altura = DoubleSlider(0.15, range=0.025..0.35 step 0.025)
largura = DoubleSlider(2.25, range=1..10 step 0.25)
parametro_largura = DoubleSlider(0.05, range=0.025..0.45 step 0.025)
perfil = DoubleSlider(11, range=0..30 step 1)
função_inicial = CodeBlock(a=altura, ac=parametro_altura, l=largura, lc=parametro_largura, p=perfil) { a; ac; l; lc; p; PE = Perfil (a ,ac, l, lc, p ); }
