# Dynamo graph Tendão.dyn (Dynamo 3.3.0.6316)

# group: Cria elemento cilíndrico con formato de catenária
# Autor: Prof. José Luis Menegotto.
# Escola Politécnica da UFRJ
# Disciplinas BIM, Descomp
funções = CodeBlock()
# ---------- funções.designscript (7 lines) ----------
// x número ou lista
// a maior que 0
def Catenaria( x , a )
{
  f = 1/a;
  return =  ( a * Math.Cosh(x/f))-a;
};
# ----------------------------------------
módulos = IntegerSlider(12, range=2..16 step 2)
dimensão_flecha = DoubleSlider(3.5, range=0.5..15 step 0.5)
fator_de_curvatura = DoubleSlider(0.27, range=0..0.5 step 0.01)
raio = DoubleSlider(0.59, range=0.1..1 step 0.01)
forma_cilíndrica = CodeBlock(q=módulos, d=dimensão_flecha, f=fator_de_curvatura, r=raio)
# ---------- forma_cilíndrica.designscript (23 lines) ----------
q;
d;
f;
r;
//--------------------------------------------
i = q/2;
m = (d-(d/q));
n = q-1;
x  = (-i..i..#q) * (m/n);
y  = Catenaria ( x , f );
//--------------------------------------------
LP = Point.ByCoordinates( x  , y    , 0 );
PO = PolyCurve.ByPoints ( LP , false    );
CV = PolyCurve.Curves   ( PO            );
P1 = CV.StartPoint;
P2 = CV.EndPoint;
Di = CV.Direction;
C1 = List.AddItemToEnd ( P2[-1] , P1 );
D1 = List.AddItemToEnd ( Di[-1] , Di );
GE = Circle.ByCenterPointRadiusNormal(C1,r,D1);
st = String.Replace    ( ""+r, "0", "" );
SO = Solid.ByLoft      ( GE            );
ID = "Cabo_"+q+"_"+Math.Floor(f)+"_"+st+"_";
# ----------------------------------------
faz_o_elemento = Python(IN[0]=forma_cilíndrica.SO, IN[1]=forma_cilíndrica.ID)  # CPython3
# ---------- faz_o_elemento.python (64 lines) ----------
import clr
import Revit
import Autodesk.Revit.DB as DB

clr.AddReference('System')
clr.AddReference("RevitAPI")
clr.AddReference("RevitServices")
clr.AddReference("RevitNodes")
from System                     import DateTime
from RevitServices.Persistence  import DocumentManager
from RevitServices.Transactions import TransactionManager

clr.ImportExtensions(Revit.GeometryConversion)

from System.Collections.Generic import List

doc = DocumentManager.Instance.CurrentDBDocument


geom  = IN[0] 
iden  = IN[1] 
now   = DateTime.Now
dat   = iden+now.ToString("dd/MM/yyyy_HH:mm:ss:fff")
ca    = DB.BuiltInCategory.OST_StructuralTendons
cat   = DB.Category.GetCategory(doc, ca)
catId = cat.Id


if isinstance(geom, list):
    geom_list = geom
else:
    geom_list = [geom]

rev_geom_list = []
for g in geom_list:
    try:
        rg = g.ToRevitType()
    except:
        rg = None
    if rg:
        if isinstance(rg, list):
            rev_geom_list.extend(rg)
        else:
            rev_geom_list.append(rg)

geo_list = List[DB.GeometryObject]()
for g in rev_geom_list:
    geo_list.Add(g)

TransactionManager.Instance.EnsureInTransaction(doc)
forma = DB.DirectShape.CreateElement(doc, catId)
forma.SetShape ( geo_list )

marca = forma.LookupParameter("Mark")
if marca and not marca.IsReadOnly:
    marca.Set(str(dat))
    
comme = forma.LookupParameter("Comments")
if comme and not comme.IsReadOnly:
    comme.Set(str(round(geom.Volume, 2)))

TransactionManager.Instance.TransactionTaskDone()

OUT = forma
# ----------------------------------------
