# Dynamo graph Tendão_Trazado.dyn (Dynamo 3.3.0.6316)

# group: Cria elemento cilíndrico para cordoalhas em vigas
# Autor: Prof. José Luis Menegotto.
# Escola Politécnica da UFRJ
# Disciplinas BIM, Descomp
marca_a_cordoalha = CodeBlock()
# ---------- marca_a_cordoalha.designscript (16 lines) ----------
def Cabo (l,h,b,fa,fc,j)
{
    m  = 10;
    n  = m*2;
    o  = l/2;
    d  = b;
    x1 = l/m;
    x2 = l/n;
    x3 = l-x1;
    x4 = l-x2;
    x  =  0..l..#(l*m);
    xc = -o..o..#(l*m);
    z  = Altura( xc,x1,fa,fc,j);
    p  = Desvio( x,z,x1,x2,x3,x4,d);
    return = p;
};
# ----------------------------------------
luz_do_vão = DoubleSlider(16, range=5..50 step 0.25)
baixar_cordoalha = DoubleSlider(-1.4, range=-1.5..0 step 0.025)
deslocamento_do_centro = DoubleSlider(0, range=0..0.05 step 0.01)
fator_de_altura = DoubleSlider(0.5, range=0.4..0.5 step 0.01)
fator_de_curvatura = DoubleSlider(0.005, range=0..0.005 step 0.00125)
raio = DoubleSlider(0.008, range=0.005..0.03 step 0.001)
modelar = BoolSelector(false)
forma_cilíndrica = CodeBlock(l=luz_do_vão, j=baixar_cordoalha, d=deslocamento_do_centro, fa=fator_de_altura, fc=fator_de_curvatura, r=raio, OK=modelar)
# ---------- forma_cilíndrica.designscript (24 lines) ----------
l;
h = Arredonda (l/25 , 0.05);
b = Arredonda (h/ 4 , 0.05);
j;
d;
fa;
fc;
r;
OK;
//--------------------------------------------
VI  = Viga ( l , h , b              );
LP  = Cabo ( l , h , d , fa , fc , j);
//--------------------------------------------
PO = PolyCurve.ByPoints ( LP , false );
CV = PolyCurve.Curves   ( PO         );
P1 = CV.StartPoint;
P2 = CV.EndPoint;
Di = CV.Direction;
C1 = List.AddItemToEnd ( P2[-1] , P1 );
D1 = List.AddItemToEnd ( Di[-1] , Di );
GE = Circle.ByCenterPointRadiusNormal(C1,r,D1);
SO = Solid.ByLoft      ( GE            );
ID = "Tensor-"+l+"-"+fa+"-"+fc+"-"+d;
OK;
# ----------------------------------------
faz_o_elemento = Python(IN[0]=forma_cilíndrica.out19, IN[1]=forma_cilíndrica.out20, IN[2]=forma_cilíndrica.out21)  # CPython3
# ---------- faz_o_elemento.python (66 lines) ----------
import clr
import Revit
import Autodesk.Revit.DB as DB

clr.AddReference('System')
clr.AddReference("RevitAPI")
clr.AddReference("RevitServices")
clr.AddReference("RevitNodes")
from System                     import DateTime
from RevitServices.Persistence  import DocumentManager
from RevitServices.Transactions import TransactionManager

clr.ImportExtensions(Revit.GeometryConversion)

from System.Collections.Generic import List

doc = DocumentManager.Instance.CurrentDBDocument

geom  = IN[0] 
iden  = IN[1] 
dese  = IN[2]

now   = DateTime.Now
dat   = now.ToString("dd/MM/yyyy_HH:mm:ss:fff")
ca    = DB.BuiltInCategory.OST_StructuralTendons
cat   = DB.Category.GetCategory(doc, ca)
catId = cat.Id

if isinstance(geom, list):
    geom_list = geom
else:
    geom_list = [geom]

rev_geom_list = []
for g in geom_list:
    try:
        rg = g.ToRevitType()
    except:
        rg = None
    if rg:
        if isinstance(rg, list):
            rev_geom_list.extend(rg)
        else:
            rev_geom_list.append(rg)

geo_list = List[DB.GeometryObject]()
for g in rev_geom_list:
    geo_list.Add(g)

if dese == True:
    TransactionManager.Instance.EnsureInTransaction(doc)
    forma = DB.DirectShape.CreateElement(doc, catId)
    forma.SetShape(geo_list)
    marca = forma.LookupParameter("Mark")
    idmar = iden.replace("0", "").replace(".", "")

    if marca and not marca.IsReadOnly:
        marca.Set(str( idmar+"_"+dat ))
    comme = forma.LookupParameter("Comments")
    if comme and not comme.IsReadOnly:
        comme.Set("Volume:" + str( round(geom.Volume, 2)))
    TransactionManager.Instance.TransactionTaskDone()
else:
    forma = ""

OUT = forma
# ----------------------------------------
marca_a_viga = CodeBlock()
# ---------- marca_a_viga.designscript (13 lines) ----------
def Viga ( l , h , b )
{
    e      = 0;
    x1     = [0,l,l,0];
    y1     = [e,e,e,e];
    y2     = [e,e,e,e]*-1;
    z1     = [0,0,h,h]*-1;
    p1     = Point.ByCoordinates(x1,y1,z1);
    p2     = Point.ByCoordinates(x1,y2,z1);
    v1     = PolyCurve.ByPoints (p1, true);
    v2     = PolyCurve.ByPoints (p2, true);
    return = v1;
};
# ----------------------------------------
calcula_deslocamento_em_planta = CodeBlock()
# ---------- calcula_deslocamento_em_planta.designscript (7 lines) ----------
def Desvio(x,z,x1,x2,x3,x4,d )
{
  y = (x>=0  && x<=x1)?  0:
      (x> x1 && x< x2)? -d:
      (x> x2 && x< x3)? -d:0;
  return = Point.ByCoordinates(x,y,z);
};
# ----------------------------------------
altura_dos_pontos = CodeBlock()
# ---------- altura_dos_pontos.designscript (6 lines) ----------
def Altura( x, h, fa, fc, j)
{
    de = ( (fa/x) / fc );
    z  = Math.Cosh( x / de );
    return = z+(h*j);
};
# ----------------------------------------
marca_a_cordoalha_2 = CodeBlock()
# ---------- marca_a_cordoalha_2.designscript (4 lines) ----------
def Arredonda ( v , p )
{
  return = Math.Round(v/p)*p;
};
# ----------------------------------------
