# Dynamo graph Viga_Tendão.dyn (Dynamo 3.3.0.6316)

# group: Cria viga com cordoalhas
# Autor: Prof. José Luis Menegotto.
# Escola Politécnica da UFRJ
# Disciplinas BIM, Descomp - Trazado de viga com cabos de protensão - Predimensionamento estimado sem cálculo.
marca_círculo_inicial_das = CodeBlock()  # "Marca círculo inicial das bainhas"
# ---------- marca_círculo_inicial_das.designscript (6 lines) ----------
def Ancora ( p , r )
{
    v = Vector.XAxis();
    c = Circle.ByCenterPointRadiusNormal(p,r,v);
    return = c;
};
# ----------------------------------------
marca_a_seção_da_viga_e_o = CodeBlock()  # "Marca a seção da viga e o comprimento"
# ---------- marca_a_seção_da_viga_e_o.designscript (16 lines) ----------
def Viga (l,h,b)
{
    x  = [0,l];
    i  = [0,3,7,10,14,19,23,20,16,13,9,4];
    y  = [0,0.3,0.70,1                  ]* b;
    z  = [0,0.1,0.15,0.70,0.8,1         ]*-h;
    //bv = y * b;
    //hz = y * z;
    ps = Point.ByCoordinates      ( 0 , y, z<1>);
    pf = List.Flatten             ( ps,2);
    sv = PolyCurve.ByPoints       ( pf[i] , true );
    pe = Point.ByCoordinates      ( x , 0, 0     );
    ej = Line.ByStartPointEndPoint( pe[0] , pe[1]);
    vi = Solid.BySweep            ( sv , ej      );
    return = vi;
};
# ----------------------------------------
arredondamentos = CodeBlock()
# ---------- arredondamentos.designscript (4 lines) ----------
def Arredonda ( v , p )
{
    return = Math.Round(v/p)*p;
};
# ----------------------------------------
marca_4_cabos = CodeBlock()
# ---------- marca_4_cabos.designscript (28 lines) ----------
def Cabo (l,h,b,c,r)
{
    ce  = 0.50;
    fd  = 0.20;
    fe  = 1-fd;
    co  = c * 0.001;
    m1  = -h+r+co+0.05;
    m2  = -h+r+co+0.03;
    m3  = -h+r+co+0.01;
    m4  = -h+r+co;
    vx  = Vector.XAxis();
    xo  =  0..l..#(l*10);
    z   = [0.125 , 0.375 , 0.625 ,0.875 ]* -h;
    cx  =  l/2;
    cy1 = [ce, ce, ce, ce]* b;
    cy2 = [ce, ce, fe, fd]* b;
    cz  = [m1, m2, m4, m4];
    p1  = Point.ByCoordinates   ( 0  , cy1  , z  );
    p2  = Point.ByCoordinates   ( l  , cy1  , z  );
    ci  = Ancora                ( p1 , r         );
    pm  = Point.ByCoordinates   ( cx , cy2  , cz );
    ar  = Arc.ByThreePoints     ( p1 , pm   , p2 );
    da  = Arc.PointsAtEqualSegmentLength( ar ,100);
    pa  = Arc.ParameterAtPoint  ( ar , da        );
    no  = Arc.NormalAtParameter ( ar , pa        );
    so  = Solid.BySweep         ( ci , ar, true  );
    return = so;
};
# ----------------------------------------
luz_do_vão_m = DoubleSlider(33.5, range=5..50 step 0.25)
cobrimento_cm = DoubleSlider(2.5, range=2.5..20 step 0.5)
fator_predimensionamento = DoubleSlider(25, range=25..30 step 5)
modelar = BoolSelector(false)
função_inicial = CodeBlock(l=luz_do_vão_m, c=cobrimento_cm, f=fator_predimensionamento, OK=modelar)
# ---------- função_inicial.designscript (14 lines) ----------
l;
c;
f;
OK;
h  = Arredonda (l /  f , 0.050);
b  = Arredonda (h /  4 , 0.050);
r  = Arredonda (h /100 , 0.001);
//----------------------------------------
VI = Viga ( l , h , b         );
CA = Cabo ( l , h , b , c , r );
NU = List.IndexOf ( CA , CA )+1;
ID = "Tensor-"+NU+"-"+l+"-"+h+"-"+b+"-"+r;
VO = CA.Volume;
OK;
# ----------------------------------------
coloca_os_4_cabos = Python(IN[0]=função_inicial.out8, IN[1]=função_inicial.out10, IN[2]=função_inicial.out11, IN[3]=função_inicial.out12)  # CPython3
# ---------- coloca_os_4_cabos.python (79 lines) ----------
import clr
import Revit
import Autodesk.Revit.DB as DB

clr.AddReference('System')
clr.AddReference("RevitAPI")
clr.AddReference("RevitServices")
clr.AddReference("RevitNodes")
from System                     import DateTime
from RevitServices.Persistence  import DocumentManager
from RevitServices.Transactions import TransactionManager

clr.ImportExtensions(Revit.GeometryConversion)
from System.Collections.Generic import List
doc = DocumentManager.Instance.CurrentDBDocument

geom  = IN[0] 
iden  = IN[1] 
volu  = IN[2]
dese  = IN[3]

now   = DateTime.Now
dat   = now.ToString("dd/MM/yyyy_HH:mm:ss:fff")
ca    = DB.BuiltInCategory.OST_StructuralTendons
cat   = DB.Category.GetCategory(doc, ca)
catId = cat.Id

if isinstance(geom, list):
    geom_list = geom
else:
    geom_list = [geom]

rev_geom_list = []
for g in geom_list:
    try:
        rg = g.ToRevitType()
    except:
        rg = None
    if rg:
        if isinstance(rg, list):
            rev_geom_list.extend(rg)
        else:
            rev_geom_list.append(rg)

geo_list = List[DB.GeometryObject]()
for g in rev_geom_list:
    geo_list.Add(g)

if dese == True:
    TransactionManager.Instance.EnsureInTransaction(doc)
    formas = []

    for i , g in enumerate(rev_geom_list):
        geo_list = List[DB.GeometryObject]()
        geo_list.Add(g)

        forma = DB.DirectShape.CreateElement(doc, catId)
        forma.SetShape(geo_list)

        # Preenche Mark
        marca = forma.LookupParameter("Mark")
        if marca and not marca.IsReadOnly:
            # usa o elemento correspondente da lista iden
            idmar = str(iden[i]).replace("00","")
            marca.Set(idmar + "_" + dat)

        # Preenche Comments
        comme = forma.LookupParameter("Comments")
        if comme and not comme.IsReadOnly:
            votx = str(round(volu[i], 6))
            comme.Set("Volume: " + votx)

        formas.append(forma)

    TransactionManager.Instance.TransactionTaskDone()
else:
    formas = []

OUT = formas
# ----------------------------------------
