# Dynamo graph Relogio.dyn (Dynamo 2.17.1.4055)

# group: Definição de um Relógio. Rodar em modo de Execução Periódico
# Disciplina: BIM I Modelo Digital da Edificação - Escola Politécnica da UFRJ
# Desenvolvimento: Prof: José Luis Menegotto
# Tema: Execução Periódica em Dynamo.
zero = TimeSpan.Zero()
now = DateTime.Now()
timeOfDay = DateTime.TimeOfDay(dateTime=now)
add = TimeSpan.Add(timeSpan1=zero, timeSpan2=timeOfDay)
raio_do_relógio = DoubleSlider(2.5, range=1..10 step 0.5)
relogio = CodeBlock(tempo=add, ra=raio_do_relógio)
# ---------- relogio.designscript (32 lines) ----------
tempo;
ra;
mh    = 30;
ms    =  6;
angHO = 0..360..mh;
angMS = 0..360..ms;

p0 = Point.ByCoordinates(0,0,0);
cs = CoordinateSystem.ByOrigin(p0);
//Converte em string o Tempo Atual e separa Hora, Min e Seg ------
hora = String.Substring( tempo+"" , 0 , 2);
minu = String.Substring( tempo+"" , 3 , 2);
segu = String.Substring( tempo+"" , 6 , 2);

//Angulo do Tempo Atual de Hora, minuto e segundo ----------------
hoa  = String.ToNumber(hora) %12 * -mh+90;
mia  = String.ToNumber(minu)     * -ms+90;
sea  = String.ToNumber(segu)     * -ms+90;

//Marcas de Horas e minutos --------------------------------------
marh1 = Point.ByCylindricalCoordinates( cs, angHO , 0 , ra*1.6);
marh2 = Point.ByCylindricalCoordinates( cs, angHO , 0 , ra*1.9);
marm1 = Point.ByCylindricalCoordinates( cs, angMS , 0 , ra*1.8);
marm2 = Point.ByCylindricalCoordinates( cs, angMS , 0 , ra*1.9);
//Ponteiros de Horas Minutos e Segundos --------------------------
ph    = Point.ByCylindricalCoordinates( cs, hoa   , 0 , ra*1.1);
pm    = Point.ByCylindricalCoordinates( cs, mia   , 0 , ra*1.4);
ps    = Point.ByCylindricalCoordinates( cs, sea   , 0 , ra*1.5);

LmaH = Line.ByStartPointEndPoint      ( marh1 , marh2 );
LmaM = Line.ByStartPointEndPoint      ( marm1 , marm2 );
Lpon = Line.ByStartPointEndPoint      ( p0 , [ph, pm, ps] );
# ----------------------------------------
