# Dynamo graph Crono_Obra.dyn (Dynamo 2.17.1.4055)

# group: Estimativa temporal de construção com distribuição lineal de tempos.
# Disciplina:              BIM I Modelagem Digital da Edificação
# Desenvolvido por: Prof. José Luis Menegotto
# Departamento de Expressão Gráfica / Escola Politécnica da UFRJ
categories = Categories("OST_Parts")
all_elements_of_category = ElementsOfCategory(Category=categories)
tempo_total_de_obra_em_dias = DoubleSlider(240, range=1..2000 step 1)
cronometro_de_tarefas = CodeBlock(ELE=all_elements_of_category, TTO=tempo_total_de_obra_em_dias)
# ---------- cronometro_de_tarefas.designscript (68 lines) ----------
ELE;
TTO;
Itens   = List.Count(ELE);
drive   = "C:\\";
pasta   = "JLMenegotto\\Academia\\";
arqui   = "Modelo_04_4D_Crono.xlsx";
arquivo = drive + pasta + arqui;
tabela  = "Partes_Crono";
//---------------------------------------------------------------------------
// Define os tempos e Formata o modo de escrita
//---------------------------------------------------------------------------
CronoTotal    = DSCore.TimeSpan.Create      ( TTO , 0, 0, 0, 0   );
CronoItem     = DSCore.TimeSpan.Create      ( DPI , 0, 0, 0, 0   );
CronoAndae    = DSCore.TimeSpan.Create      ( TPA , 0, 0, 0, 0   );
d_Iobra       = DSCore.DateTime.Today;
d_Fobra       = DSCore.DateTime.AddTimeSpan ( d_Iobra , CronoTotal  );
d_Iobra_txt   = DSCore.DateTime.Format      ( d_Iobra , "dd/MM/yyyy");

DPI           = TTO / Itens;
TPA           = TTO / QAndares;
L_Niveis      = List.UniqueItems ( List.IndexOf ( COTA , COTA ));
QAndares      = List.Count(L_Niveis);
qniv          = 1..QAndares-2;
L_EleNiv      = L_Niveis[qniv+1] - L_Niveis[qniv];
Qniveis       = List.UniqueItems( List.IndexOf ( COTA , COTA ))+1;
DTCota        = Math.Floor      ( List.IndexOf ( COTA , COTA )/100);

DeltaT        = TPA * INXA;

ItarefaI      = DTCota;
ItarefaF      = DTCota +2;
NumerTI       = ItarefaI + DeltaT;
NumerTF       = ItarefaF + DeltaT;

CronoTI       = DSCore.TimeSpan.Create      ( NumerTI , 0, 0, 0, 0 );
CronoTF       = DSCore.TimeSpan.Create      ( NumerTF , 0, 0, 0, 0 );
DataTI        = DSCore.DateTime.AddTimeSpan ( d_Iobra , CronoTI    );
DataTF        = DSCore.DateTime.AddTimeSpan ( d_Iobra , CronoTF    );

TARE          = List.OfRepeatedItem ( "Construct" , Itens);

Cotas         = List.UniqueItems    ( List.Sort ( COTA ));
QNIV          = List.Count(Cotas);
//---------------------------------------------------------------------------
// Condicionais de filtragem
//---------------------------------------------------------------------------
Vig    = String.Contains ( TIPO , "V" , true )==1 ? true : false;
Laj    = String.Contains ( TIPO , "L" , true )==1 ? true : false;
Pil    = String.Contains ( TIPO , "P" , true )==1 ? true : false;

ELID  = ELE.Id;
INXA  = List.IndexOf ( Cotas , COTA )+1;
INXB  = Vig? 1 : Laj ? 2 : 3;
DURI  = DPI;
CATE  = FamilyInstance.GetParameterValueByName (ELE  , "Original Category");
TIPO  = FamilyInstance.GetParameterValueByName (ELE  , "Original Type"    );
LEVL  = FamilyInstance.GetParameterValueByName (ELE  , "Base Level"       );
ANDA  = Level.GetParameterValueByName          (LEVL , "Name"             );
COTA  = Level.GetParameterValueByName          (LEVL , "Elevation"        );

kob = ["INXA","INXB","CATE","TIPO","ANDA","ELID","TARE","DataTI","DataTF"];
vob = [ INXA , INXB , CATE , TIPO , ANDA , ELID , TARE , DataTI , DataTF ];

//---------------------------------------------------------------------------
//Escreve os dados em Planilha Excel
//---------------------------------------------------------------------------
DSOffice.Data.ExportExcel( arquivo , tabela, 0, 0, [kob]          , false);
DSOffice.Data.ExportExcel( arquivo , tabela, 1, 0, Transpose(vob) , false);
# ----------------------------------------
watch = Watch(cronometro_de_tarefas.Qniveis)
watch_2 = Watch(cronometro_de_tarefas.DTCota)
