# Dynamo graph Hiperboloide_Midi.dyn (Dynamo 2.17.1.4055)

revit_uia = Python()  # CPython3
# ---------- revit_uia.python (20 lines) ----------
import clr
import Revit

clr.AddReference("ProtoGeometry")
clr.AddReference("RevitAPI")
clr.AddReference("RevitAPIUI")
clr.AddReference("RevitServices")
clr.AddReference("RevitNodes")

from Autodesk.DesignScript.Geometry import *
from Autodesk.Revit.DB import *
from RevitServices.Persistence import DocumentManager


#dad = IN[0]

doc = DocumentManager.Instance.CurrentDBDocument
uia = DocumentManager.Instance.CurrentUIApplication

OUT = uia
# ----------------------------------------
code_block = CodeBlock { 0; }
MIDI_Ativar = Musica_2020.Musica_2020.MIDI_Ativar(n=code_block)
zero = TimeSpan.Zero()
now = DateTime.Now()
timeOfDay = DateTime.TimeOfDay(dateTime=now)
add = TimeSpan.Add(timeSpan1=zero, timeSpan2=timeOfDay)
densidade = IntegerSlider(20, range=15..30 step 5)
constroi_hiperbolóide = CodeBlock(tempo=add, div=densidade)
# ---------- constroi_hiperbolóide.designscript (41 lines) ----------
tempo;
div;
//---------------------------------------------------
// Converte em string o Tempo Atual e separa miliseg.
//---------------------------------------------------
max =  25;
apo =   5;
fal =  15;
r1  = 1+(si1%3);
r2  = r1 * 0.95;
mx  = max/2;
txt = "Autodesk.DesignScript.Geometry.Point";
frz = Math.Random(max) * 10;
vz  = Vector.ZAxis();
seg = String.Substring ( tempo+"" , 6 , 2);
mil = String.Substring ( tempo+"" , 9 , 5);
si1 = String.ToNumber  ( seg ) % 60;
si2 = String.ToNumber  ( mil ) % 60;
//---------------------------------------------------------------------
ang  = 160 - (10 * (1+(si1%5)));

a   = 0..360..10;
b   = a<1> + [ang , -ang];
q   = List.Count( a )-1;
alt = r1 * 2.5;
xa  = [ r1 , r2 ]<1> * Math.Cos ( a );
ya  = [ r1 , r2 ]<1> * Math.Sin ( a );
xb  = [ r1 , r2 ]<1> * Math.Cos ( b );
yb  = [ r1 , r2 ]<1> * Math.Sin ( b );
pa  = Point.ByCoordinates ( xa , ya , alt );
pb  = Point.ByCoordinates ( xb , yb ,  0  );
lin = Transpose(Line.ByStartPointEndPoint( pb , pa));

l1  = List.Flatten( lin , 2);
pin = Geometry.Intersect ( l1<1> , l1 );
pi1 = List.Flatten ( pin , 2 );
pi2 = DSCore.Object.Type(pi1)+"" == txt ? pi1 : null;

pon = List.Clean( pi2 , false);
cox = (pon.X + pon.Y)/2;
coz = pon.Z;
# ----------------------------------------
tocar = CodeBlock(app=revit_uia, midi=MIDI_Ativar, max=constroi_hiperbolóide.max, si1=constroi_hiperbolóide.si1, si2=constroi_hiperbolóide.si2, pto=constroi_hiperbolóide.pon, cox=constroi_hiperbolóide.cox, coy=constroi_hiperbolóide.coz)
# ---------- tocar.designscript (51 lines) ----------
app;
midi;
max;
si1;
si2;
pto;
cox;
coy;
//-------------------------------------------------------------------------
// Listas iniciais de escalas e duração
//-------------------------------------------------------------------------
bra   = 10;
es1   = 6..8..#25;
es2   = -12 + es1;
es3   = Reverse(es2);
rit   = 1.0..1.0..#2;
dur   = rit * bra;
//-------------------------------------------------------------------------
// Se aumentar dur, aumentar o período para completar ciclo
//-------------------------------------------------------------------------
m  = Count ( es1 )-1;
n  = Count ( es2 )-1;
o  = Count ( es3 )-1;
r  = Count ( rit )-1;
i  = List.IndexOf(cox , cox)%m;
j  = List.IndexOf(coy , coy)%n;
k  = List.IndexOf(coy , coy)%o;
l  = List.IndexOf(cox , cox)%r;
f1 = f2+12;
f2 = 40 + (si1%6);
f3 = f2-12;
s1 = es1[i];
s2 = es1[j] + si2%4;
s3 = es1[k] + si2%4;
d1 = dur[l];
v1 = 101;
v2 = 101;
v3 =  si1%2==0 ? 103 : 103;
fd =  1;
i1 = 120..80..#qp;
i2 = 120..80..#qp;
i3 = 120..80..#qp;
//-------------------------------------------------------------------------
qp = List.Count( s1 );
gi = 0..360..#qp;
az = si1%2==0 ? gi : -gi;
al = si1%2==0 ? 0..0..#qp : 0..0..#qp;
//-------------------------------------------------------------------------
// Tocar
//-------------------------------------------------------------------------
Musica_2020.Tocar_Vozes3 (app,midi,az,al,1,v1,v2,v3,f1,f2,f3,s1,s2,s3,d1,1);
# ----------------------------------------
watch = Watch(tocar.si2)
watch_2 = Watch(tocar.pto)
watch_3 = Watch(tocar.f1)
watch_4 = Watch(constroi_hiperbolóide.l1)
