# Dynamo graph Mandala_Midi.dyn (Dynamo 2.17.0.3472)

mandala_midi = CodeBlock()  # unwired: midi, toca, inst
# ---------- mandala_midi.designscript (13 lines) ----------
midi;
toca;
inst;
a   = 0..360..6;
r1  = 20;
r2  = r1/4;
x   = r1<1> * Math.Cos ( a );
y   = r2<1> * Math.Sin ( a );
//P   = Point.ByCoordinates( x , y , 0);
not = Math.Abs(Math.Floor( x ))+ 64;
dur = not/not * not%3 ? 55 : not%5 ? 65 : 45;
din = not/not * not%2 ? 127 : 120;
Musica_2020.Tocar_Nota( midi, not, dur, din, 1, inst, toca);
# ----------------------------------------
zero = TimeSpan.Zero()
now = DateTime.Now()
timeOfDay = DateTime.TimeOfDay(dateTime=now)
add = TimeSpan.Add(timeSpan1=zero, timeSpan2=timeOfDay)
revit_uia = Python(IN[0]=add)  # CPython3
# ---------- revit_uia.python (20 lines) ----------
import clr
import Revit

clr.AddReference("ProtoGeometry")
clr.AddReference("RevitAPI")
clr.AddReference("RevitAPIUI")
clr.AddReference("RevitServices")
clr.AddReference("RevitNodes")

from Autodesk.DesignScript.Geometry import *
from Autodesk.Revit.DB import *
from RevitServices.Persistence import DocumentManager


dad = IN[0]

doc = DocumentManager.Instance.CurrentDBDocument
uia = DocumentManager.Instance.CurrentUIApplication

OUT = uia
# ----------------------------------------
code_block = CodeBlock { 2; }
MIDI_MIDI = Musica_2020.Musica_2020.MIDI_MIDI(n=code_block)
toca_0_ou_1 = IntegerSlider(1, range=0..1 step 1)
instrumentos_1_a_128 = IntegerSlider(1, range=1..128 step 1)
code_block_2 = CodeBlock(rvuia=revit_uia, tempo=add, midi=MIDI_MIDI, toca=toca_0_ou_1, inst=instrumentos_1_a_128)
# ---------- code_block_2.designscript (24 lines) ----------
rvuia;
tempo;
midi;
toca;
inst;
//---------------------------------------------------------
// Converte em string o Tempo Atual e separa segs e mils
//---------------------------------------------------------
segu = String.Substring ( tempo+"" , 6 , 2);
mili = String.Substring ( tempo+"" , 9 , 3);

segs = 0..String.ToNumber(segu)/2;
mils = 0..String.ToNumber(mili);
a    = 0..#50..(60 + mils[-1]);
x    = mils * Math.Cos ( a );
y    = mils * Math.Sin ( a );
Pt   = Point.ByCoordinates( x , y , 0);
not  = Math.Abs(Math.Floor( x )) + 35;
dur  = not/not * not%3 ? 155 : not%2 ? 310 : 75;
din  = not/not * not%5 ? 127 : 90;
//---------------------------------------------------------
// Tocar --------------------------------------------------
//---------------------------------------------------------
Musica_2020.Tocar_NotaRVT( rvuia, midi, not, dur, din, 1, inst, toca, x, y, 0);
# ----------------------------------------
watch = Watch(code_block_2.rvuia)
watch_2 = Watch(code_block_2.mils)
instrumentos_1_a_128_2 = IntegerSlider(1, range=1..128 step 1)
toca_0_ou_1_2 = IntegerSlider(1, range=0..1 step 1)
watch_3 = Watch(code_block_2.a)
watch_4 = Watch(code_block_2.mili)
