# Dynamo graph Mandala_Musical.dyn (Dynamo 2.17.1.4055)

# group: Definição de uma Mandala Sonora. Rodar em modo de Execução Periódico
# Disciplina: BIM I Modelo Digital da Edificação - Escola Politécnica da UFRJ
# Desenvolvimento: Prof: José Luis Menegotto
# Tema: Execução Periódica em Dynamo com interface MIDI de NAUDIO
zero = TimeSpan.Zero()
now = DateTime.Now()
timeOfDay = DateTime.TimeOfDay(dateTime=now)
add = TimeSpan.Add(timeSpan1=zero, timeSpan2=timeOfDay)
code_block = CodeBlock { 0; }
midiOut = NAudio.Midi.MidiOut.MidiOut(deviceNo=code_block)
folhas = DoubleSlider(15, range=15..180 step 15)
mandala_sonora = CodeBlock(tempo=add, mio=midiOut, fol=folhas)
# ---------- mandala_sonora.designscript (26 lines) ----------
tempo;
mio;
fol;
//Converte em string o Tempo Atual e separa os segundos ------
segu   = String.Substring( tempo+"" , 6 , 2);
segs   = 0..String.ToNumber(segu);
a      = 0..#fol..segs;
x      = segs * Math.Cos( a );
y      = segs * Math.Sin( a );
Pt     = Point.ByCoordinates( x , y , 0);
//Fundamental -----------------------
f0     = segs% 5==0? 60: 48;
//Saltos ----------------------------
s1     = segs%  5==0? 0:  5;
s2     = segs%  2==0? 0:  9;
//Instrumento -----------------------
i1     = segs% 2==0?  11 : segs% 3==0? 116 : 69;
instr  = MidiMessage.RawData(MidiMessage.ChangePatch ( i1 , 1));
MidiOut.Send ( mio , instr);
//Nota ------------------------------
nota   = f0;
//Tocar -----------------------------
toca1  = MidiMessage.RawData(MidiMessage.StartNote ( nota + s2 , 30+segs , 1));
toca2  = MidiMessage.RawData(MidiMessage.StartNote ( nota + s1 , 15+segs , 1));
toca3  = MidiMessage.RawData(MidiMessage.StartNote ( nota + s2 ,  5+segs , 1));
MidiOut.Send ( mio , segs% 2==0? toca1 : segs% 3==0? toca2 : toca3);
# ----------------------------------------
