# Dynamo graph Paraboloide_Midi.dyn (Dynamo 2.17.1.4055)

zero = TimeSpan.Zero()
now = DateTime.Now()
timeOfDay = DateTime.TimeOfDay(dateTime=now)
add = TimeSpan.Add(timeSpan1=zero, timeSpan2=timeOfDay)
constroi_a_matriz_plana = CodeBlock(tempo=add)
# ---------- constroi_a_matriz_plana.designscript (21 lines) ----------
tempo;
//---------------------------------------------------
// Converte em string o Tempo Atual e separa miliseg.
//---------------------------------------------------
max  = 15;
mx   = max/2;
mili = String.Substring ( tempo+"" , 9 , 4);
s    = (String.ToNumber ( mili ) % max )+ 1;
x    = (-mx..mx)* s * Math.Random(s/5);
y    = (-mx..mx)* s * Math.Random(s/5);
pt   = Point.ByCoordinates ( x<1>  ,  y );
ptt   = Point.ByCoordinates(  x ,  y<1> );
z1   = ((0..max) * s/3)+1;
z2   = ((max..0) * s/6)+1;
p1   = pt[ 0].Translate ( 0 , 0 , z1);
p2   = pt[-1].Translate ( 0 , 0 , z2);
vz   = Vector.ZAxis();
gx1  = Line.ByStartPointDirectionLength (pt[0]  , vz, z1);
gx2  = Line.ByStartPointDirectionLength (pt[-1] , vz, z2);
gy1  = Line.ByStartPointDirectionLength (ptt[0] , vz, List.Reverse(z2));
gy2  = Line.ByStartPointDirectionLength (ptt[-1], vz, List.Reverse(z1));
# ----------------------------------------
code_block = CodeBlock { 0; }
MIDI_Ativar = Musica_2020.Musica_2020.MIDI_Ativar(n=code_block)
revit_uia = Python()  # CPython3
# ---------- revit_uia.python (20 lines) ----------
import clr
import Revit

clr.AddReference("ProtoGeometry")
clr.AddReference("RevitAPI")
clr.AddReference("RevitAPIUI")
clr.AddReference("RevitServices")
clr.AddReference("RevitNodes")

from Autodesk.DesignScript.Geometry import *
from Autodesk.Revit.DB import *
from RevitServices.Persistence import DocumentManager


#dad = IN[0]

doc = DocumentManager.Instance.CurrentDBDocument
uia = DocumentManager.Instance.CurrentUIApplication

OUT = uia
# ----------------------------------------
tocar = CodeBlock(max=constroi_a_matriz_plana.max, s=constroi_a_matriz_plana.s, p1=constroi_a_matriz_plana.p1, p2=constroi_a_matriz_plana.p2, midi=MIDI_Ativar, app=revit_uia)
# ---------- tocar.designscript (57 lines) ----------
max;
s;
p1;
p2;
midi;
app;
gx    = Line.ByStartPointEndPoint ( p1     ,   p2         );
gy    = Line.ByStartPointEndPoint ( px[0]  , px[-1]       );
px    = Line.PointAtParameter     ( gx<1>  , 0..1..#max+1 );
py    = Line.PointAtParameter     ( gy<1>  , 0..1..#max+1 );
co1   = List.Flatten ( Math.Floor ( px.Z ) ,   1          );
co2   = List.Flatten ( Math.Floor ( py.Z ) ,   1          );
//-------------------------------------------------------------------------
// Listas iniciais de escalas e duração
//-------------------------------------------------------------------------
andam = 9950;
bra   = andam / Math.Pow( max+1 , 1.77 );
es1   = [ 0,2,3,5,-9,5 ,3,2,-3,0];
es2   = [ 0,3,2,5, 5,5,-3,2, 3,0];
rit   = [ 2.0 , 1.5];
mo1   = es1 + s%1;
mo2   = es2 + s%1;
//mo2   = List.Reverse( mo1 );
mo3   = List.ShiftIndices( mo1 , s%4 );
mo4   = List.ShiftIndices( mo2 , s%4 );
dur   = rit * bra;
//-------------------------------------------------------------------------
// Se aumentar dur, aumentar o período para completar ciclo
//-------------------------------------------------------------------------
m     = Count ( es1 )-1;
r     = Count ( rit )-1;
i     = co1 % m;
j     = co2 % m;
k     = co1 % r;
f1    = 60 + s%4;
f2    = f1-24;
f3    = f1-24;
f4    = f1-24;
s1    = List.ShiftIndices( mo1 , s%4 )[i];
s2    = List.ShiftIndices( mo2 , s%4 )[j];
s3    = List.ShiftIndices( mo3 , s%4 )[i];
s4    = List.ShiftIndices( mo4 , s%4 )[j];
du    = List.ShiftIndices( dur , s%4 )[k];
v1    =   9;
v2    =  33;
v3    =  33;
v4    =  33;
fd    =   1;
//-------------------------------------------------------------------------
qp    = List.Count( s1 );
az    = 0..135..#qp;
al    = 0.. 0..#qp;
ttd   = Math.Sum(du);
//-------------------------------------------------------------------------
// Tocar
//-------------------------------------------------------------------------
Musica_2020.Tocar_4Vozes(app,midi,f1,f2,f3,f4,s1,s2,s3,s4,du,v1,v2,v3,v4,fd,2,az,al,1);
# ----------------------------------------
watch = Watch(tocar.py)
watch_2 = Watch(tocar.dur)
watch_3 = Watch(tocar.ttd)
