# Dynamo graph PPE_Room_Pisos_e_Laje_ComRebaixos.dyn (Dynamo 2.3.0.5885)

categories = Categories("OST_Rooms")
all_elements_of_category = ElementsOfCategory(Category=categories)
categories_2 = Categories("OST_Walls")
all_elements_of_category_2 = ElementsOfCategory(Category=categories_2)
viga_básica_de_anteprojeto = StructuralFramingTypes("Basica")
categories_3 = Categories("OST_Levels")
all_elements_of_category_3 = ElementsOfCategory(Category=categories_3)
tipo_de_pisos_internos_de = FloorTypes("Piso_Basico")  # "Tipo de Pisos Internos de Anteprojeto"
tipo_de_pisos_rebaixados = FloorTypes("Piso_Rebaixo")
tipo_de_laje_estrutural_de = FloorTypes("Laje_Estrutural_10cm")  # "Tipo de Laje Estrutural de Anteprojeto"
coloca_pisos_e_lajes_nos = CodeBlock(Amb=all_elements_of_category, EPA=all_elements_of_category_2, Tvi=viga_básica_de_anteprojeto, Lev=all_elements_of_category_3, Tpn=tipo_de_pisos_internos_de, Tpr=tipo_de_pisos_rebaixados, Til=tipo_de_laje_estrutural_de)  # "Coloca Pisos e Lajes nos Ambientes usando Dados de Rooms e Levels - Rebaixa em Banheiros"
# ---------- coloca_pisos_e_lajes_nos.designscript (36 lines) ----------
Amb;
EPA;
Tvi;
Lev;
Tpn;
Tpr;
Til;
//------------------------------------------------------------------
//  Coloca Viga básica sob os eixos das paredes
//------------------------------------------------------------------
PAR = Element.GetLocation                    ( EPA                    );
AND = Wall.GetParameterValueByName           ( EPA , "Base Constraint");
VIG = StructuralFraming.BeamByCurve          ( PAR , AND , Tvi        );
//------------------------------------------------------------------
//  Captura Dados e Limites dos Compartimentos e faz polygonal com Offset
//------------------------------------------------------------------
cla = FamilyInstance.GetParameterValueByName ( Amb    , "Name"  );
Per = Room.CoreBoundary                      ( Amb              );
Cur = PolyCurve.ByJoinedCurves               ( Per<1> , 0       );
Pol = Curve.Offset                           ( Cur<1> , 0.045   );
//------------------------------------------------------------------
//  Seleciona os valores de offset de Pisos e Lajes
//------------------------------------------------------------------
Tip = cla=="BANHEIRO" ?  Tpr  : Tpn;
ola = cla=="BANHEIRO" ?  0.15 :   0;
opi = FamilyType.GetParameterValueByName ( Tip , "Default Thickness") - ola;
//------------------------------------------------------------------
//  Define o contorno dos Pisos e Lajes
//------------------------------------------------------------------
Pis = Floor.ByOutlineTypeAndLevel        ( Per<1> , Tip<1> , Lev[0] );
Laj = Floor.ByOutlineTypeAndLevel        ( Pol<1> , Til    , Lev[0] );
//------------------------------------------------------------------
//  Ajusta Offset de Pisos e Lajes
//------------------------------------------------------------------
Nip = FamilyInstance.SetParameterByName ( Pis , "Height Offset From Level" ,  opi );
Nij = FamilyInstance.SetParameterByName ( Laj , "Height Offset From Level" , -ola );
# ----------------------------------------
