# Dynamo graph Torre2.dyn (Dynamo 2.18.1.5096)

# group: Exemplo Coordenadas Cilíndricas para a formação de uma torre
# Desenvolvido como material didático para a Disciplina BIM;
# Prof: José Luis Menegotto  POLI/UFRJ
# O exemplo ilustra algumas técnicas de controle.
# Uso de dicionários.
# O aluno pode continuar a construção utilizando as funções para colocar membros analíticos e atribuir os seus roles.
# AnalyticalMember.ByCurve
# AnalyticalMember.SetStructuralRole
altura_total_da_torre = IntegerSlider(60, range=4..60 step 1)
altura_modulo_da_torre = DoubleSlider(4, range=4..6 step 0.25)
raio_da_base = DoubleSlider(7.25, range=5..10 step 0.25)
quantidade_de_lados = IntegerSlider(3, range=3..7 step 1)
inclinação_vertical = IntegerSlider(11, range=0..20 step 1)
structural_framing_types = StructuralFramingTypes("No structural framing types available.")
torre_poligonal_equilátera = CodeBlock(att=altura_total_da_torre, amt=altura_modulo_da_torre, rai=raio_da_base, lad=quantidade_de_lados, inc=inclinação_vertical, tbh=structural_framing_types)
# ---------- torre_poligonal_equilátera.designscript (56 lines) ----------
att;
amt;
rai;
lad;
inc;
tbh;

qmo = Math.Floor(att / amt);
v   = 0..qmo;
i   = 0..lad-1;
Circle.ByCenterPointRadius(Point.Origin(), 0.6);
altura = 0..(amt*qmo)..amt;
Niveis = Level.ByElevationAndName( altura , "Torre_Niv_ " + v);
Vistas = FloorPlanView.ByLevel   ( Niveis);
//--------------------------------------------------------------------------
//  Inclina e verifica o raio. O limite é 1.2 m desde ai segue reta.
//--------------------------------------------------------------------------
rf   = rai-(altura * Math.Tan(inc));
r    = Math.Sum(rf > 1.2 ? 1  : 0)-1;
rs   = rf > 1.2 ? rf : rf[r];
//--------------------------------------------------------------------------
//  Definição dos pontos
//--------------------------------------------------------------------------
csi   = CoordinateSystem.Identity();
ang   = 0..360..(360/lad);
alt   = altura * (rai * Math.Sqrt(3));
//--------------------------------------------------------------------------
//  Pontos do polígono regular da torre
//--------------------------------------------------------------------------
po   = Point.ByCylindricalCoordinates ( csi , ang<1> , altura , rs );
//--------------------------------------------------------------------------
//  Barras Horizontais e transposição
//--------------------------------------------------------------------------
BarH = Line.ByStartPointEndPoint      ( po[i] , po[i+1]    );
//--------------------------------------------------------------------------
//  Barras verticais
//--------------------------------------------------------------------------
bav  = Transpose( BarH );
j    = 0..List.Count(bav)-2;
BarV = Line.ByStartPointEndPoint( bav[j].StartPoint , bav[j+1].StartPoint );
//--------------------------------------------------------------------------
//  Barras Diagonais e pontos centrais de cada módulo
//--------------------------------------------------------------------------
Dia1 = Line.ByStartPointEndPoint( bav[j].StartPoint , bav[j+1].EndPoint   );
Dia2 = Line.ByStartPointEndPoint( bav[j].EndPoint   , bav[j+1].StartPoint );
Pcen = Line.Intersect(Dia1 , Dia2);
//--------------------------------------------------------------------------
//Colocação das barras horizontais
//--------------------------------------------------------------------------
//BHO = StructuralFraming.BeamByCurve(BarH, Niveis, tbh);
//--------------------------------------------------------------------------
// Semântica com o diccionário de elementos ordenados
//--------------------------------------------------------------------------
Chave  = ["BarrasH" , "BarrasV" , "BarrasD"     , "Centros"];
Valor  = [ BarH     ,  BarV     , [Dia1, Dia2]  , Pcen     ];
Dados  = Dictionary.ByKeysValues( Chave , Valor );
# ----------------------------------------
