# Dynamo graph Locar_No_Terreno.dyn (Dynamo 2.3.0.5885)

# group: Seleção do Lote
numero_do_lote = DoubleSlider(0, range=0..5 step 1)
seleção_de_Lotes = Custom[Seleção_de_Lotes](Indice_Lote=numero_do_lote)  # Seleciona lotes para processamento

# group: Análise do Lote
afastamento = DoubleSlider(1, range=0..4 step 0.1)
posição_longitudinal = DoubleSlider(0.59, range=0.01..0.99 step 0.005)
posição_transversal = DoubleSlider(0.46, range=0..1 step 0.005)
analisar_Divisas = Custom[Analisar_Divisas](Lote=seleção_de_Lotes, Afastamento=afastamento, Pos_Longitudinal=posição_longitudinal, Pos_Transversal=posição_transversal)  # Analisa linhas de força do terreno

# group: Definição dos Pavimentos
quantidade_de_andares_torre = DoubleSlider(6, range=1..25 step 1)
altura_piso_a_piso = DoubleSlider(3.25, range=3..4 step 0.25)
proporção_do_embasamento = DoubleSlider(3, range=1..10 step 1)
cria_Andares = Custom[Cria_Andares](Quant_Andares_Torre=quantidade_de_andares_torre, Altura_Piso_Piso=altura_piso_a_piso, Quant_Andares_Embas=proporção_do_embasamento)  # Criar andares

# group: Formalização da massa do prédio
ocupação_da_torre = DoubleSlider(10, range=10..100 step 5)
proporção_area_lado = DoubleSlider(1.284, range=0.1..10 step 0.001)
posicionamento_rotacional = DoubleSlider(8, range=0..25 step 1)
predio_Estudo = Custom[Predio_Estudo](Dic_Lote=analisar_Divisas, Dic_Andares=cria_Andares, Taxa_Ocupacao=ocupação_da_torre, Razao_Area_Lado=proporção_area_lado, Girar=posicionamento_rotacional)  # Predio para estudos preliminares

code_block = CodeBlock(Dic_Pre=predio_Estudo)
# ---------- code_block.designscript (10 lines) ----------
Dic_Pre;
//Dic_Pre["EMBAS"];
//Dic_Pre["TORRE"];
Dic_Pre["TORRE"];
Dic_Pre["SoliT"];
//Dic_Pre["SoliE"];
Dic_Pre["AreaT"];
Dic_Pre["GuiaT"];
Dic_Pre["GuiaE"];
Dic_Pre["SoliF"];
# ----------------------------------------
code_block_2 = CodeBlock(D=analisar_Divisas)
# ---------- code_block_2.designscript (12 lines) ----------
D;
D["PtsP"];
D["OCUP"];
D["PtsC"];
D["LinC"];
D["LinL"];
D["LinT"];
D["LinP"];
D["NoDe"];
D["NoFo"];
M = D["PtsM"];
V = D["PtsP"];
# ----------------------------------------
watch = Watch(code_block_2.out1)
watch_2 = Watch(code_block_2.out2)
