# Dynamo graph MET_Extrair_CSV.dyn (Dynamo 2.13.1.3887)

# group: Extração de Dados CSV para processamento em Navisworks
# As datas estão distribuidas linearmente por item para cumprir com a duração estimada da obra.
# Necessário usar o parâmetro de projeto UsoEstrutural associado a Fundações, Colunas e Vigas
drive = CodeBlock { "D"; }
categoria_fundações = Categories("OST_StructuralFoundation")
pega_todas_as_fundações = ElementsOfCategory(Category=categoria_fundações)
categoria_colunas = Categories("OST_StructuralColumns")
pega_todas_as_colunas = ElementsOfCategory(Category=categoria_colunas)
categoria_vigas = Categories("OST_StructuralFraming")
pega_todas_as_vigas = ElementsOfCategory(Category=categoria_vigas)
tempo_total_da_obra_estimado_em = DoubleSlider(175, range=7..365 step 7)  # "Tempo total da obra estimado em dias (TTO)"
cronograma_de_tarefas = CodeBlock(DRV=drive, FUN=pega_todas_as_fundações, COL=pega_todas_as_colunas, VIG=pega_todas_as_vigas, TTO=tempo_total_da_obra_estimado_em)
# ---------- cronograma_de_tarefas.designscript (60 lines) ----------
DRV;
FUN;
COL;
VIG;
TTO;
//------------------------------------------------------------------------
//Define local de gravação do arquivo CSV
//------------------------------------------------------------------------
pasta   = DRV+":\\JLMenegotto\\Academia\\00_Aulas_2022_1\\Curso_MET\\";
arqcsv  = "Modelo_Galpao.csv";
arquiv  = pasta + arqcsv;
//------------------------------------------------------------------------
//Ordena Porticos pela coordenada Y
//------------------------------------------------------------------------
FUNY    = List.SortByKey(FUN , FUN.Location.Y           )["sortedList"];
COLY    = List.SortByKey(COL , COL.Location.StartPoint.Y)["sortedList"];
VIGY    = List.SortByKey(VIG , VIG.Location.StartPoint.Y)["sortedList"];
//------------------------------------------------------------------------
//Separa Vigas e Terças
//------------------------------------------------------------------------
USOE    = FamilyInstance.GetParameterValueByName (VIGY , "UsoEstrutural");
VIGA    = List.Clean(USOE=="Viga"  ? VIGY : null, false);
TERC    = List.Clean(USOE=="Terca" ? VIGY : null, false);
//------------------------------------------------------------------------
//Unifica as listas ordenadas em uma única lista de Elementos
//Prepara índices para sequenciar temporalmente e Extrai parâmetro Custo
//------------------------------------------------------------------------
Elem    = List.Flatten ( [FUNY , COLY , VIGA , TERC ] , 1);
IeleI   = List.IndexOf ( Elem , Elem )+1;
IeleF   = IeleI + 1;
Qelem   = List.Count   ( IeleI );
TIPO    = FamilyInstance.GetParameterValueByName(Elem, "Type");
CUST    = FamilyType.GetParameterValueByName    (TIPO, "Cost");
//----------------------------------------------------------------------
// Prepara os tempos
//----------------------------------------------------------------------
DltItm  = TTO / Qelem;
diaIni  = IeleI * DltItm;
diaFim  = IeleF * DltItm;
Dia_1   = DSCore.DateTime.Today;
IniTare = DSCore.TimeSpan.Create      ( diaIni , 0, 0, 0, 0 );
FimTare = DSCore.TimeSpan.Create      ( diaFim , 0, 0, 0, 0 );
Data_TI = DSCore.DateTime.AddTimeSpan ( Dia_1  , IniTare    );
Data_TF = DSCore.DateTime.AddTimeSpan ( Dia_1  , FimTare    );
//--------------------------------------------------------------------
// Prepara os dados a extrair
//--------------------------------------------------------------------
INDC = FamilyInstance.GetParameterValueByName (Elem, "UsoEstrutural");
NUME = FamilyInstance.GetParameterValueByName (Elem, "Mark");
ID   = Elem.Id;
TIPT = List.OfRepeatedItem    ( "Construct" , Qelem   );
TARI = DSCore.DateTime.Format ( Data_TI , "dd/MM/yyyy");
TARF = DSCore.DateTime.Format ( Data_TF , "dd/MM/yyyy");
//---------------------------------------------------------------------
//Ordena e Escreve os dados em Arquivo CSV
//---------------------------------------------------------------------
cabe    = "TAREFA,ID,TIPOTAREFA,DATAI,DATAF,DATARI,DATARF,CUSTO";
vals    = [INDC+"_"+NUME+","+ID+","+TIPT+","+TARI+","+TARF+","+TARI+","+TARF+","+CUST];
dados   = List.AddItemToFront( cabe , List.Flatten( vals , 1));
DSOffice.Data.ExportCSV( arquiv , dados);
# ----------------------------------------
watch = Watch(cronograma_de_tarefas.TARI)
watch_2 = Watch(cronograma_de_tarefas.TARF)
watch_3 = Watch(cronograma_de_tarefas.FUNY)
watch_4 = Watch(cronograma_de_tarefas.CUST)
