# Dynamo graph MET_Treliças_Joist_CBCA_Tipo1-2.dyn (Dynamo 2.13.1.3887)

# group: Referência: CBCA - Treliças Joist - Flávio D´Alambert & Marcelo Pinheiro
# Algoritmo para geração: Curso de Especialização de Estruturas de Aço - Escola Politécnica - UFRJ.
# Disciplina:  ETM602 - Desenho, Montagem e Fabricação (CAD/CAM/BIM).
# Prof. José Luis Menegotto.
file_path = Filename(".\Treliça_CBCA_Tipos1-2.PNG")
file_from_path = FileObject(path=file_path)
readFromFile = Image.ReadFromFile(file=file_from_path)
watch_image = WatchImageCore(image=readFromFile)

file_path_2 = Filename(".\Planilha_Dados.xlsx")
file_from_path_2 = FileObject(path=file_path_2)

# group: Referência: CBCA - Treliças Joist - Flávio D´Alambert & Marcelo Pinheiro
# Algoritmo para geração: Curso de Especialização de Estruturas de Aço - Escola Politécnica - UFRJ.
# Disciplina:  ETM602 - Desenho, Montagem e Fabricação (CAD/CAM/BIM).
# Prof. José Luis Menegotto.
levels = Levels("Level 2")  # graph input
tipo_de_treliça = DoubleSlider(1, range=1..2 step 1)  # graph input
vão_l = DoubleSlider(14000, range=6000..20000 step 500)  # graph input
altura_andar = DoubleSlider(6750, range=5000..12000 step 250)  # graph input
quantidade_de_paineis = DoubleSlider(18, range=2..60 step 2)  # graph input
largura_do_apoio = DoubleSlider(400, range=200..500 step 50)  # graph input
extensão_banzo_inferior = DoubleSlider(200, range=0..500 step 50)  # graph input
tipo_de_viga = StructuralFramingTypes("UB406x178x60")  # graph input
tipo_de_pilar = StructuralColumnTypes("UC356x368x129")  # graph input
tipo_de_terças = StructuralFramingTypes()  # nothing selected; graph input
pontos_e_linhas_da_treliça = CodeBlock(And=levels, TiTr=tipo_de_treliça, DimL=vão_l, DimH=altura_andar, qpai=quantidade_de_paineis, lap=largura_do_apoio, ebi=extensão_banzo_inferior, tiv=tipo_de_viga, tip=tipo_de_pilar, tit=tipo_de_terças)
# ---------- pontos_e_linhas_da_treliça.designscript (67 lines) ----------
And;
TiTr;
DimL;
DimH;
qpai;
lap;
ebi;
tiv;
tip;
tit;

Tipo2 = TiTr==2 ? true : DimL>12000 ? true : false;
LVL   = Level.SetParameterByName (And, "Elevation", DimH );
vx    = DimL/2;
vy    = 0;
vz    = DimH;

x0    = -(vx-lap)..(vx-lap)..#(qpai*2)+1;
y0    = 0;
//-------------------------------------------------------------
// Altura de Triângulo Equilátero
//-------------------------------------------------------------
dimP = x0[2]-x0[0];
Altu = (dimP * Math.Sqrt(3))/2;
zs   = DimH;
zi   = DimH - Altu;
//------------------------------------------------------------
//  Indices para lançamento dos elementos da treliça
//------------------------------------------------------------
q    = List.Count( x0 );
i    = 0..q-1..2;
j    = 1..q-2..2;
k    = 2..q-1..2;
m    = 2..q-2..2;
//------------------------------------------------------------
//  Pontos iniciais do Banzo Superior e Inferior
//------------------------------------------------------------
PtBS  = Point.ByCoordinates(x0 , y0 , zs);
PtBI  = Point.ByCoordinates(x0 , y0 , zi);
//------------------------------------------------------------
// Linhas dos Banzos
//------------------------------------------------------------
LiBZS   = Line.ByStartPointEndPoint(PtBS[0] , PtBS[-1]);
LiBZI   = Line.ByStartPointEndPoint(PtBI[1] , PtBI[-2]);
LiBZSE1 = Line.ExtendStart( LiBZS , lap );
LiBZSE2 = Line.ExtendEnd  ( LiBZS , lap );
          Line.ExtendStart( LiBZI , ebi );
          Line.ExtendEnd  ( LiBZI , ebi );
//------------------------------------------------------------
// Linhas das Diagonais e Montantes só no caso Tipo 2
//------------------------------------------------------------
LiDIA1 =        Line.ByStartPointEndPoint( PtBS[i] , PtBI[j] );
LiDIA2 =        Line.ByStartPointEndPoint( PtBI[j] , PtBS[k] );
LiMONT = Tipo2? Line.ByStartPointEndPoint( PtBS[m] , PtBI[m] ):null;
//------------------------------------------------------------
// Pontos e Linhas dos pilares
//------------------------------------------------------------
Pt1   = LiBZSE1.StartPoint;
Pt2   = LiBZSE2.EndPoint;
Pt01  = Point.ByCoordinates ( Pt1.X , Pt1.Y , 0 );
Pt02  = Point.ByCoordinates ( Pt2.X , Pt2.Y , 0 );
LiPIE = Line.ByStartPointEndPoint( Pt01, Pt1 );
LiPID = Line.ByStartPointEndPoint( Pt02, Pt2 );
//------------------------------------------------------------
chaves  = [ "Diag1"       , "Diag2"       , "Mont" ];
valores = [ LiDIA1.Length , LiDIA2.Length , LiMONT.Length ];
Dictionary.ByKeysValues(chaves, valores);
# ----------------------------------------

faz_a_leitura_e_escrita_na = CodeBlock(arqE=file_from_path_2, Dados=pontos_e_linhas_da_treliça.out45)  # "Faz a leitura e escrita na planilha"
# ---------- faz_a_leitura_e_escrita_na.designscript (11 lines) ----------
arqE;
Dados;
Vdia1 = Dados["Diag1"];
Vdia2 = Dados["Diag2"];
Vmont = Dados["Mont"];
//------------------------------------------------------------------------
//Escrever dados no Excel
//------------------------------------------------------------------------
dadosD1 = DSOffice.Data.ExportToExcel (arqE  , "Treliça", 0 , 0, Vdia1, false , false );
dadosD2 = DSOffice.Data.ExportToExcel (arqE  , "Treliça", 0 , 1, Vdia2, false , false );
Montant = DSOffice.Data.ExportToExcel (arqE  , "Treliça", 0 , 2, Vmont, false , false );
# ----------------------------------------
watch = Watch(faz_a_leitura_e_escrita_na.Vmont)
watch_2 = Watch(faz_a_leitura_e_escrita_na.Vdia2)
watch_3 = Watch(faz_a_leitura_e_escrita_na.Vdia1)
