# Dynamo graph Matriz_XYZ.dyn (Dynamo 2.17.1.4055)

# group: Matriz Retangular
# Desenvolvido como material didático para a Disciplina BIM;
# Prof: José Luis Menegotto  POLI/UFRJ
DX = DoubleSlider(4.5, range=1..10 step 0.25)
DY = DoubleSlider(9.5, range=1..10 step 0.25)
altura_andar = DoubleSlider(3.6, range=3.6..6 step 0.18)
quanti_x = IntegerSlider(10, range=1..10 step 1)
quanti_y = IntegerSlider(7, range=1..10 step 1)
quantidade_de_andares = IntegerSlider(12, range=1..25 step 1)
cota_rn = CodeBlock { 3.45; }
matriz_retangular_xyz = CodeBlock(dx=DX, dy=DY, dz=altura_andar, qx=quanti_x, qy=quanti_y, qz=quantidade_de_andares, cotaRN=cota_rn)
# ---------- matriz_retangular_xyz.designscript (27 lines) ----------
dx;
dy;
dz;
qx;
qy;
qz;
cotaRN;

a  = 0..qx;
b  = 0..qy;
c  = 0..qz;

x  = (a * dx);
y  = (b * dy);
z  = (c * dz) + cotaRN;

px = Point.ByCoordinates( x<1> , y    , z<2> );
py = Point.ByCoordinates( x    , y<1> , z<2> );
pz = Point.ByCoordinates( x<2> , y    , z<1> );

vx = Line.ByStartPointEndPoint( px[i] , px[i+1] );
vy = Line.ByStartPointEndPoint( py[j] , py[j+1] );
co = Line.ByStartPointEndPoint( pz[k] , pz[k+1] );

i  = 0..Count(px)-2;
j  = 0..Count(py)-2;
k  = 0..Count(pz)-2;
# ----------------------------------------
code_block = CodeBlock(alt=matriz_retangular_xyz.z, vx=matriz_retangular_xyz.vx, vy=matriz_retangular_xyz.vy, cz=matriz_retangular_xyz.co)
# ---------- code_block.designscript (12 lines) ----------
alt;
vx;
vy;
cz;
pav  = 0..List.Count( alt )-1;
max  = pav[-1];
nome = pav==0 ? "Térreo" : pav==max ? "Cobertura" : pav+"° Andar";

Andares = Level.ByElevationAndName( alt , nome );

//VigasX  = StructuralFraming.BeamByCurve (vx, Andares, tipov);
//VigasY  = StructuralFraming.BeamByCurve (vy, Andares, tipov);
# ----------------------------------------
structural_column_types = StructuralColumnTypes("HP200X53")
structural_framing_types = StructuralFramingTypes("W150X24")
