# Dynamo graph PPE_Matriz_OCAD.dyn (Dynamo 2.12.0.5650)

X = DoubleSlider(7.5, range=1.25..10 step 1.25)
Y = DoubleSlider(7.5, range=1.25..10 step 1.25)
QX = DoubleSlider(12, range=2..15 step 1)
QY = DoubleSlider(7, range=2..10 step 1)
quantidade_de_divisões = DoubleSlider(7, range=1..10 step 1)
matriz_ocad = CodeBlock(x=X, y=Y, qx=QX, qy=QY, ns=quantidade_de_divisões)
# ---------- matriz_ocad.designscript (43 lines) ----------
x;
y;
qx;
qy;
ns;
Vz      = Vector.ZAxis();
cx      = 0..#qx..x;
cy      = 0..#qy..y;
tx      = 0..#qx-1..x;
ty      = 0..#qy-1..y;
ix      = 0..qx-2;
jx      = 1..qx-1;
iy      = 0..qy-2;
jy      = 1..qy-1;
e       = [0 , -1];
t       = [1 , -2];
//Project Base Point  --------------------------------------------
PBP     = Coordinates.BasePoint();
//Matriz de pontos e Barras em sentido X BaX e Y BaY -------------
PP      = Point.ByCoordinates       ( cx<1>   , cy ,  0 );
PO      = Point.Translate           ( PP , PBP.X, PBP.Y-30 , PBP.Z);
PT      = Transpose                 ( PO                );
BaX     = Line.ByStartPointEndPoint ( PO[ix] , PO[jx] );
BaY     = Line.ByStartPointEndPoint ( PT[iy] , PT[jy] );
//Travamentos cruzados -------------------------------------------
LX      = [ PO[0][0] , PO[1][1] , PO[1][0]  , PO[0][1] ];
TX1     = Line.ByStartPointEndPoint ( LX[0] , LX[1]          );
TX2     = Line.ByStartPointEndPoint ( LX[2] , LX[3]          );
Tr1     = Line.Translate            ( TX1   , tx<1> , ty , 0 );
Tr2     = Line.Translate            ( TX2   , tx<1> , ty , 0 );
//Pilares --------------------------------------------------------
PExt    = List.UniqueItems (List.Flatten( [PO[e] , PT[e]] , 3));
PInt    = List.UniqueItems (List.Flatten( [PO[t] , PT[t]] , 3));
Orden   = [ PExt , PInt ];
Pilares = Line.ByStartPointDirectionLength(Orden, Vz , x );
//Sistema de Vigas Secundarias -----------------------------------
Arma    = x>y ? [BaY, BaX] : [BaX , BaY];
Ptrf    = Line.PointAtParameter     ( Tr1<1> , 0.0 );
ns;
//----------------------------------------------------------------
Ke      = ["BarrasX" , "BarrasY" , "Travamentos" , "Pilares" ];
Va      = [ BaX      , BaY       ,  [Tr1, Tr2]   ,  Pilares  ];
Dic     = Dictionary.ByKeysValues( Ke , Va );
# ----------------------------------------
sistema_de_vigas_secundárias = CodeBlock(Barras=matriz_ocad.out31, P0=matriz_ocad.out32, q=matriz_ocad.out33)
# ---------- sistema_de_vigas_secundárias.designscript (15 lines) ----------
Barras;
P0;
q;
dvao = Barras[0][0][0].Length;
dima = Barras[1][0][0].Length;
dir1 = Line.TangentAtParameter ( Barras[0][0][0] , 0 );
dir2 = Line.TangentAtParameter ( Barras[1][0][0] , 0 );
dv   = (0..1..#q+1)*dima;
di   = List.RemoveItemAtIndex          ( dv    , [q , 0] );
P1   = Point.Translate                 ( P0<1> , dir2 , dv<2>);
VigS = Line.ByStartPointDirectionLength( P1    , dir1 , dvao );
//----------------------------------------------------------------
Ke   = ["Vigas Sec" ];
Va   = [ VigS       ];
Dic  = Dictionary.ByKeysValues( Ke , Va );
# ----------------------------------------
