# Dynamo graph PPE_Topografia.dyn (Dynamo 2.3.1.11775)

# group: Cota média de implantação
densidade_da_matriz_de_pontos = DoubleSlider(12, range=1..30 step 1)
nomes_do_terreno_e_do_lote_a = CodeBlock { "TopoLote"; "Lote01"; }  # "Nomes do terreno e do Lote a serem processados"
# note: Função Dynamo-Revit
# Autor: Prof. José Luis Menegotto
# Objetivo:  Ensino disciplina BIM
# Tema: Topografia - Estimativa de cálculo para a cota de impantação do projeto
# Caso a criação da nova topografia acusar pontos na mesma posição alterar a densidade da matriz de pontos.
# Recortar o terreno original com a função Split para diminuir a quantidade de faces a serem processadas e delimitar o estudo ao lote do projeto.
# Os pontos calculados na cota do terreno foram divididos em 3 classes.
# Pontos extremos da linha de divisa;
# Pontos internos na Matriz
# Pontos distribuidos sobre a linha da divisa
# O cálculo de volume de corte e aterro pode ser realizado calculando a area de uma unidade da matriz regular de pontos e multiplicando pela altura média dessa célula de área e multiplicando por um fator de empolamento. Esse fator de empolamento pode ser incorpodado para definir uma cota ideal de implantação quando se calcula a cota média da plataforma na linha.
# CotaMe  = Line.PointAtParameter ( LinDec , 0.5 ).Z;
# Esse fator poderia ser um parâmetro de entrada numérico (Slider) que o projetista poderia ajustar.
categories = Categories("OST_Topography")
all_elements_of_category = ElementsOfCategory(Category=categories)
categories_2 = Categories("OST_SiteProperty")
all_elements_of_category_2 = ElementsOfCategory(Category=categories_2)
cria_surfaces_a_partir_do = CodeBlock(Filtro_Topo=nomes_do_terreno_e_do_lote_a.out0, Filtro_Lote=nomes_do_terreno_e_do_lote_a.out1, Topo=all_elements_of_category, Lote=all_elements_of_category_2)  # "Cria Surfaces a partir do Terreno"
# ---------- cria_surfaces_a_partir_do.designscript (26 lines) ----------
Filtro_Topo;
Filtro_Lote;
Topo;
Lote;

TopoNome = Element.GetParameterValueByName ( Topo     , "Name");
LoteNome = Element.GetParameterValueByName ( Lote     , "Name");
i        = List.IndexOf                    ( TopoNome , Filtro_Topo );
j        = List.IndexOf                    ( LoteNome , Filtro_Lote );

ETopo    = Topo[i];
ELote    = Lote[j];
GTopo    = Element.Geometry      ( ETopo );
GLote    = Element.Geometry      ( ELote );
//--------------------------------------------------------------------

PtTopo  = Topography.Points     ( ETopo );

// Extração das Faces Triangulares da Topografia ---------------------
Malha   = Topography.Mesh       ( ETopo );
Ifa     = Mesh.FaceIndices      ( Malha );
pf1     = PtTopo[Ifa.A];
pf2     = PtTopo[Ifa.B];
pf3     = PtTopo[Ifa.C];
LPF     = Transpose([ pf1, pf2, pf3 ]);
FACTRI  = Surface.ByPerimeterPoints( LPF );
# ----------------------------------------
pontos_da_divisa_na_cota_do = CodeBlock(qp=densidade_da_matriz_de_pontos, GLote=cria_surfaces_a_partir_do.GLote, FACTRI=cria_surfaces_a_partir_do.FACTRI)  # "Pontos da divisa na cota do terreno"
# ---------- pontos_da_divisa_na_cota_do.designscript (48 lines) ----------
qp;
GLote;
FACTRI;
VZ      = Vector.ZAxis();
// ------------------------------------------------------------------
// Definição da Matriz de pontos internos do Lote e Pt das dividas --
// ------------------------------------------------------------------
BB      = BoundingBox.ByGeometry      ( GLote );
Q1      = BB.MinPoint;
Q2      = BB.MaxPoint;
x       = List.Flatten                ( Q1.X..Q2.X..#qp , 1 );
y       = List.Flatten                ( Q1.Y..Q2.Y..#qp , 1 );
PtIN0   = Point.ByCoordinates         ( x<1> , y , 0 );
PtLQ0   = Line.PointAtParameter       ( GLote<1> , 0);
PtLD0   = Line.PointAtParameter       ( GLote<1> , 0.1..0.9..#qp/3);
// ------------------------------------------------------------------
// Projeções dos pontos da cota 0 para a cota do terreno
// Quinas da divisa, Divisa e Internos
// ------------------------------------------------------------------
PtINC   = List.Flatten                ( PtIN0.Project (FACTRI<1>, VZ), 3);
PtLQC   = List.Flatten                ( PtLQ0.Project (FACTRI<1>, VZ), 3);
PtLDC   = List.Flatten                ( PtLD0.Project (FACTRI<1>, VZ), 3);
// Linha de Declividade do Lote e cota media -----------------------
LinDec  = Line.ByBestFitThroughPoints ( PtINC );
CotaMe  = Line.PointAtParameter       ( LinDec , 0.5 ).Z;
// Plataforma Horizontal na cota media --------------------------------
PolyLo  = PolyCurve.ByJoinedCurves    ( GLote );
Plataf  = Surface.ByPatch             ( PolyLo ).Translate( 0, 0 , CotaMe);

PtInt   = Point.ByCoordinates         ( PtINC.X , PtINC.Y , CotaMe );
PtQui   = Point.ByCoordinates         ( PtLQC.X , PtLQC.Y , CotaMe );
PtLot   = Point.ByCoordinates         ( PtLDC.X , PtLDC.Y , CotaMe );

LVI     = Line.ByStartPointEndPoint   ( PtInt    , PtINC           );
LVQ     = Line.ByStartPointEndPoint   ( PtQui    , PtLQC           );
LVL     = Line.ByStartPointEndPoint   ( PtLot    , PtLDC           );
// Linha de Interseção Horiz entre a Plataforma e o terreno -----------
LinInt  = Geometry.Intersect          ( Plataf   , FACTRI<1> );
// --------------------------------------------------------------------
// Lista de pontos nova topografia formada pelas 3 listas pontos Internos
// Quinas da divisa e divisões da divisa
// --------------------------------------------------------------------
Pt_Novos = List.UniqueItems(List.Flatten( [ PtINC , PtLQC , PtLDC ] , 1));
// --------------------------------------------------------------------
// Criação da nova topografia regularizada
// --------------------------------------------------------------------
NovaREG  = Topography.ByPoints( Pt_Novos );
NovaNom  = NovaREG.SetParameterByName( NovaREG , "Name", "NovaTopografia");
# ----------------------------------------
cota_media_de_implantação = Watch(pontos_da_divisa_na_cota_do.CotaMe)
