# Dynamo custom node Predio_Estudo.dyf (Dynamo 2.3.0.5885)
# category: Prédios
# Predio para estudos preliminares

Dic_Lote = Input(Dic_Lote: var[]..[])
Dic_Andares = Input(Dic_Andares: var[]..[])
Taxa_Ocupacao = Input(Taxa_Ocupacao: var[]..[])
Razao_Area_Lado = Input(Razao_Area_Lado: var[]..[])
Girar = Input(Girar: var[]..[] = 0)
posicionamento_de_projeto_no = CodeBlock(Dic_Lote=Dic_Lote, Dic_Pavt=Dic_Andares, TAXA=Taxa_Ocupacao, PROP=Razao_Area_Lado, G=Girar)  # "Posicionamento de projeto no lote"
# ---------- posicionamento_de_projeto_no.designscript (59 lines) ----------
Dic_Lote;
Dic_Pavt;
TAXA;
PROP;
G;

APRO  = (AreaL * TAXA) / 100;
T     = Dic_Lote["T"    ];
O     = Dic_Lote["O"    ];
N     = Dic_Lote["N"    ];
OLOC  = Dic_Lote["OLOC" ];
PtsO  = Dic_Lote["PtsO" ];
Angu  = Dic_Lote["Angu" ];
AreaL = Dic_Lote["AreaL"];
Andar = Dic_Pavt["Andar"];
Cotas = Dic_Pavt["Cota" ];
QAE   = Dic_Pavt["QAE"  ];

Vz    = Vector.ZAxis  (         );
mg    = List.Count    (  Angu@L1   )+1;
QAT   = List.Count    (  Cotas  );
Girar = List.SetUnion ( [0, 90] , List.Flatten( Angu , 1));
//-------------------------------------------------------
// Definição do Embasamento a partir dos pontos PtsO
//-------------------------------------------------------

GuiaE = Line.ByStartPointDirectionLength( OLOC , Vz , Cotas[QAE]       );
PoliE = PolyCurve.ByPoints   ( PtsO  , true                            );
SurfE = Surface.ByPatch      ( PoliE                                   );
SoliE = Solid.BySweep        ( PoliE , GuiaE                           );
EMBAS = Geometry.Translate   ([PoliE , SurfE] , 0, 0, Cotas[0..QAE]<1> );

//-------------------------------------------------------
// Definição da torre do prédio a partir da Origem OLOC
//-------------------------------------------------------

GuiaT = Line.ByStartPointDirectionLength( OLOC , Vz , Cotas[QAT-1]);
l1    = Math.Sqrt( APRO / PROP);
l2    =              l1 * PROP;
cx    = [ l1 ,  l1, -l1, -l1] * 0.5;
cy    = [ l2 , -l2, -l2,  l2] * 0.5;
x     = T<1>.Scale            (  cx                                     );
y     = N<1>.Scale            (  cy                                     );
xy    = x.Add                 (   y                                     );
PQ    = OLOC.Add              (  xy                                     );
PQR   = Point.Rotate          (  PQ    , OLOC , Vz , Girar[G%mg]        );
PoliT = PolyCurve.ByPoints    (  PQR   , true                           );
SurfT = Surface.ByPatch       (  PoliT                                  );
SoliT = Solid.BySweep         (  PoliT , GuiaT                          );
TORRE = Geometry.Translate    ( [PoliT , SurfT] , 0, 0, Cotas[0..QAT]<1>);
AreaT = SurfT.Area;
SoliF = Solid.Difference      ( SoliE  , SoliT                          );
//-------------------------------------------------------
// Extração dos resultados utilizando um Dicionário
//-------------------------------------------------------

Key  = ["GuiaT","GuiaE","EMBAS","TORRE","SurfE","SurfT","PoliE","PoliT","AreaT","APRO","SoliE","SoliT","SoliF"];
Val  = [ GuiaT , GuiaE , EMBAS , TORRE , SurfE , SurfT , PoliE , PoliT , AreaT , APRO , SoliE , SoliT , SoliF ];
DIC  = Dictionary.ByKeysValues ( Key , Val );
# ----------------------------------------
Dados = Output(posicionamento_de_projeto_no.DIC)
code_block = CodeBlock()
# ---------- code_block.designscript (6 lines) ----------
//Definição do Embasamento com segmentação em dir N T o nula
//FOR  = (SEG==0 ? SUC : SEG==1 ? SUL : SEG==2 ? SUT : SUA);
//SUL  = List.Flatten (Surface.Split ( SUC   , ExoL         ) , 2);
//SUT  = List.Flatten (Surface.Split ( SUC   , ExoT         ) , 2);
//SUA  = List.Flatten (Surface.Split ( SUC<1>,[ExoL , ExoT] ) , 2);
//Emba = Geometry.Translate          ( FOR , 0 , 0 , PAV["Cota"] );
# ----------------------------------------
