# Dynamo graph Viaduto_Millau_2023.dyn (Dynamo 2.13.1.3887)

# group: Função comentada de marcação da estrutura do Viaduto Millau. Revit 2023.
# Escola Politécnica da UFRJ. Departamento de Expressão Gráfica.
# Disciplina: Desenho Computacional
# Autor: Prof. José Luis Menegotto
Z1 = DoubleSlider(0, range=0..100 step 0.1)
longitude = DoubleSlider(2350, range=1000..2500 step 50)
flecha = DoubleSlider(51.7, range=1..150 step 0.1)
altura_do_mastro = DoubleSlider(89, range=80..200 step 0.5)
altura_do_pilone = DoubleSlider(244, range=100..260 step 1.5)
parâmetro_superior_dos_estais = DoubleSlider(0.97, range=0.7..0.99 step 0.01)
parâmetro_inferior_dos_estais = DoubleSlider(0.57, range=0.5..0.65 step 0.01)
deslocar_estais_do_centro = DoubleSlider(1, range=0..4 step 1)
viaduto_millau_marcação_da = CodeBlock(z1=Z1, longi=longitude, corda=flecha, AltMastro=altura_do_mastro, AltPilone=altura_do_pilone, es=parâmetro_superior_dos_estais, ei=parâmetro_inferior_dos_estais, dc=deslocar_estais_do_centro)  # "Viaduto Millau - Marcação da estrutura."; unwired: Lp1, Lp2
# ---------- viaduto_millau_marcação_da.designscript (87 lines) ----------
z1;
longi;
corda;
AltMastro;
AltPilone;
es;
ei;
dc;
qe        = 11.0;
AltCaixao =  4.5;
Modulos   = 14.0;
ModulosX  = Modulos * 20;
AltPista  = AltPilone + AltCaixao;
AltPilone;
VZ        = Vector.ZAxis();
// ----------------------------------------------------
// Definição dos arcos da pista
// ----------------------------------------------------
p1      = Point.ByCoordinates ( 0       , 0     , z1 );
p2      = Point.ByCoordinates ( longi/2 , corda , z1 );
p3      = Point.ByCoordinates ( longi   , 0     , z1 );
Eixo    = Arc.ByThreePoints   ( p1 , p2 , p3         );
Pista   = Eixo.Translate      ( 0  , 0  , AltPista   );
// ----------------------------------------------------
// Segmentação dos módulos construtivos da pista
// ----------------------------------------------------
Comprim = Arc.Length ( Eixo );
CaixaoL = Comprim / ModulosX;
PtoPil1 = Arc.PointsAtEqualSegmentLength ( Eixo    , Modulos          );
PtoPil2 = List.TakeEveryNthItem          ( PtoPil1 , 2 , 1            );
PtoMast = Point.Translate                ( PtoPil2 , 0 , 0 , AltPista );
// ----------------------------------------------------
// Posicionamento dos pilones e dos mastros
// ----------------------------------------------------
Pilones = Line.ByStartPointDirectionLength(PtoPil2, VZ, AltPilone);
Mastros = Line.ByStartPointDirectionLength(PtoMast, VZ, AltMastro);
// ----------------------------------------------------
// Definição dos pontos dos Estais sobre os Mastros
// ----------------------------------------------------
p_MEsq  = List.TakeItems        ( ei..es..(es-ei)/(qe+2) , 11 );
p_MDir  = List.Reverse          ( p_MEsq );
CabMa_E = Line.PointAtParameter ( Mastros<1> , p_MEsq );
CabMa_D = Line.PointAtParameter ( Mastros<1> , p_MDir );
Pini    = Mastros[0].StartPoint;
Caix    = Line.PointsAtSegmentLengthFromPoint( Pista , Pini , CaixaoL );
Norm    = Line.NormalAtParameter  (Pista , Line.ParameterAtPoint(Pista, Caix));
// ----------------------------------------------------
// Segmentação da pista no sentido transversal
// ----------------------------------------------------
LTra1   = Line.ByStartPointDirectionLength ( Caix   , Norm ,  16.02    );
LTra2   = Line.ByStartPointDirectionLength ( Caix   , Norm , -16.02    );
PExtr1  = Line.PointAtParameter            ( LTra1  , 1                );
PExtr2  = Line.PointAtParameter            ( LTra2  , 1                );
PCen1s  = Line.PointAtSegmentLength        ( LTra1  , 2.50             );
PCen2s  = Line.PointAtSegmentLength        ( LTra2  , 2.50             );
PCen1i  = Point.Translate                  ( PCen1s , 0, 0, -AltCaixao );
PCen2i  = Point.Translate                  ( PCen2s , 0, 0, -AltCaixao );
// ----------------------------------------------------
// Marcação dos Extremos do caixão
// ----------------------------------------------------
Lpcaix  = Line.ByStartPointEndPoint ( Lp1 , Lp2);
LCen1i  = Line.ByStartPointEndPoint ( PCen1s , PCen1i);
LCen2i  = Line.ByStartPointEndPoint ( PCen2s , PCen2i);
LCenho  = Line.ByStartPointEndPoint ( PCen1i , PCen2i);
LIncl1  = Line.ByStartPointEndPoint ( PExtr1 , PCen1i);
LIncl2  = Line.ByStartPointEndPoint ( PExtr2 , PCen2i);
Poli_X  = PolyCurve.ByJoinedCurves  ([LTra1, LTra2, LIncl2, LCenho, LIncl1], 0.1);
// ----------------------------------------------------
// Divisão do Arco da Pista em Segmentos entre Mastros
// ----------------------------------------------------
pe      = List.Reverse          ( 0..0.5..1/20 ) + (0.05 * dc);
pd      = List.Reverse          ( 0.5..1..1/20 ) - (0.05 * dc);
Segmet  = Arc.SplitByPoints     ( Pista     , PtoPil1 );
SegEsq  = List.TakeEveryNthItem ( Segmet    , 2  , 1  );
SegDir  = List.TakeEveryNthItem ( Segmet    , 2  , 2  );
CabPi_E = Line.PointAtParameter ( SegEsq<1> , pe      );
CabPi_D = Line.PointAtParameter ( SegDir<1> , pd      );
// ----------------------------------------------------
// Traçado das Harpas
// ----------------------------------------------------
Estai_E = Line.ByStartPointEndPoint ( CabMa_E , CabPi_E );
Estai_D = Line.ByStartPointEndPoint ( CabMa_D , CabPi_D );
// ----------------------------------------------------
// Colocação dos Levels
// ----------------------------------------------------
Level.ByElevationAndName(AltPista , "Viaduto_Pista");
Level.ByElevationAndName(p1.Z     , "Viaduto_Base");
# ----------------------------------------
